# Grasshopper definition 1_Panel Component Parameters.gh (Grasshopper 1.0.7)

skindesigner = SkinDesigner_SkinDesigner()  # -> out
# ---------- skindesigner: Python ----------
# SkinDesigner: A Plugin for Building Skin Design (GPL) started by Santiago Garay

# This file is part of SkinDesigner.
# 
# Copyright (c) 2017, Santiago Garay <sgaray1970@gmail.com> 
# SkinDesigner is free software; you can redistribute it and/or modify 
# it under the terms of the GNU General Public License as published 
# by the Free Software Foundation; either version 3 of the License, 
# or (at your option) any later version. 
# 
# SkinDesigner is distributed in the hope that it will be useful,
# but WITHOUT ANY WARRANTY; without even the implied warranty of 
# MERCHANTABILITY or FITNESS FOR A PARTICULAR PURPOSE. See the 
# GNU General Public License for more details.
# 
# You should have received a copy of the GNU General Public License
# along with SkinDesigner; If not, see <http://www.gnu.org/licenses/>.
# 
# @license GPL-3.0+ <http://spdx.org/licenses/GPL-3.0+>


# By Santiago Garay
# SkinDesigner_SkinDesigner


"""
This is the main SkinDesigner component which contains the Panel, Skin and BaseDesignFunction APIs. 
-
    Args:


    Returns:


"""

ghenv.Component.Name = "SkinDesigner_SkinDesigner"
ghenv.Component.NickName = 'SkinDesigner'
ghenv.Component.Message = 'VER 0.5.01\nSep_14_2018'
ghenv.Component.Category = "SkinDesigner"
ghenv.Component.SubCategory = "01 | Construction"
try: ghenv.Component.AdditionalHelpFromDocStrings = "1"
except: pass

# push SkinDesigner component to back
ghenv.Component.OnPingDocument().SelectAll()
ghenv.Component.Attributes.Selected = False
ghenv.Component.OnPingDocument().BringSelectionToTop()
ghenv.Component.OnPingDocument().DeselectAll()

import rhinoscriptsyntax as rs
import copy
from types import *
import scriptcontext as sc
import Rhino
import Rhino.Geometry as rg
import random
import math




#init set up global variables

sc.doc = Rhino.RhinoDoc.ActiveDoc
unitSystem = sc.doc.ModelUnitSystem
_UNIT_COEF = 1
if unitSystem == Rhino.UnitSystem.Feet: _UNIT_COEF = 3.28084
if unitSystem == Rhino.UnitSystem.Inches: _UNIT_COEF = 3.28084*12
if unitSystem == Rhino.UnitSystem.Millimeters: _UNIT_COEF = 1000
sc.doc = ghdoc



class Panel:
    
    
    
    #----------------------------------------------------------------------------------------------------------------------
    #CONSTRUCTOR ----------------------------------------------------------------------------------------------------------------------
    def __init__(self, isSurfacePanel=False):
        
        #Doc Parameters
        self.__m_unitCoef = _UNIT_COEF #Coeficient used to adjust dimensions used inside Panel Class (Meter is 1)
        self.__m_dimRoundCoef = 1.01  #Coeficient ot absorb panel grid dimensions rounding errors
        
        #Skin Context Parameters
        self.__m_SkinParent = None
        self.__m_SkinParentName = None
        self.__m_SkinPlacementType = None
        
        #Panel Parameters
        self.__m_strName = ""
        self.__m_arrBlockInstances=[]
        self.__m_strDrawMode = "DEFAULT"
        self.__m_blnSurfacePanelMode = isSurfacePanel
        self.__m_intSurfacePanelSides = None
        self.__m_arrPanelOffsetPoints = [0,0,0,0]#offset from Rectangular Panel in Surface Panel Mode
        self.__m_ConformedPanelSurface = None
        self.__m_warningData = [] # panel warning data will be stored here
        
        #Wall Default Parameters
        self.__m_dblHeight = 3.5 * self.__m_unitCoef
        self.__m_dblWidth = 1.5 * self.__m_unitCoef
        self.__m_dblWallThickness = 0.1 * self.__m_unitCoef
        self.__m_blnShowWall = True
        self.__m_arrWallObjects = [0]
        self.__m_arrWallBreps = [0] 
        
        #Pane Parameters (default feet units)
        self.__m_strPaneName = "Default-Pane"
        self.__m_dblPaneThickness = 0.02 * self.__m_unitCoef
        self.__m_dblPaneOffset = 0.06 * self.__m_unitCoef
        self.__m_dblPaneOffsetEdge = 0
        self.__m_blnShowPane = False
        self.__m_arrPaneObjects = [0]
        self.__m_arrPaneBreps = [0]
        self.__m_dblPaneTileWidth = 0
        self.__m_dblPaneTileHeight = 0
        self.__m_dblPaneTileThickness = 0
        self.__m_dblPaneTileGap = 0
    
        #Window
        self.__m_arrWindowPoints = [0,0,0,0]
        self.__m_dblWinGlassThickness = 0    #: Glass Thickness
        self.__m_dblWinGlassOffset = 0       #: Distance From Outer Surface of Glass to Outer Surface of Wall
        self.__m_arrWindowObjects = [0]
        self.__m_arrWindowBreps = [0]
        self.__m_blnShowWindow = False
        self.__m_arrWindowUserData = dict(width=0, height=0, fromLeft=0, fromBottom=0, recess = 0, thickness = 0)
        self.__m_blnWindowConformSurfaceAsPanel  = False
        self.__m_ConformedWindowSurface = None
        
        #Mulions Parameters (default feet units)
        self.__m_dblMullionWidth = 0.05 * self.__m_unitCoef
        self.__m_dblMullionThickness = 0.1 * self.__m_unitCoef
        self.__m_dblMullionCapThickness = 0.05 * self.__m_unitCoef
        self.__m_blnShowMullions = False
        self.__m_blnShowMullionsCap = False
        
        #Initialize mullion data
        self.__m_arrMullionHorObjects = [0]
        self.__m_arrMullionVertObjects = [0]
        self.__m_arrMullionHorBreps = [[0]]
        self.__m_arrMullionVertBreps = [[0]]
        
        self.__m_arrMullionVertUserData = [[],[],[],[],[]]
        self.__m_arrMullionHorUserData = [[],[],[],[],[]]
        
        #Init Shading data
        self.__m_blnShowShading = False
        self.__m_arrShadingObjects = [0]
        self.__m_arrShadingUserData = [[],[],[],[],[],[],[],[],[],[]]
        #--------------------------------------------------------
        #Deform Paramters
        
        self.__m_arrDeformBox=[]
        self.__m_arrBoundingBox=[]
        self.__m_blnShowDeform = False
        self.__m_arrBoundingBox = self.__ResetBoundingBox()
        
        self.__m_ConditionalDefinitions = dict()
        #----------------------------------------------------------------------------
        
        #CustomGeometry Paramters
        self.__m_blnShowCustomGeo = 0
        self.__m_CustomGeoBreps = []
        self.__m_CustomGeoBaseData = []
        self.__m_CustomGeoDrawBreps = []
        self.__m_CustomGeoObjects = []
        self.__m_CG_vecPlacement = rg.Vector3d(0,0,0)
        self.__m_CG_vecScaleFactor = rg.Vector3d(1,1,1)
        self.__m_CG_vecUpVector = rg.Vector3d(0,0,1)
        self.__m_CG_blnTilable = False
        self.__m_CG_dblRotation = 0
        self.__m_CG_windowDepth = 0
        self.__m_CG_trimToPanelSize = False
        self.__m_CustomGeoController = None
        #-----------------------------------------------------------------------------        
        #Ladybug Parameters
        self.__m_LadybugShadeThresh = 0.1 * self.__m_unitCoef   # min value (in meters) for shading/mullions caps to be created in "LADYBUG"  draw mode)
        
        #---------------------------------------------------------------------
        
    def __del__(self):
        #print "adios!"
        pass
        
        
    #----------------------------------------------------------------------------------------------------------------------
    #--------PROPERTIES SECTION------------------------------------------------------------------------------
    #----------------------------------------------------------------------------------------------------------------------
    def GetName(self):
        return self.__m_strName
        
    def SetName(self, someName):
        if "\n" in someName : self.__m_warningData.append("Invalid Name - data ignored"); return False 
        self.__m_strName = someName
        
    def GetHeight(self):
        return self.__m_dblHeight
        
    def SetHeight(self, someHeight):

        if type(someHeight) == StringType : someHeight = eval(someHeight)
        
        if someHeight <= 0 : return
        self.__m_dblHeight = someHeight
        self.__m_arrBoundingBox = self.__ResetBoundingBox()
                
        self.UpdateWindow() #Check if window does fit in panel
        
    def GetWidth(self):
        return self.__m_dblWidth
        
        
    def SetWidth(self, someWidth):
        
        if someWidth <= 0 : return
        
        if type(someWidth) == StringType : someWidth = eval(someWidth)
        
        self.__m_dblWidth = someWidth
        self.__m_arrBoundingBox = self.__ResetBoundingBox()
        
        self.UpdateWindow() #Check if window does fit in panel

        
    def GetThickness(self):
        return self.__m_dblWallThickness
        
        
    def SetThickness(self, someThickness):
        
        if type(someThickness) == StringType : someThickness = eval(someThickness)
        
        if someThickness == 0 : 
            self.__m_dblWallThickness = 0.001
        else: self.__m_dblWallThickness = someThickness
        
        self.__m_arrBoundingBox = self.__ResetBoundingBox()
        
        
    def SetDrawMode(self, strMode):
        if strMode in ["DEFAULT", "LADYBUG"] : self.__m_strDrawMode = strMode
        
    def GetDrawMode(self):
        return self.__m_strDrawMode
        
        
    def GetPanelProperty(self, strPropName):
        properties= ["PanelHeight", "PanelWidth", "PanelThickness", "PanelOffsetPoints", "PanelCornerPoints",\
            "PaneVisibility", "PaneName","PaneOffsetEdge", "PaneThickness", \
            "WindowData", "WindowLeft", "WindowWidth", "WindowRight", "WindowBottom", "WindowHeight", "WindowTop", "WindowVisibility", \
            "MullionVisibility",\
            "ShadingVisibility", "ShadingObjects", "ShadingDataNum",\
            "CustomGeoPlacement", "CustomGeoController", "CustomGeoOriginalBrep", \
            "SkinPlacement", "BoundingBox", "BlockInstances", "WarningData", "SurfacePanelMode"]
        if strPropName in  properties :
            return self.__GetPanelProperty(strPropName)
        
    def __GetPanelProperty(self, strPropName):
        
        PanelProperty = None
        
        #Panel Data        
        if strPropName == "PanelHeight":PanelProperty = self.__m_dblHeight
        elif strPropName ==  "PanelWidth":PanelProperty = self.__m_dblWidth
        elif strPropName ==  "SurfacePanelMode":PanelProperty = self.__m_blnSurfacePanelMode
        elif strPropName ==  "SurfacePanelSides":PanelProperty = self.__m_intSurfacePanelSides
        elif strPropName ==  "PanelOffsetPoints":PanelProperty = self.__m_arrPanelOffsetPoints
        elif strPropName ==  "PanelCornerPoints":PanelProperty = copy.deepcopy(self.__GetCornerPoints())
        #Wall Data
        elif strPropName ==  "PanelThickness":PanelProperty = self.__m_dblWallThickness
        elif strPropName ==  "WallVisibility":PanelProperty = self.__m_blnShowWall
        elif strPropName ==  "WallObjects":PanelProperty = self.__m_arrWallBreps
        #Deform Data
        elif strPropName == "BoundingBox":PanelProperty = self.__m_arrBoundingBox
        elif strPropName ==  "DeformVisibility":PanelProperty = self.__m_blnShowDeform
        elif strPropName ==  "DeformBox":PanelProperty = self.__m_arrDeformBox
        #Blocks Data
        elif strPropName == "BlockInstances":PanelProperty = self.__m_arrBlockInstances
        #Pane Data
        elif strPropName ==  "PaneName":PanelProperty = self.__m_strPaneName
        elif strPropName ==  "PaneVisibility":PanelProperty = self.__m_blnShowPane
        elif strPropName ==  "PaneThickness":PanelProperty = self.__m_dblPaneThickness
        elif strPropName ==  "PaneOffset":PanelProperty = self.__m_dblPaneOffset
        elif strPropName ==  "PaneOffsetEdge":PanelProperty = self.__m_dblPaneOffsetEdge
        elif strPropName ==  "PaneObjects":PanelProperty = self.__m_arrPaneBreps
        elif strPropName ==  "PaneTileWidth":PanelProperty = self.__m_dblPaneTileWidth
        elif strPropName ==  "PaneTileHeight":PanelProperty = self.__m_dblPaneTileHeight
        elif strPropName ==  "PaneTileThickness":PanelProperty = self.__m_dblPaneTileThickness
        elif strPropName ==  "PaneTileGap":PanelProperty = self.__m_dblPaneTileGap
        #Window Data
        elif strPropName ==  "WindowPoints":PanelProperty = self.__m_arrWindowPoints 
        elif strPropName ==  "WindowVisibility":PanelProperty = self.__m_blnShowWindow
        elif strPropName ==  "WindowGlassThickness":PanelProperty = self.__m_dblWinGlassThickness
        elif strPropName ==  "WindowGlassOffset":PanelProperty = self.__m_dblWinGlassOffset
        elif strPropName ==  "WindowObjects":PanelProperty = self.__m_arrWindowBreps
        elif strPropName == "WindowWidth": PanelProperty = (self.__m_arrWindowPoints[1][0]-self.__m_arrWindowPoints[0][0] if self.__m_blnShowWindow else False)
        elif strPropName == "WindowHeight":PanelProperty = (self.__m_arrWindowPoints[2][2]-self.__m_arrWindowPoints[1][2] if self.__m_blnShowWindow else False)
        elif strPropName == "WindowBottom":PanelProperty = (self.__m_arrWindowPoints[0][2] if self.__m_blnShowWindow else False)
        elif strPropName == "WindowTop":PanelProperty = (self.GetHeight()-self.__m_arrWindowPoints[2][2] if self.__m_blnShowWindow else False)
        elif strPropName == "WindowLeft":PanelProperty = (self.__m_arrWindowPoints[0][0] if self.__m_blnShowWindow else False)
        elif strPropName == "WindowRight":PanelProperty = (self.GetWidth()-self.__m_arrWindowPoints[1][0] if self.__m_blnShowWindow else False)
        elif strPropName == "WindowData":PanelProperty = self.__m_arrWindowUserData
        elif strPropName ==  "WindowConformSurfaceAsPanel":PanelProperty = self.__m_blnWindowConformSurfaceAsPanel
        #Mullion Data
        elif strPropName ==  "MullionWidth":PanelProperty = self.__m_dblMullionWidth
        elif strPropName ==  "MullionThickness":PanelProperty = self.__m_dblMullionThickness
        elif strPropName ==  "MullionCapThickness":PanelProperty = self.__m_dblMullionCapThickness
        elif strPropName ==  "MullionVisibility":PanelProperty = self.__m_blnShowMullions 
        elif strPropName ==  "MullionCapVisibility":PanelProperty = self.__m_blnShowMullionsCap
        elif strPropName ==  "MullionHorNum":PanelProperty = len(self.__m_arrMullionHorBreps)
        elif strPropName ==  "MullionVertNum":PanelProperty = len(self.__m_arrMullionVertBreps)
        elif strPropName ==  "MullionHorDataNum":PanelProperty = len(self.__m_arrMullionHorUserData)
        elif strPropName ==  "MullionVertDataNum":PanelProperty = len(self.__m_arrMullionVertUserData)
        #Shading Data
        elif strPropName ==  "ShadingVisibility":PanelProperty = self.__m_blnShowShading 
        elif strPropName ==  "ShadingObjects":PanelProperty = self.__m_arrShadingBreps
        elif strPropName ==  "ShadingDataNum":PanelProperty = len(self.__m_arrShadingUserData)  
        #Conditional definitions
        elif strPropName ==  "ConditionalDefinitions":PanelProperty = self.__m_ConditionalDefinitions
        #CustomGeometry Parameters
        elif strPropName == "CustomGeoVisibility":PanelProperty = self.__m_blnShowCustomGeo
        elif strPropName == "CustomGeoBrep":PanelProperty = self.__m_CustomGeoBreps
        elif strPropName == "CustomGeoOriginalBrep":PanelProperty = self.__m_CustomGeoBaseData  
        elif strPropName == "CustomGeoPlacement":PanelProperty = self.__m_CG_vecPlacement 
        elif strPropName == "CustomGeoScaleFactor":PanelProperty = self.__m_CG_vecScaleFactor
        elif strPropName == "CustomGeoUpVector":PanelProperty = self.__m_CG_vecUpVector
        elif strPropName == "CustomGeoTilable":PanelProperty = self.__m_CG_blnTilable
        elif strPropName == "CustomGeoRotation":PanelProperty = self.__m_CG_dblRotation
        elif strPropName == "CustomGeoWindowDepth":PanelProperty = self.__m_CG_windowDepth
        elif strPropName == "CustomGeoTrimToPanel":PanelProperty = self.__m_CG_trimToPanelSize
        elif strPropName == "CustomGeoController":PanelProperty = self.__m_CustomGeoController
        #Energy Analysis Parameters
        elif strPropName == "LB_ShadeThreshold":PanelProperty = self.__m_LadybugShadeThresh    
        #Skin Context Paramters
        elif strPropName == "SkinParent":PanelProperty = self.__m_SkinParent
        elif strPropName == "SkinParentName":PanelProperty = self.__m_SkinParentName
        elif strPropName == "SkinPlacement":PanelProperty = self.__m_SkinPlacementType
        #Misc. parameters
        elif strPropName == "WarningData":PanelProperty = self.__m_warningData
            
        return PanelProperty
        
    def GetPanelPropertyArrayItem(self, strPropName, arrayIndex):
        properties= ["MullionHorDataArray", "MullionHorObjArray", "MullionVertDataArray", "MullionVertObjArray", "ShadingDataArray" ]
        if strPropName in  properties :
            return copy.deepcopy(self.__GetPanelPropertyArray(strPropName, arrayIndex))
            
    def __GetPanelPropertyArray(self, strPropName, arrayIndex):
        
        try:
            if strPropName ==  "MullionHorObjArray":PanelPropertyArray = self.__m_arrMullionHorBreps[arrayIndex]
            elif strPropName ==  "MullionVertObjArray":PanelPropertyArray = self.__m_arrMullionVertBreps[arrayIndex]
            elif strPropName ==  "MullionHorDataArray":PanelPropertyArray = self.__m_arrMullionHorUserData[arrayIndex]
            elif strPropName ==  "MullionVertDataArray":PanelPropertyArray = self.__m_arrMullionVertUserData[arrayIndex]
            elif strPropName ==  "ShadingDataArray":PanelPropertyArray = self.__m_arrShadingUserData[arrayIndex]
        except:
            return False
        return PanelPropertyArray
        
        
    def SetPanelProperty(self, strPropName, value ):
        if strPropName in ["DrawMode", "SkinPlacement", "LB_ShadeThreshold", "SkinParentName", "SurfacePanelMode",\
            "PanelOffsetPoints", "SurfacePanelSides", "CustomGeoController"] :
            self.__SetPanelProperty(strPropName, value)
        else:
            self.__m_warningData.append("Panel Parameter "+ strPropName + " is not valid")
            
            
    def __SetPanelProperty(self, strPropName, value ):
        
        #Panel Data        
        if strPropName == "PanelHeight":self.__m_dblHeight = value
        elif strPropName ==  "PanelWidth":self.__m_dblWidth = value
        elif strPropName ==  "SurfacePanelMode": self.__m_blnSurfacePanelMode = value
        elif strPropName ==  "SurfacePanelSides": self.__m_intSurfacePanelSides = value
        elif strPropName ==  "PanelOffsetPoints": self.__m_arrPanelOffsetPoints = value
        #Wall Data
        elif strPropName ==  "PanelThickness":self.__m_dblWallThickness = value
        elif strPropName ==  "WallVisibility":self.__m_blnShowWall = value
        #Pane Data
        elif strPropName ==  "PaneName":self.__m_strPaneName = value
        elif strPropName ==  "PaneVisibility":self.__m_blnShowPane = value
        elif strPropName ==  "PaneThickness":self.__m_dblPaneThickness = value
        elif strPropName ==  "PaneOffset":self.__m_dblPaneOffset = value
        elif strPropName ==  "PaneOffsetEdge":self.__m_dblPaneOffsetEdge = value
        elif strPropName ==  "PaneTileWidth":self.__m_dblPaneTileWidth = value
        elif strPropName ==  "PaneTileHeight":self.__m_dblPaneTileHeight = value
        elif strPropName ==  "PaneTileThickness":self.__m_dblPaneTileThickness = value
        elif strPropName ==  "PaneTileGap":self.__m_dblPaneTileGap = value
        #Window Data
        elif strPropName ==  "WindowPoints":self.__m_arrWindowPoints = value
        elif strPropName ==  "WindowVisibility":self.__m_blnShowWindow = value
        elif strPropName ==  "WindowGlassThickness":self.__m_dblWinGlassThickness = value
        elif strPropName ==  "WindowGlassOffset":self.__m_dblWinGlassOffset = value
        elif strPropName == "WindowWidth":self.__m_arrWindowUserData['width'] = value
        elif strPropName == "WindowHeight":self.__m_arrWindowUserData['height'] = value
        elif strPropName == "WindowBottom":self.__m_arrWindowUserData['fromBottom'] = value
        elif strPropName == "WindowLeft":self.__m_arrWindowUserData['fromLeft'] = value
        elif strPropName == "WindowData":self.__m_arrWindowUserData = value
        elif strPropName == "WindowConformSurfaceAsPanel" : self.__m_blnWindowConformSurfaceAsPanel = value
        #Mullion Data
        elif strPropName ==  "MullionWidth":self.__m_dblMullionWidth = value
        elif strPropName ==  "MullionThickness":self.__m_dblMullionThickness = value
        elif strPropName ==  "MullionCapThickness":self.__m_dblMullionCapThickness = value
        elif strPropName ==  "MullionVisibility":self.__m_blnShowMullions = value 
        elif strPropName ==  "MullionCapVisibility":self.__m_blnShowMullionsCap = value
        #Shading Data
        elif strPropName ==  "ShadingVisibility":self.__m_blnShowShading = value
        #array value format: [index, array data]
        elif strPropName ==  "ShadingIndexArray": self.__m_arrShadingUserData[value[0]] = value[1]
        #Conditional Defintitions
        elif strPropName ==  "ConditionalDefinitions": self.__m_ConditionalDefinitions = value
        #CustomGeometry Parameters
        elif strPropName == "CustomGeoVisibility":self.__m_blnShowCustomGeo = value
        elif strPropName == "CustomGeoBrep":self.__m_CustomGeoBreps = value
        elif strPropName == "CustomGeoOriginalBrep":self.__m_CustomGeoBaseData = value   
        elif strPropName == "CustomGeoPlacement":self.__m_CG_vecPlacement = value
        elif strPropName == "CustomGeoScaleFactor":self.__m_CG_vecScaleFactor = value
        elif strPropName == "CustomGeoUpVector":self.__m_CG_vecUpVector = value
        elif strPropName == "CustomGeoTilable":self.__m_CG_blnTilable = value
        elif strPropName == "CustomGeoRotation":self.__m_CG_dblRotation = value
        elif strPropName == "CustomGeoWindowDepth":self.__m_CG_windowDepth = value
        elif strPropName == "CustomGeoTrimToPanel":self.__m_CG_trimToPanelSize = value
        elif strPropName == "CustomGeoController":self.__m_CustomGeoController = value
        #Energy Anlaysis Parameters
        elif strPropName == "LB_ShadeThreshold":self.__m_LadybugShadeThresh = value
        #Skin Context Parameters
        elif strPropName == "SkinParent":self.__m_SkinParent = value
        elif strPropName == "SkinParentName":self.__m_SkinParentName = value
        elif strPropName == "SkinPlacement":self.__m_SkinPlacementType = value
        else: self.__m_warningData.append("Invalid panel property: " + strPropName)
        
        return
        
        
    def __ResetBoundingBox(self):
        return [[0, 0, 0], [self.__m_dblWidth, 0, 0], [self.__m_dblWidth, self.__m_dblWallThickness, 0], \
            [0, self.__m_dblWallThickness, 0], [0, 0, self.__m_dblHeight], [self.__m_dblWidth, 0, self.__m_dblHeight], \
            [self.__m_dblWidth, self.__m_dblWallThickness, self.__m_dblHeight], [0, self.__m_dblWallThickness, self.__m_dblHeight]]
            
            
    #----------------------------------------------------------------------------------------------------------------------
    #--------UTILITIES SECTION------------------------------------------------------------------------------
    #----------------------------------------------------------------------------------------------------------------------
    #Copy properties (not geometry) of provided panel
    
    def Copy(self, myPanel):
        
        #General panel properties
        self.__m_SkinParent = myPanel.__GetPanelProperty("SkinParent")
        self.__m_SkinParentName = myPanel.__GetPanelProperty("SkinParentName")
        self.__m_SkinPlacementType = myPanel.__GetPanelProperty("SkinPlacement")
        
        self.__m_strName = myPanel.GetName()
        self.__m_dblHeight = myPanel.__GetPanelProperty("PanelHeight") #: Wall Height
        self.__m_dblWidth = myPanel.__GetPanelProperty("PanelWidth") # Wall Width 
        
        self.__m_blnSurfacePanelMode = myPanel.__GetPanelProperty("SurfacePanelMode")     
        self.__m_intSurfacePanelSides  = myPanel.__GetPanelProperty("SurfacePanelSides")    
        self.__m_arrPanelOffsetPoints  = copy.deepcopy(myPanel.__GetPanelProperty("PanelOffsetPoints")) #for  Surface Panels       
        self.__m_strDrawMode = myPanel.GetDrawMode()
        self.__m_ConditionalDefinitions = copy.deepcopy(myPanel.__GetPanelProperty("ConditionalDefinitions"))
        
        #Wall properties
        self.__m_dblWallThickness = myPanel.__GetPanelProperty("PanelThickness") #: Wall Depth
        self.__m_blnShowWall = myPanel.__GetPanelProperty("WallVisibility")
        
        #Pane parameters
        self.__m_blnShowPane = myPanel.__GetPanelProperty("PaneVisibility")
        self.__m_strPaneName = myPanel.__GetPanelProperty("PaneName")
        self.__m_dblPaneThickness = myPanel.__GetPanelProperty("PaneThickness")
        self.__m_dblPaneOffset = myPanel.__GetPanelProperty("PaneOffset")
        self.__m_dblPaneOffsetEdge = myPanel.__GetPanelProperty("PaneOffsetEdge")
        
        self.__m_dblPaneTileWidth  = myPanel.__GetPanelProperty("PaneTileWidth")
        self.__m_dblPaneTileHeight = myPanel.__GetPanelProperty("PaneTileHeight")
        self.__m_dblPaneTileThickness = myPanel.__GetPanelProperty("PaneTileThickness")
        self.__m_dblPaneTileGap = myPanel.__GetPanelProperty("PaneTileGap")
        
        
        #Window Parameters
        self.__m_blnShowWindow = myPanel.__GetPanelProperty("WindowVisibility") 
        self.__m_dblWinGlassThickness = myPanel.__GetPanelProperty("WindowGlassThickness")
        self.__m_dblWinGlassOffset = myPanel.__GetPanelProperty("WindowGlassOffset")
        self.__m_arrWindowPoints = copy.deepcopy(myPanel.__GetPanelProperty("WindowPoints"))
        self.__m_arrWindowUserData = copy.deepcopy(myPanel.__GetPanelProperty("WindowData"))
        self.__m_blnWindowConformSurfaceAsPanel  = myPanel.__GetPanelProperty("WindowConformSurfaceAsPanel")
        
        #Mullion Parameters
        self.__m_blnShowMullions = myPanel.__GetPanelProperty("MullionVisibility") 
        self.__m_blnShowMullionsCap = myPanel.__GetPanelProperty("MullionCapVisibility")
        self.__m_dblMullionWidth = myPanel.__GetPanelProperty("MullionWidth")
        self.__m_dblMullionThickness = myPanel.__GetPanelProperty("MullionThickness") 
        self.__m_dblMullionCapThickness = myPanel.__GetPanelProperty("MullionCapThickness") 

        #Copy mullions Data
        self.__m_arrMullionVertUserData = []
        self.__m_arrMullionHorUserData = []
        
        for i in range(myPanel.__GetPanelProperty("MullionHorDataNum")):
            arrMullions = copy.deepcopy(myPanel.__GetPanelPropertyArray("MullionHorDataArray", i))
            if type(arrMullions) == ListType :
                self.__m_arrMullionHorUserData.append(arrMullions)
                
        for i in range(myPanel.__GetPanelProperty("MullionVertDataNum")):
            arrMullions = copy.deepcopy(myPanel.__GetPanelPropertyArray("MullionVertDataArray", i))
            if type(arrMullions) == ListType :
                self.__m_arrMullionVertUserData.append(arrMullions)
                
                
        #shading Parameters
        self.__m_blnShowShading = myPanel.__GetPanelProperty("ShadingVisibility")    
        
        self.__m_arrShadingUserData = []
        for i in range(myPanel.__GetPanelProperty("ShadingDataNum")):
            arrShadingData = copy.deepcopy(myPanel.__GetPanelPropertyArray("ShadingDataArray", i))
            if type(arrShadingData) == ListType :
                self.__m_arrShadingUserData.append(arrShadingData)

        #CustomGeometry Parameters
        self.__m_blnShowCustomGeo = myPanel.__GetPanelProperty("CustomGeoVisibility")
        self.__m_CustomGeoBreps = myPanel.__GetPanelProperty("CustomGeoBrep")
        self.__m_CustomGeoBaseData = myPanel.__GetPanelProperty("CustomGeoOriginalBrep")
        self.__m_CG_vecPlacement = myPanel.__GetPanelProperty("CustomGeoPlacement")
        self.__m_CG_vecScaleFactor = myPanel.__GetPanelProperty("CustomGeoScaleFactor")
        self.__m_CG_vecUpVector = myPanel.__GetPanelProperty("CustomGeoUpVector")
        self.__m_CG_blnTilable = myPanel.__GetPanelProperty("CustomGeoTilable")
        self.__m_CG_dblRotation = myPanel.__GetPanelProperty("CustomGeoRotation")
        self.__m_CG_windowDepth = myPanel.__GetPanelProperty("CustomGeoWindowDepth")
        self.__m_CG_trimToPanelSize = myPanel.__GetPanelProperty("CustomGeoTrimToPanel")
        self.__m_CustomGeoController = myPanel.__GetPanelProperty("CustomGeoController")
        
        #Deform parameters
        self.__m_arrDeformBox = copy.deepcopy(myPanel.__GetPanelProperty("DeformBox")) # Wall Location
        self.__m_arrBoundingBox = copy.deepcopy(myPanel.__GetPanelProperty("BoundingBox"))
        self.__m_blnShowDeform = myPanel.__GetPanelProperty("DeformVisibility")
        
        #Energy Analysis
        self.__m_LadybugShadeThresh = myPanel.__GetPanelProperty("LB_ShadeThreshold")

    #----------------------------------------------------------------------------------------------------------------------
    #----------------------------------------------------------------------------------------------------------------------
    
    

    def CreateBlockCopy(self, strBlockName, arrAreaPanelPoints, blnFitToArea):
        
        blnNewBlock = False
        
        parentLayerName = "SKIN_DESIGNER"
        if self.__m_SkinParentName <> None: parentLayerName = self.__m_SkinParentName.split("::")[0]
        if not rs.IsLayer(parentLayerName) : rs.AddLayer(parentLayerName)

        currentLayer = rs.CurrentLayer() 
        
        if not rs.IsLayer(parentLayerName+"::_P_0") : 
            rs.AddLayer(parentLayerName+"::_P_0")
            
        rs.CurrentLayer(parentLayerName+"::_P_0")
            
        #create block if not created already
        if not rs.IsBlock(strBlockName) :
            
            blnNewBlock = True
            
            self.DrawSceneObjects()
            
            arrBlockObjects = []
            if  self.__m_arrWallObjects and not type(self.__m_arrWallObjects[0]) == IntType and rs.IsObject(self.__m_arrWallObjects[0]):
                arrBlockObjects += self.__m_arrWallObjects

            if  self.__m_arrWindowObjects and not type(self.__m_arrWindowObjects[0]) == IntType and rs.IsObject(self.__m_arrWindowObjects[0]):
                arrBlockObjects +=  self.__m_arrWindowObjects
            
            if  self.__m_arrPaneObjects and not type(self.__m_arrPaneObjects[0]) == IntType and rs.IsObject(self.__m_arrPaneObjects[0]):
                arrBlockObjects += self.__m_arrPaneObjects

            if self.__m_arrMullionHorObjects and not type(self.__m_arrMullionHorObjects[0]) == IntType and rs.IsObject(self.__m_arrMullionHorObjects[0]):
                arrBlockObjects += self.__m_arrMullionHorObjects
            
            if self.__m_arrMullionVertObjects and not type(self.__m_arrMullionVertObjects[0]) == IntType and rs.IsObject(self.__m_arrMullionVertObjects[0]):
                arrBlockObjects += self.__m_arrMullionVertObjects
            
            if self.__m_arrShadingObjects and not type(self.__m_arrShadingObjects[0]) == IntType and rs.IsObject(self.__m_arrShadingObjects[0]):
                arrBlockObjects +=  self.__m_arrShadingObjects
            
            if self.__m_CustomGeoObjects and type(self.__m_CustomGeoObjects) == ListType and len(self.__m_CustomGeoObjects) > 0 and rs.IsObject(self.__m_CustomGeoObjects[0]):
                arrBlockObjects += self.__m_CustomGeoObjects
                
            #ignore panels with empty geometry
            if len(arrBlockObjects) == 0:
                return None
                
            rs.AddBlock(arrBlockObjects, self.__m_arrBoundingBox[0], strBlockName)
            self.DeleteSceneObjects()
            
        #Translate and Scale based on grid points
        
        #Start from Panel Original Bounding Box
        arrBoxPoints = self.__m_arrBoundingBox
        
        #Move Bounding Box to new locatation Plane (to avoid panel depth distortions)
        arrStartPlane = rs.PlaneFromPoints(arrBoxPoints[0], arrBoxPoints[1], arrBoxPoints[4]) #Create Plane from current Boundng Box points
        #create plane from panel corner points -check for duplicate corner points(triangle panels)
        dists = rs.Distance(arrAreaPanelPoints[0],[arrAreaPanelPoints[1], arrAreaPanelPoints[2]])
        if dists[0] == dists[1]: 
            arrEndPlane = rs.PlaneFromPoints(arrAreaPanelPoints[0], arrAreaPanelPoints[1], arrAreaPanelPoints[3])
        elif 0 in dists: 
            arrEndPlane = rs.PlaneFromPoints(arrAreaPanelPoints[1], arrAreaPanelPoints[2], arrAreaPanelPoints[3])
        else: 
            arrEndPlane = rs.PlaneFromPoints(arrAreaPanelPoints[0], arrAreaPanelPoints[1], arrAreaPanelPoints[2])
        
        #Apply Transf. Matrix from planes on Bounding Box
        arrXform = rs.XformRotation1(arrStartPlane, arrEndPlane)
        arrNewBoxPoints = rs.PointArrayTransform(arrBoxPoints, arrXform)
        
        if blnFitToArea : #scale to fit area only if specified
            arrScaleXform = rs.XformScale([(rs.Distance(arrNewBoxPoints[0], arrAreaPanelPoints[1]) / rs.Distance(arrNewBoxPoints[0], arrNewBoxPoints[1])), 1,\
                (rs.Distance(arrNewBoxPoints[0], arrAreaPanelPoints[2]) / rs.Distance(arrNewBoxPoints[0], arrNewBoxPoints[4]))])
            arrXform = rs.XformMultiply(arrXform, arrScaleXform)
        
        
        #Create Copy and move to location
        if rs.IsBlock(strBlockName) :
            self.__m_arrBlockInstances.append(rs.InsertBlock2(strBlockName, arrXform))
            
        rs.CurrentLayer(currentLayer)
        return blnNewBlock
    
    #----------------------------------------------------------------------------------------------------------------------
    #----------------------------------------------------------------------------------------------------------------------

    def DeleteBlockCopies(self):

        if self.__m_arrBlockInstances :
            
            if rs.IsBlockInstance(self.__m_arrBlockInstances[0]):
                rs.BlockInstanceName(self.__m_arrBlockInstances[0])
                rs.DeleteBlock(rs.BlockInstanceName(self.__m_arrBlockInstances[0]))
                
            __m_arrBlockInstances = []

    #----------------------------------------------------------------------------------------------------------------------
    #----------------------------------------------------------------------------------------------------------------------

    def DeleteSceneObjects(self):
        
        if  type(self.__m_arrWallObjects) == ListType and len(self.__m_arrWallObjects) and not type(self.__m_arrWallObjects[0]) == IntType and rs.IsObject(self.__m_arrWallObjects[0]): 
            rs.DeleteObjects(self.__m_arrWallObjects)
     
        if  self.__m_arrPaneObjects and not type(self.__m_arrPaneObjects[0]) == IntType and rs.IsObject(self.__m_arrPaneObjects[0]):
            rs.DeleteObjects(self.__m_arrPaneObjects)
             
        if  self.__m_arrWindowObjects and not type(self.__m_arrWindowObjects[0]) == IntType and rs.IsObject(self.__m_arrWindowObjects[0]): 
            rs.DeleteObjects(self.__m_arrWindowObjects)

        if self.__m_arrMullionHorObjects and not type(self.__m_arrMullionHorObjects[0]) == IntType and rs.IsObject(self.__m_arrMullionHorObjects[0]):
            rs.DeleteObjects(self.__m_arrMullionHorObjects)
        
        if self.__m_arrMullionVertObjects and not type(self.__m_arrMullionVertObjects[0]) == IntType and rs.IsObject(self.__m_arrMullionVertObjects[0]):
            rs.DeleteObjects(self.__m_arrMullionVertObjects)
                
        if  self.__m_arrShadingObjects and not type(self.__m_arrShadingObjects[0]) == IntType and rs.IsObject(self.__m_arrShadingObjects[0]): 
            rs.DeleteObjects(self.__m_arrShadingObjects)
            
        if self.__m_CustomGeoObjects and type(self.__m_CustomGeoObjects) == ListType and len(self.__m_CustomGeoObjects) > 0 and rs.IsObject(self.__m_CustomGeoObjects[0]):
            rs.DeleteObjects(self.__m_CustomGeoObjects)

    #----------------------------------------------------------------------------------------------------------------------
    #----------------------------------------------------------------------------------------------------------------------
    
    def __GetCornerPoints(self):
        cornerPt1 = rg.Point3d(0,0,0)
        cornerPt2 = rg.Point3d(self.__m_dblWidth,0,0)
        cornerPt3 = rg.Point3d(0, 0, self.__m_dblHeight)        
        cornerPt4 = rg.Point3d(self.__m_dblWidth, 0, self.__m_dblHeight)
        
        if self.GetPanelProperty("SurfacePanelMode"):
            offsets = self.GetPanelProperty("PanelOffsetPoints")
            if offsets[0] <> 0:
                offsets = [rg.Point3d(of.X, 0, of.Z) for of in offsets]
                of1, of2, of3, of4 = offsets
                cornerPt1 += of1; cornerPt2 += of2; cornerPt3 += of3; cornerPt4 += of4
            
        return [cornerPt1, cornerPt2, cornerPt3, cornerPt4]
        
    #----------------------------------------------------------------------------------------------------------------------
    #----------------------------------------------------------------------------------------------------------------------
    def __GetConformedPanelSurface(self):
        
        if not self.GetPanelProperty("SurfacePanelMode"): return None
        
        if self.__m_ConformedPanelSurface <> None : return self.__m_ConformedPanelSurface
        
        cp1, cp2, cp4, cp3 = self.__GetCornerPoints()
        op1 = [0,0,0]
        op2 = [self.__GetPanelProperty("PanelWidth"),0,0]
        op3 = [self.__GetPanelProperty("PanelWidth"),0,self.__GetPanelProperty("PanelHeight")]
        op4 = [0,0,self.__GetPanelProperty("PanelHeight")]
        op1, op2, op3, op4 = [rg.Point3d(p[0], p[1], p[2]) for p in [op1, op2, op3, op4]]
        #create Surface and distort to new  surface panel shape to obtain equivalent points
        pcSurf = rg.NurbsSurface.CreateFromCorners(op1, op2, op3, op4)
        for u,v,p in [[0,0,cp1],[1,0,cp2],[1,1,cp3],[0,1,cp4]]:
            pcSurf.Points.SetControlPoint(u,v,p)
        self.__m_ConformedPanelSurface = pcSurf
            
        return self.__m_ConformedPanelSurface
    
    #----------------------------------------------------------------------------------------------------------------------
    #----------------------------------------------------------------------------------------------------------------------
    def __GetConformedWindowSurface(self):
        
        if not self.GetPanelProperty("SurfacePanelMode"): return None
        
        if self.__m_ConformedWindowSurface <> None : return self.__m_ConformedWindowSurface
        
        #Generate Shaped window points based on offset from panel edges
        offsetLeft = self.GetPanelProperty("WindowLeft")
        offsetRight = self.GetPanelProperty("WindowRight")
        offsetTop = self.GetPanelProperty("WindowTop")        
        offsetBottom = self.GetPanelProperty("WindowBottom")
        c1, c2, c3, c4 = self.__GetCornerPoints()
        tolerance = Rhino.RhinoDoc.ActiveDoc.ModelAbsoluteTolerance
        wl = []
        for lp1, lp2, offset in [[c1,c2,offsetBottom], [c4,c3,offsetTop], [c3,c1,offsetLeft], [c2,c4,offsetRight]]:
            line = rg.LineCurve(lp1,lp2)
            if offset > 0:
                lc = line.Offset(rg.Plane.WorldZX, offset, tolerance, rg.CurveOffsetCornerStyle.None)[0]
            else: lc = line
            wl.append(rg.Line(lc.PointAtStart, lc.PointAtEnd))
            
        cw1 = wl[0].PointAt(rg.Intersect.Intersection.LineLine(wl[0], wl[2])[1])
        cw2 = wl[0].PointAt(rg.Intersect.Intersection.LineLine(wl[0], wl[3])[1])
        cw4 = wl[1].PointAt(rg.Intersect.Intersection.LineLine(wl[1], wl[2])[1])
        cw3 = wl[1].PointAt(rg.Intersect.Intersection.LineLine(wl[1], wl[3])[1])
        ow1, ow2, ow3, ow4  = [rg.Point3d(p[0], p[1], p[2]) for p in self.__m_arrWindowPoints]

        #create Surface and distort to new window conformed to surface panel shape to obtain equivalent points
        wcSurf = rg.NurbsSurface.CreateFromCorners(ow1, ow2, ow3, ow4)
        for u,v,p in [[0,0,cw1],[1,0,cw2],[1,1,cw3],[0,1,cw4]]:
            wcSurf.Points.SetControlPoint(u,v,p)
        self.__m_ConformedWindowSurface = wcSurf

        return self.__m_ConformedWindowSurface

    #----------------------------------------------------------------------------------------------------------------------
    #----------------------------------------------------------------------------------------------------------------------
    def __BaseToSurfacePanelPoint(self, arrPoint):
        basePoint = rg.Point3d(arrPoint[0], arrPoint[1], arrPoint[2])
        if self.GetPanelProperty("SurfacePanelMode"):
            #remaping of points to adjust shade to conformed shape in Surface Panel Mode
            panelSurf = self.__GetConformedPanelSurface()
            surfPoint= panelSurf.PointAt(basePoint.X,basePoint.Z)
            surfPoint.Y = arrPoint[1]
            return surfPoint
        return basePoint
        
    #----------------------------------------------------------------------------------------------------------------------
    #----------------------------------------------------------------------------------------------------------------------    
    def __BaseToSurfaceWindowPoint(self, arrPoint):
        basePoint = rg.Point3d(arrPoint[0], arrPoint[1], arrPoint[2])
        if self.GetPanelProperty("SurfacePanelMode") and self.__GetPanelProperty("WindowConformSurfaceAsPanel"):
            winSurf = self.__GetConformedWindowSurface()
            fromPt = copy.deepcopy(self.__m_arrWindowPoints[0])
            origin = rg.Point3d(fromPt[0], fromPt[1], fromPt[2])
            basePoint -= origin
            surfPoint= winSurf.PointAt(basePoint.X, basePoint.Z)
            surfPoint.Y = arrPoint[1]
            return surfPoint
        return basePoint
        
        
    #Distort/transform Morphing Bounding Box only, leave data ready for DrawMorph command(OBSOLETE)----------------------------------------------------------------------------------------------------------------------
    #----------------------------------------------------------------------------------------------------------------------
    def MorphPanel(self, arrAreaPanelPoints):
        
        
        #Start from Panel Original Bounding Box
        arrBoxPoints = self.__m_arrBoundingBox
        
        #Move Bounding Box to new locatation Plane (to avoid panel depth distortions)
        arrStartPlane = rs.PlaneFromPoints(arrBoxPoints[0], arrBoxPoints[1], arrBoxPoints[4]) #Create Plane from current Boundng Box points
        arrEndPlane = rs.PlaneFromPoints(arrAreaPanelPoints[0], arrAreaPanelPoints[1], arrAreaPanelPoints[2])#Create Plane from Panels Area points
        
        #Apply Transf. Matrix from planes on Bounding Box
        arrRotXform = rs.XformRotation1(arrStartPlane, arrEndPlane)
        arrNewBoxPoints = rs.PointArrayTransform(arrBoxPoints, arrRotXform)
        
        arrScaleXform = rs.XformScale([(rs.Distance(arrNewBoxPoints[0], arrAreaPanelPoints[1]) / rs.Distance(arrNewBoxPoints[0], arrNewBoxPoints[1])), 1.0,\
            (rs.Distance(arrNewBoxPoints[0], arrAreaPanelPoints[2]) / rs.Distance(arrNewBoxPoints[0], arrNewBoxPoints[4]))])
        arrXform = rs.XformMultiply(arrRotXform, arrScaleXform)
        
        self.__m_TransformMatrix = arrXform
        
        #Store new Bounding Box ready for Draw()
        self.__m_arrDeformBox = arrNewBoxPoints
        self.__m_blnShowDeform = True
    
    
    
    
    #----------------------------------------------------------------------------------------------------------------------	 
    #PANEL CONDITIONAL DEFINITIONS SECTION
    #Data Matrix with panel properties-based conditionals and Function-based Definitions (ex: "PanelWidth < 1.0", "DeleteWindow()")    
    #----------------------------------------------------------------------------------------------------------------------
    
    def AddConditionalDefinition(self, strCondition, strAction):
        
        
        if strCondition not in self.__m_ConditionalDefinitions:
            self.__m_ConditionalDefinitions[strCondition] = []
        self.__m_ConditionalDefinitions[strCondition].append(strAction)
    
    
    
    def DeleteConditionalDefinition(self, strCondition, strAction="All"):
        
        if strCondition not in self.__m_ConditionalDefinitions: return False
        
        if strAction == "All" : 
            del self.__m_ConditionalDefinitions[strCondition]
            return True
            
        tmpDefList = self.__m_ConditionalDefinitions[strCondition]
        if  strAction in tmpCondef : 
            tmpDefList.remove(strAction)
            return True
            
        return False
    
    
    def GetConditionalDefinition(self, strCondition="All"):
        if strCondition == "All":
            return copy.deepcopy(self.__m_ConditionalDefinitions)
        else: 
            return copy.deepcopy(self.__m_ConditionalDefinitions[strCondition])
    
    
    def RunConditionalDefinition(self, strCondition=None):

        conditionList = []
        if strCondition <> None:
            if strCondition not in self.__m_ConditionalDefinitions: return False
            conditionList = [strCondition]
        else: 
            conditionList = self.__m_ConditionalDefinitions.keys()
            
        for condition in conditionList:
            parsedList = condition.split()
            parsedCondition = "if self.GetPanelProperty('"+parsedList[0]+"') "+parsedList[1]+" "+parsedList[2]+" : "
            
            actionList = self.__m_ConditionalDefinitions[condition]
            for strAction in actionList:
                strConditionalAction = parsedCondition + "self." + strAction
                #print strConditionalAction
                exec(strConditionalAction)
        
    #----------------------------------------------------------------------------------------------------------------------
    #--------ADDING/REMOVING/MODIFYING ELEMENTS SECTION------------------------------------------------------------------------------
    #----------------------------------------------------------------------------------------------------------------------
            
            
    def AddWindow(self, width=1*_UNIT_COEF, height=1*_UNIT_COEF, fromLeft="C", fromBottom="C", recess=0, thickness=0.02*_UNIT_COEF, conformSurface=False):
        
        self.__m_arrWindowUserData = dict(width=width, height=height, fromLeft=fromLeft, fromBottom=fromBottom, recess = recess, thickness = thickness)
        #Panel variables
        PanelWidth = self.GetWidth()
        PanelHeight = self.GetHeight()
        
        if type(width) == StringType : width = eval(width)
        if type(height) == StringType : height = eval(height)
        if type(recess) == StringType : recess = eval(recess)
        
        dblGlassWidth = width ; dblGlassHeight = height
        dblGlassThickness = thickness ; dblGlassRecess = recess
        
        #Window variables
        Window = dict(width=width, height=height, fromLeft=fromLeft, fromBottom=fromBottom, recess = recess, thickness = thickness)

        if type(fromLeft) is StringType :
            if fromLeft == 'C' : dblGlassDisLeft = (PanelWidth-width)/2.0
            else : dblGlassDisLeft = eval(fromLeft)
        elif type(fromLeft) is FloatType or type(fromLeft) is IntType :
            dblGlassDisLeft = fromLeft
        else: dblGlassDisLeft = (PanelWidth-width)/2.0
            
        if type(fromBottom) is StringType:
            if fromBottom == 'C' : dblGlassDisBottom = (PanelHeight-height)/2.0 
            else : dblGlassDisBottom = eval(fromBottom)
        elif type(fromBottom) is FloatType or type(fromBottom) is IntType :
            dblGlassDisBottom = fromBottom 
        else: dblGlassDisBottom = (PanelHeight-height)/2.0 
        
        #Check window dimensions, hide window if invalid
        if dblGlassWidth <= 0 or dblGlassHeight <= 0 or \
            (dblGlassDisLeft + dblGlassWidth) > self.__GetPanelProperty("PanelWidth")*self.__m_dimRoundCoef or \
            dblGlassDisBottom + dblGlassHeight > self.__GetPanelProperty("PanelHeight")*self.__m_dimRoundCoef: 
            self.HideWindow(); print ">>> Panel " + self.GetName()+" - Window fixed size won't fit in panel - window erased"; return
        
        #load processed data in window array
        self.__m_arrWindowPoints[0] = [dblGlassDisLeft, 0, dblGlassDisBottom]
        self.__m_arrWindowPoints[1] = [dblGlassDisLeft + dblGlassWidth, 0, dblGlassDisBottom]
        self.__m_arrWindowPoints[2] = [dblGlassDisLeft + dblGlassWidth, 0, dblGlassDisBottom + dblGlassHeight]
        self.__m_arrWindowPoints[3] = [dblGlassDisLeft, 0, dblGlassDisBottom + dblGlassHeight]
        self.__m_dblWinGlassThickness = dblGlassThickness
        self.__m_dblWinGlassOffset = dblGlassRecess
        self.__m_blnWindowConformSurfaceAsPanel = conformSurface

        self.ShowWindow()
        
        
        
    def ModifyWindow(self, width=None, height=None, fromLeft=None, fromBottom=None, recess=None, thickness=None, conformSurface=None):
        
        if self.__m_arrWindowPoints == [0,0,0,0] : return False
        
        self.__m_arrWindowUserData['width'] = width if width<>None else self.__m_arrWindowUserData['width'] 
        self.__m_arrWindowUserData['height'] = height if height<>None else self.__m_arrWindowUserData['height'] 
        self.__m_arrWindowUserData['fromLeft'] = fromLeft if fromLeft<>None else self.__m_arrWindowUserData['fromLeft'] 
        self.__m_arrWindowUserData['fromBottom'] = fromBottom if fromBottom<>None else self.__m_arrWindowUserData['fromBottom'] 
        self.__m_arrWindowUserData['recess'] = recess if recess<>None else self.__m_arrWindowUserData['recess']
        self.__m_arrWindowUserData['thickness'] = thickness if thickness<>None else self.__m_arrWindowUserData['thickness']        
        conformSurf = conformSurface if conformSurface <> None else self.__m_blnWindowConformSurfaceAsPanel   
        
        Window = self.__m_arrWindowUserData
        self.AddWindow(width=Window['width'], height=Window['height'], fromLeft=Window['fromLeft'],\
            fromBottom=Window['fromBottom'], recess=Window['recess'], thickness=Window['thickness'], conformSurface=conformSurf)
        
        
        
    def UpdateWindow(self):
        if self.__m_arrWindowPoints == [0,0,0,0] : return False
        Window = self.__m_arrWindowUserData
        
        self.AddWindow(width=Window['width'], height=Window['height'], fromLeft=Window['fromLeft'], fromBottom=Window['fromBottom'],\
            recess=Window['recess'], thickness=Window['thickness'], conformSurface=self.__m_blnWindowConformSurfaceAsPanel)
        
        
    def DeleteWindow(self):
        self.HideWindow()
        self.__m_arrWindowPoints = [0,0,0,0]
        self.__m_arrWindowObjects = [0]
        self.__m_arrWindowBreps = [0]
        self.__m_blnShowWindow = False
        self.__m_arrWindowUserData = dict(width=0, height=0, fromLeft=0, fromBottom=0, recess = 0, thickness = 0)

        
    #----------------------------------------------------------------------------------------------------------------------
    #----------------------------------------------------------------------------------------------------------------------
        
        
    def AddPane(self, paneName="_P_DefaultPane", thickness=0.02*_UNIT_COEF, offset=0.02*_UNIT_COEF, offsetEdge=0, tileWidth=0, tileHeight=0, tileThickness=0, tileGap=0.01*_UNIT_COEF):
        
        self.__m_strPaneName = str(paneName)
        self.__m_dblPaneThickness = float(thickness)
        self.__m_dblPaneOffset = float(offset)
        self.__m_dblPaneOffsetEdge = float(offsetEdge)
        self.__m_dblPaneTileWidth = float(tileWidth)
        self.__m_dblPaneTileHeight = float(tileHeight)
        self.__m_dblPaneTileThickness = float(tileThickness)
        self.__m_dblPaneTileGap = float(tileGap)
        
        self.__m_blnShowPane = True


    #----------------------------------------------------------------------------------------------------------------------
    # Mullions Actions
    #----------------------------------------------------------------------------------------------------------------------
    def AddBaseMullions(self, width=0.05*_UNIT_COEF, thickness=0.1*_UNIT_COEF, capThickness=0.05*_UNIT_COEF):

        #Storing panel generic values using provided data
        if width > 0 : self.__m_dblMullionWidth = width
        if thickness > 0 : self.__m_dblMullionThickness = thickness
        
        #Caps also?
        
        if capThickness > 0.0 :
            self.__m_dblMullionCapThickness = capThickness
            self.__m_blnShowMullionsCap = True
        else :
            self.__m_blnShowMullionsCap = False
            
        if  self.__m_blnShowWindow :
            MullionTypes = ["PanelLeft", "PanelRight", "PanelBottom", "PanelTop", \
                "WindowLeft","WindowRight","WindowBottom","WindowTop"]
        else : MullionTypes = ["PanelLeft", "PanelRight", "PanelBottom", "PanelTop"]
            
            
        for strType in MullionTypes :
            self.AddMullionType(strType, width, thickness, width, capThickness)

        self.__m_blnShowMullions = True



    #----------------------------------------------------------------------------------------------------------------------
    #----------------------------------------------------------------------------------------------------------------------
    def AddWindowMullions(self, width=0.05*_UNIT_COEF, thickness=0.1*_UNIT_COEF, capThickness=0.05*_UNIT_COEF):
        MullionTypes = ["WindowLeft","WindowRight","WindowBottom","WindowTop"]
        for strType in MullionTypes :
            self.AddMullionType(strType, width, thickness, width, capThickness)


    #----------------------------------------------------------------------------------------------------------------------
    #----------------------------------------------------------------------------------------------------------------------
    def AddPanelMullions(self, width=0.05*_UNIT_COEF, thickness=0.1*_UNIT_COEF, capThickness=0.05*_UNIT_COEF):
        MullionTypes = ["PanelLeft", "PanelRight", "PanelBottom", "PanelTop"]
        for strType in MullionTypes :
            self.AddMullionType(strType, width, thickness, width, capThickness)
            
            

    #----------------------------------------------------------------------------------------------------------------------
    #----------------------------------------------------------------------------------------------------------------------
    #Use to add a predefined mullion Type

    def AddMullionType(self, strType, width=0.05*_UNIT_COEF, thickness=0.1*_UNIT_COEF, capWidth=None, capThickness=0.05*_UNIT_COEF):
        
        if strType not in ["WindowLeft","WindowRight","WindowBottom","WindowTop", "PanelLeft", "PanelRight", "PanelBottom", "PanelTop"] and \
            "Hor_fromBottom=" not in strType and "Vert_fromLeft=" not in strType: return
        try:
            if type(width) == ListType: width = width[0]
            width = float(width)
        except:
            self.__m_warningData.append("Wrong width parameter on mullion "+ strType) ; return
        try:
            if type(capWidth) == ListType: capWidth = capWidth[0]
            if capWidth <> None : capWidth = float(capWidth)
        except:
            self.__m_warningData.append("Wrong capWidth parameter on mullion "+ strType) ; return

        try:  
            if type(thickness) == ListType : thickness = list(float(num) for num in thickness)
            else: thickness = float(thickness)
        except:
            self.__m_warningData.append("Wrong thickness parameter on mullion "+ strType) ; return
        try:  
            if type(capThickness) == ListType : capThickness = list(float(num) for num in capThickness)
            else: capThickness = float(capThickness)
        except:
            self.__m_warningData.append("Wrong capThickness parameter on mullion "+ strType) ; return
            
        if capWidth == None : capWidth = width 
        
        if "Bottom" in strType or "Top" in strType or "Hor_fromBottom=" in strType:
            self.__m_arrMullionHorUserData[0] = self.__m_arrMullionHorUserData[0] + [strType]
            self.__m_arrMullionHorUserData[1] = self.__m_arrMullionHorUserData[1] + [width]
            self.__m_arrMullionHorUserData[2] = self.__m_arrMullionHorUserData[2] + [thickness]
            self.__m_arrMullionHorUserData[3] = self.__m_arrMullionHorUserData[3] + [capWidth]
            self.__m_arrMullionHorUserData[4] = self.__m_arrMullionHorUserData[4] + [capThickness]


        if "Left" in strType or "Right" in strType or "Vert_fromLeft=" in strType:
            self.__m_arrMullionVertUserData[0] = self.__m_arrMullionVertUserData[0] + [strType]
            self.__m_arrMullionVertUserData[1] = self.__m_arrMullionVertUserData[1] + [width]
            self.__m_arrMullionVertUserData[2] = self.__m_arrMullionVertUserData[2] + [thickness]
            self.__m_arrMullionVertUserData[3] = self.__m_arrMullionVertUserData[3] + [capWidth]
            self.__m_arrMullionVertUserData[4] = self.__m_arrMullionVertUserData[4] + [capThickness]
            
    
        self.__m_blnShowMullions = True

    #-----------------------------------------------------------------------------------------------------------------------------------
    #------------------------------------------------------------------------------------------------------------------------------------
    def AddMullionAt(self, direction=None, distance="C", width=0.05*_UNIT_COEF, thickness=0.1*_UNIT_COEF, capThickness=0.05*_UNIT_COEF) :
        
        strType = ""
        if  (direction == "horizontal" or direction == "Horizontal") and distance :
            if distance == "C" : distance = self.__GetPanelProperty("PanelHeight")/2.0
            strType = "Hor_fromBottom=" + str(distance)
        elif  direction == "vertical" or direction == "Vertical" and (type(distance) == FloatType or distance == "C"):
            if distance == "C" : distance = self.__GetPanelProperty("PanelWidth")/2.0 
            strType = "Vert_fromLeft=" + str(distance)
        else: 
            self.__m_warningData.append("Wrong 'direction' or 'distance' parameter on mullion: " + str(direction)) ; return
        
        self.AddMullionType(strType, width, thickness, width, capThickness)
        self.__m_blnShowMullions = True
        
    #------------------------------------------------------------------------------------------------------------------------------------
    #------------------------------------------------------------------------------------------------------------------------------------

    def ChangeMullionType(self, strType=None, width=None, thickness=None, capThickness=None):


        if len(self.__m_arrMullionHorUserData[0]) :
            for i in range(len(self.__m_arrMullionHorUserData[0])):
                if  self.__m_arrMullionHorUserData[0][i] == strType or strType in self.__m_arrMullionHorUserData[0][i]:
                    if width <> None : self.__m_arrMullionHorUserData[1][i] = width
                    if thickness <> None : self.__m_arrMullionHorUserData[2][i] = thickness
                    if width <> None: self.__m_arrMullionHorUserData[3][i] = width
                    if capThickness <> None : self.__m_arrMullionHorUserData[4][i] = capThickness
                
                
        if len(self.__m_arrMullionVertUserData[0]) :
            for i in range(len(self.__m_arrMullionVertUserData[0])) :
                if  self.__m_arrMullionVertUserData[0][i] == strType or strType in self.__m_arrMullionVertUserData[0][i] :
                    if  width <> None : self.__m_arrMullionVertUserData[1][i] = width
                    if  thickness <> None : self.__m_arrMullionVertUserData[2][i] = thickness
                    if width <> None : self.__m_arrMullionVertUserData[3][i] = width
                    if  capThickness <> None : self.__m_arrMullionVertUserData[4][i] = capThickness
                
                
    #------------------------------------------------------------------------------------------------------------------------------------
    # ------------------------------------------------------------------------------------------------------------------------------------
    # Delete functions:  Deletes objects and data structures based on objects' parameters----
    
    def DeleteMullionType(self, strType):
    
        if strType in self.__m_arrMullionHorUserData[0] :
            i = self.__m_arrMullionHorUserData[0].index(strType)
            del self.__m_arrMullionHorUserData[0][i]
            del self.__m_arrMullionHorUserData[1][i]
            del self.__m_arrMullionHorUserData[2][i]
            del self.__m_arrMullionHorUserData[3][i]
            del self.__m_arrMullionHorUserData[4][i]
        elif strType in self.__m_arrMullionVertUserData[0] :
            i = self.__m_arrMullionVertUserData[0].index(strType)
            del self.__m_arrMullionVertUserData[0][i]
            del self.__m_arrMullionVertUserData[1][i]
            del self.__m_arrMullionVertUserData[2][i]
            del self.__m_arrMullionVertUserData[3][i]
            del self.__m_arrMullionVertUserData[4][i]
        else: return
        
        if len(self.__m_arrMullionHorUserData[0]) == 0 and  len(self.__m_arrMullionVertUserData[0]) == 0 :
             self.__m_blnShowMullions = False
             
        self.DeleteMullionType(strType)

    #------------------------------------------------------------------------------------------------------------------------------------
    #------------------------------------------------------------------------------------------------------------------------------------

    def DeleteWindowMullions(self):
        self.DeleteMullionType("WindowTop")
        self.DeleteMullionType("WindowBottom")
        self.DeleteMullionType("WindowLeft")
        self.DeleteMullionType("WindowRight")

    #------------------------------------------------------------------------------------------------------------------------------------
    #------------------------------------------------------------------------------------------------------------------------------------
    
    def DeleteMullionAt(self, direction, distance=None):
        
        strType = ""
        
        if  direction == "horizontal" or direction == "Horizontal" :
            if  distance <> None:
                if distance == "C" : distance = self.__GetPanelProperty("PanelHeight")/2.0
                elif  strType(distance) <> StringType : strType = "Hor_fromBottom=" + str(distance)
            else: strType = "Hor_"
            
            i=0
            while i < len(self.__m_arrMullionHorUserData[0]):
                if  strType in self.__m_arrMullionHorUserData[0][i]:
                    del self.__m_arrMullionHorUserData[0][i]
                    del self.__m_arrMullionHorUserData[1][i]
                    del self.__m_arrMullionHorUserData[2][i]
                    del self.__m_arrMullionHorUserData[3][i]
                    del self.__m_arrMullionHorUserData[4][i]
                else: i+=1
            return

        if  direction == "vertical" or direction == "Vertical" :
            if  distance <> None:
                if distance == "C" : distance = self.__GetPanelProperty("PanelWidth")/2.0
                elif  strType(distance) <> StringType : strType = "Vert_fromLeft=" + str(distance)
            else: strType = "Vert_"   
            
            i=0
            while i < len(self.__m_arrMullionVertUserData[0]):
                if  strType in self.__m_arrMullionVertUserData[0][i]:
                    del self.__m_arrMullionVertUserData[0][i]
                    del self.__m_arrMullionVertUserData[1][i]
                    del self.__m_arrMullionVertUserData[2][i]
                    del self.__m_arrMullionVertUserData[3][i]
                    del self.__m_arrMullionVertUserData[4][i]
                else: i+=1
                
        if len(self.__m_arrMullionHorUserData[0]) == 0 and  len(self.__m_arrMullionVertUserData[0]) == 0 :
             self.__m_blnShowMullions = False
             
             
    #------------------------------------------------------------------------------------------------------------------------------------
    #Shading actions
    #------------------------------------------------------------------------------------------------------------------------------------


    def AddShadingType(self, strShadingType, layerName="_P_Shading", fromLeftBottom=[0.0,0.0], fromRightTop=[0.0,0.0], fromEdge = 0.0, \
        width=.05*_UNIT_COEF, thickness=0.05*_UNIT_COEF, offset=0.0, spacing=.1*_UNIT_COEF, rotation=0.0, shiftEnds=[None, None]) :

        
        if  thickness <= 0 or width <= 0 : return
        
        #handling predefined variables as string paramters
        Window = self.__m_arrWindowUserData
        PanelWidth = self.GetWidth()
        PanelHeight = self.GetHeight()
        if type(fromLeftBottom) == StringType : fromLeftBottom = eval(fromLeftBottom)
        if type(fromRightTop) == StringType : fromRightTop = eval(fromRightTop)
        
        if type(fromLeftBottom) <> ListType or (type(fromLeftBottom[0]) <> FloatType and type(fromLeftBottom[0]) <> IntType) or \
            (type(fromLeftBottom[1]) <> FloatType and type(fromLeftBottom[1])<> IntType):
            self.__m_warningData.append("Wrong Shading fromLeftBottom parameter: "+ str(fromLeftBottom) + " at "+ strShadingType)  ; return
        if type(fromEdge) == StringType : fromEdge = eval(fromEdge)
        if type(fromEdge) <> FloatType and type(fromEdge) <> IntType:
            self.__m_warningData.append("Wrong Shading fromEdge parameter: "+ strShadingType)  ; return        
        if type(fromRightTop) == StringType : fromRightTop = eval(fromRightTop)        
        if type(fromRightTop) <> ListType or (type(fromRightTop[0]) <> FloatType and type(fromRightTop[0])<> IntType) or \
            (type(fromRightTop[1]) <> FloatType and type(fromRightTop[1])<> IntType) :
            self.__m_warningData.append("Wrong Shading fromRightTop parameter: "+ strShadingType)  ; return
        
        ShadingTypes = ["HorizontalShade","VerticalShade", "HorizontalLouver", "VerticalLouver", "HorizontalWindowShade", "VerticalWindowShade", "HorizontalWindowLouver", "VerticalWindowLouver"]
        if strShadingType not in ShadingTypes: self.__m_warningData.append("Wrong shading type: "+ strShadingType) ;return   
               
         #Check for valid possible methods to specify sunshade values       
        if strShadingType in ["HorizontalLouver", "VerticalLouver"] :
            if type(fromRightTop) <> ListType or type(fromLeftBottom[0]) <> FloatType: self.__m_warningData.append("Wrong Shading parameter fromRightTop: "+ strShadingType)  ; return
            if spacing < width : spacing = width
            if spacing < 0.02*self.__m_unitCoef : spacing = 0.02*self.__m_unitCoef
            fromEdge = None
        elif strShadingType in ["HorizontalShade", "VerticalShade", "HorizontalWindowShade", "VerticalWindowShade"] :
            if fromEdge == None : self.__m_warningData.append("Wrong Shading parameter fromEdge: "+ strShadingType) ; return
            fromRightTop = None
        elif strShadingType in ["HorizontalWindowShade", "VerticalWindowShade", "HorizontalWindowLouver", "VerticalWindowLouver"]:
            if self.__m_arrWindowPoints == [0,0,0,0]: self.__m_warningData.append("Window shading type ignored, no window present: " + strShadingType) ; return
            
        self.__m_arrShadingUserData[0] = self.__m_arrShadingUserData[0] + [strShadingType]
        self.__m_arrShadingUserData[1] = self.__m_arrShadingUserData[1] + [fromLeftBottom]
        
        if fromRightTop <> None : self.__m_arrShadingUserData[2] += [fromRightTop]
        else : self.__m_arrShadingUserData[2] += [fromEdge]
        
        self.__m_arrShadingUserData[3] += [width]
        self.__m_arrShadingUserData[4] += [thickness]
        self.__m_arrShadingUserData[5] += [offset]
        self.__m_arrShadingUserData[6] += [spacing]
        self.__m_arrShadingUserData[7] += [rotation]
        self.__m_arrShadingUserData[8] += [layerName]
        self.__m_arrShadingUserData[9] += [shiftEnds]

        self.__m_blnShowShading = True



    #------------------------------------------------------------------------------------------------------------------------------------
    # ------------------------------------------------------------------------------------------------------------------------------------
    def DeleteShadingType(self, type):
    
        if type not in self.__m_arrShadingUserData[0] : return
        
        i = self.__m_arrShadingUserData[0].index(type)
        for arrIndex in range(len(self.__m_arrShadingUserData)) :
            del self.__m_arrShadingUserData[arrIndex][i]
       
        if len(self.__m_arrShadingUserData[0]) == 0 : self.__m_blnShowShading = False
        
        self.DeleteShadingType(type) #Check again for more cases 
            
    #------------------------------------------------------------------------------------------------------------------------------------
    #------------------------------------------------------------------------------------------------------------------------------------
    
    def DeleteShading(self):
    
        for type in self.__m_arrShadingUserData[0]:
            self.DeleteShadingType(type)
            
        self.__m_arrShadingObjects = [0]
    #------------------------------------------------------------------------------------------------------------------------------------
    #------------------------------------------------------------------------------------------------------------------------------------
    def RotateShadingType(self, type, rotation):
    
        if type not in self.__m_arrShadingUserData[0] : return
        
        i = self.__m_arrShadingUserData[0].index(type)
        self.__m_arrShadingUserData[7][i] = rotation
            
            
    #------------------------------------------------------------------------------------------------------------------------------------
    #------------------------------------------------------------------------------------------------------------------------------------
    def ModifyShadingType(self, type, fromLeftBottom=None,fromLeft=None, fromBottom=None, fromRightTop=None, fromRight=None,\
        fromTop=None, fromEdge=None, width=None, thickness=None, offset=None, spacing=None, rotation=None, layerName=None, \
        shiftEnds=None ,shiftEnd1=None, shiftEnd2=None, shiftEnd1X = None, shiftEnd1Y = None, shiftEnd1Z=None, shiftEnd2X = None,\
        shiftEnd2Y = None, shiftEnd2Z=None):
        
        if type  in self.__m_arrShadingUserData[0]:
            shadingIndex = self.__m_arrShadingUserData[0].index(type)
            self.ModifyShadingIndex( shadingIndex, None, fromLeftBottom, fromLeft, fromBottom, fromRightTop, fromRight, fromTop, fromEdge,\
                width, thickness, offset, spacing, rotation, layerName, shiftEnds,shiftEnd1, shiftEnd2, shiftEnd1X, shiftEnd1Y, shiftEnd1Z,\
                shiftEnd2X, shiftEnd2Y, shiftEnd2Z)
            return
            
        if type =="All":
            for shadingIndex in range(len(self.__m_arrShadingUserData[0])):       
                self.ModifyShadingIndex( shadingIndex, None, fromLeftBottom, fromLeft, fromBottom, fromRightTop, fromRight, fromTop, fromEdge,\
                    width, thickness, offset, spacing, rotation, layerName, shiftEnds,shiftEnd1, shiftEnd2, shiftEnd1X, shiftEnd1Y, shiftEnd1Z,\
                    shiftEnd2X, shiftEnd2Y, shiftEnd2Z)
    
    
    def ModifyShadingIndex(self, index, type=None, fromLeftBottom=None, fromLeft=None, fromBottom=None, fromRightTop=None, fromRight=None,\
        fromTop=None, fromEdge=None, width=None, thickness=None, offset=None, spacing=None, rotation=None, layerName=None, shiftEnds=None,\
        shiftEnd1=None, shiftEnd2=None, shiftEnd1X = None, shiftEnd1Y = None, shiftEnd1Z=None, shiftEnd2X = None, shiftEnd2Y = None, shiftEnd2Z=None):
              
        if index >= len(self.__m_arrShadingUserData[0]) : return
        
        i = index 
        if type  <> None : self.__m_arrShadingUserData[0][i] = type        
        if fromLeftBottom  <> None : self.__m_arrShadingUserData[1][i] = fromLeftBottom
        if fromLeft  <> None : self.__m_arrShadingUserData[1][i][0] = fromLeft       
        if fromBottom  <> None : self.__m_arrShadingUserData[1][i][1] = fromBottom   
        if fromRightTop <> None : self.__m_arrShadingUserData[2][i] = fromRightTop
        if fromRight  <> None : self.__m_arrShadingUserData[2][i][0] = fromRight      
        if fromTop  <> None : self.__m_arrShadingUserData[2][i][1] = fromTop  
        if fromEdge <> None : self.__m_arrShadingUserData[2][i] = fromEdge
        if width <> None : self.__m_arrShadingUserData[3][i] = width
        if thickness <> None : self.__m_arrShadingUserData[4][i] = thickness
        if offset <> None : self.__m_arrShadingUserData[5][i] = offset
        if spacing <> None : self.__m_arrShadingUserData[6][i] = spacing
        if rotation<> None : self.__m_arrShadingUserData[7][i] = rotation
        if layerName <> None : self.__m_arrShadingUserData[8][i] = layerName
        if shiftEnds <> None : self.__m_arrShadingUserData[9][i] = shiftEnds

        currShiftEnds = self.__m_arrShadingUserData[9][i] 
        if shiftEnd1 <> None : currShiftEnds[0] = shiftEnd1
        if shiftEnd2 <> None : currShiftEnds[1] = shiftEnd2
        if (shiftEnd1X <> None or shiftEnd1Y<>None or shiftEnd1Z<>None) and not isinstance(currShiftEnds[0], list):
            currShiftEnds[0]=[0,0,0]
        if (shiftEnd2X <> None or shiftEnd2Y<>None or shiftEnd2Z<>None) and not isinstance(currShiftEnds[1], list):
            currShiftEnds[1]=[0,0,0]
        if shiftEnd1X <> None : currShiftEnds[0][0] = shiftEnd1X
        if shiftEnd1Y <> None : currShiftEnds[0][1] = shiftEnd1Y
        if shiftEnd1Z <> None : currShiftEnds[0][2] = shiftEnd1Z
        if shiftEnd2X <> None : currShiftEnds[1][0] = shiftEnd2X
        if shiftEnd2Y <> None : currShiftEnds[1][1] = shiftEnd2Y
        if shiftEnd2Z <> None : currShiftEnds[1][2] = shiftEnd2Z
        

    def UpdateShading(self):
        shadingUserData = copy.deepcopy(self.__m_arrShadingUserData)
        if len(shadingUserData[0]) :
            self.DeleteShading()
            for i in range(len(shadingUserData[0])) :
                if shadingUserData[0][i] in ["HorizontalLouver", "VerticalLouver", "HorizontalWindowLouver", "VerticalWindowLouver"]:
                    self.AddShadingType(shadingUserData[0][i], layerName=shadingUserData[8][i], fromLeftBottom=shadingUserData[1][i], fromRightTop=shadingUserData[2][i],\
                        width=shadingUserData[3][i], thickness=shadingUserData[4][i], offset=shadingUserData[5][i], spacing=shadingUserData[6][i],\
                        rotation=shadingUserData[7][i], shiftEnds=shadingUserData[9][i])
                if shadingUserData[0][i] in ["HorizontalShade", "VerticalShade", "HorizontalWindowShade", "VerticalWindowShade"]:
                    self.AddShadingType(shadingUserData[0][i], layerName=shadingUserData[8][i], fromLeftBottom=shadingUserData[1][i], fromEdge=shadingUserData[2][i],\
                        width=shadingUserData[3][i], thickness=shadingUserData[4][i], offset=shadingUserData[5][i], spacing=shadingUserData[6][i],\
                        rotation=shadingUserData[7][i], shiftEnds=shadingUserData[9][i])
                        

    #------------------------------------------------------------------------------------------------------------------------------------
    #Custom Geometry actions
    #------------------------------------------------------------------------------------------------------------------------------------


    def AddCustomGeometry(self, brepCustomGeo, vecPlacement=None, vecScaleFactors=None, vecUpVector=None, blnTilable=None, \
        dblRotation=None, windowDepth=None, trimToPanelSize=None):
        
        if str(type(brepCustomGeo)) <> "<type 'instance'>" and  type(brepCustomGeo) <> ListType: 
            self.__m_warningData.append("Panel '"+self.GetName()+"': Invalid Custom Geometry Object"); return
            
        if brepCustomGeo == None or  brepCustomGeo == []: 
            self.__m_warningData.append("Panel '"+self.GetName()+"': Invalid Custom Geometry Object"); return
        
        #store parameters
        self.__m_CustomGeoBaseData = brepCustomGeo
        if str(type(self.__m_CustomGeoBaseData)) == "<type 'instance'>" : 
            self.__m_CustomGeoBreps = self.__m_CustomGeoBaseData.Run()
            if None in self.__m_CustomGeoBreps or self.__m_CustomGeoBreps == []: self.__m_CustomGeoBreps = [rg.Brep()]
        else:
            self.__m_CustomGeoBreps = list(brep.DuplicateBrep() for brep in self.__m_CustomGeoBaseData)
        
        if vecPlacement : self.__m_CG_vecPlacement = vecPlacement
        if vecUpVector.IsUnitVector : self.__m_CG_vecUpVector = vecUpVector
        self.__m_CG_blnTilable = blnTilable
        if dblRotation <> None : self.__m_CG_dblRotation = dblRotation
        if windowDepth <> None : self.__m_CG_windowDepth = windowDepth
        if trimToPanelSize <> None: self.__m_CG_trimToPanelSize = trimToPanelSize
        
            
        #get size data
        tmpGeoBBox = rg.Brep().GetBoundingBox(True)
        for brep in self.__m_CustomGeoBreps:
            tmpGeoBBox.Union(brep.GetBoundingBox(True))
        tmpGeoSize = tmpGeoBBox.Max - tmpGeoBBox.Min
        
        #rotate based on Z up value
        if self.__m_CG_vecUpVector.X == 1 :
            ptOrigin = rg.Point3d(0,tmpGeoSize.Y,0)
            ptVectorX = rg.Point3d(0,tmpGeoSize.Y-1,0)
            ptVectorY = rg.Point3d(1,tmpGeoSize.Y,0)
        elif self.__m_CG_vecUpVector.X == -1 :
            ptOrigin = rg.Point3d(tmpGeoSize.X,0,0)
            ptVectorX = rg.Point3d(tmpGeoSize.X,1,0)
            ptVectorY = rg.Point3d(tmpGeoSize.X-1,0,0)
        elif self.__m_CG_vecUpVector.Y == 1 :
            ptOrigin = rg.Point3d(0,0,0)
            ptVectorX = rg.Point3d(1,0,0)
            ptVectorY = rg.Point3d(0,1,0)
        elif self.__m_CG_vecUpVector.Y == -1 :
            ptOrigin = rg.Point3d(tmpGeoSize.X, tmpGeoSize.Y,0)
            ptVectorX = rg.Point3d(tmpGeoSize.X-1, tmpGeoSize.Y,0)
            ptVectorY = rg.Point3d(tmpGeoSize.X, tmpGeoSize.Y-1,0)
        elif self.__m_CG_vecUpVector.Z == 1 :
            ptOrigin = rg.Point3d(0, tmpGeoSize.Y, 0)
            ptVectorX = rg.Point3d(1, tmpGeoSize.Y, 0)
            ptVectorY = rg.Point3d(0, tmpGeoSize.Y, 1)
        elif self.__m_CG_vecUpVector.Z == -1 :
            ptOrigin = rg.Point3d(tmpGeoSize.X, tmpGeoSize.Y, tmpGeoSize.Z)
            ptVectorX = rg.Point3d(tmpGeoSize.X-1, tmpGeoSize.Y, tmpGeoSize.Z)
            ptVectorY = rg.Point3d(tmpGeoSize.X, tmpGeoSize.Y, tmpGeoSize.Z-1)
            
        #apply vectorUp orientation
        plFrom = rg.Plane(ptOrigin, ptVectorX, ptVectorY)
        plTo = rg.Plane(rg.Point3d(0,0,0), rg.Point3d(1,0,0), rg.Point3d(0,0,1))
        brepTransform = rg.Transform.PlaneToPlane(plFrom, plTo)
        for brep in self.__m_CustomGeoBreps: brep.Transform(brepTransform)
            
        #scale based on scale factor
        if vecScaleFactors <> rg.Vector3d(1,1,1) : 
            self.__m_CG_vecScaleFactor = vecScaleFactors
            plOrigin = rg.Plane(rg.Point3d(0,0,0), rg.Point3d(1,0,0), rg.Point3d(0,1,0))
            brepTransform = rg.Transform.Scale(plOrigin, self.__m_CG_vecScaleFactor.X, self.__m_CG_vecScaleFactor.Y, self.__m_CG_vecScaleFactor.Z)
            for brep in self.__m_CustomGeoBreps: brep.Transform(brepTransform)
            # flip normals if negative scaling
            flipCG = False
            if self.__m_CG_vecScaleFactor.X < 0 : flipCG = not flipCG
            if self.__m_CG_vecScaleFactor.Y < 0 : flipCG = not flipCG
            if self.__m_CG_vecScaleFactor.Z < 0: flipCG = not flipCG
            if flipCG : 
                for brep in self.__m_CustomGeoBreps: brep.Flip()
            
        #get size data
        tmpGeoBBox = rg.Brep().GetBoundingBox(True)
        for brep in self.__m_CustomGeoBreps:
            tmpGeoBBox.Union(brep.GetBoundingBox(True))
        tmpGeoSize = tmpGeoBBox.Max - tmpGeoBBox.Min
        
        #place custom geometry at coordinates origon 0,0,0(tile) or center(no tile)
        cPSCornerPts = self.__GetCornerPoints()
        cPSBBox = rg.BoundingBox(cPSCornerPts)     
        
        #extract origin brep if included
        insertPoint = None
        if 'DGOrigin' in self.__m_CustomGeoBreps[0].GetUserStrings().AllKeys: 
            insertPoint = self.__m_CustomGeoBreps[0].Vertices[0].Location
        vecTranslate = None
        if insertPoint:
            vecTranslate = rg.Vector3d(insertPoint-cPSCornerPts[0])
        else:
            """
            if self.__m_CG_blnTilable : 
                vecTranslate = rg.Vector3d(tmpGeoBBox.Min-cPSBBox.Min)
            else:
                vecTranslate = rg.Vector3d(tmpGeoBBox.Center- cPSBBox.Center)
            """
            vecTranslate = rg.Vector3d(tmpGeoBBox.Min-cPSBBox.Min)
            vecTranslate.Y = rg.Vector3d(tmpGeoBBox.Max-cPSBBox.Max).Y
        
        for brep in self.__m_CustomGeoBreps: 
            brep.Translate(-vecTranslate)
            
        #move based on placement data
        if not self.__m_CG_vecPlacement.IsZero:
            for brep in self.__m_CustomGeoBreps: brep.Translate(self.__m_CG_vecPlacement)   
            
        #create rotation transformation based on rotation data
        rotXform = rg.Transform.Rotation(math.radians(self.__m_CG_dblRotation), rg.Vector3d(0,1,0), cPSBBox.Center)            
            
        #tile geometry if turned on
        if self.__m_CG_blnTilable:
            #define tiling base area
            tileAreaBBox =  rg.BoundingBox(cPSCornerPts)
            tolerance = sc.doc.ModelAbsoluteTolerance
            #recalculate required area to tile based on customGeo rotation
            if self.__m_CG_dblRotation <> 0:
                tileAreaBBox.Transform(rotXform)      
            tileAreaSize = tileAreaBBox.Max - tileAreaBBox.Min
            tileAreaWidth = tileAreaSize.X
            tileAreaHeight = tileAreaSize.Z
            tmpGeoBBox = rg.Brep().GetBoundingBox(True)
            for brep in self.__m_CustomGeoBreps:
                tmpGeoBBox.Union(brep.GetBoundingBox(True))
            tmpGeoSize = tmpGeoBBox.Max - tmpGeoBBox.Min
            #process tiling for each brep in list
            tmpCustomGeoBreps = []
            for index, brep in enumerate(self.__m_CustomGeoBreps):
                #move geometry to the left if not at origin
                xPos = round(tmpGeoBBox.Min.X, 3); xStep = round(tmpGeoSize.X, 3)
                vecWidth = rg.Vector3d(-xStep,0,0)            
                while xPos > 0 :
                    brep.Translate(vecWidth)
                    xPos -= xStep
                #move geometry to the bottom if not at origin
                zPos = round(tmpGeoBBox.Min.Z, 3); zStep = round(tmpGeoSize.Z, 3)
                vecHeight = rg.Vector3d(0, 0, -zStep)
                while zPos > 0 :
                    brep.Translate(vecHeight)
                    zPos -= zStep
                #create array of breps to cover panel
                tmpGeoList = []
                xTrans = 0; zTrans = 0
                while True:
                    while xPos < tileAreaWidth:        
                        tmpGeo = brep.DuplicateBrep()
                        vecWidth = rg.Vector3d(xTrans,0,zTrans)                    
                        tmpGeo.Translate(vecWidth)
                        tmpGeoList.append(tmpGeo)
                        xPos += xStep ; xTrans += xStep
                    zPos += zStep ; zTrans += zStep
                    if zPos < tileAreaHeight: xPos -= xTrans; xTrans =0     
                    else: break
                tmpCustomGeoBreps += tmpGeoList

            self.__m_CustomGeoBreps = tmpCustomGeoBreps
            # relocate tiles brep to right location before rotation
            if self.__m_CG_dblRotation <> 0: 
                for brep in self.__m_CustomGeoBreps: brep.Translate(tileAreaBBox.Min.X, 0, tileAreaBBox.Min.Z)
                
        # perform rotation on final brep
        if self.__m_CG_dblRotation <> 0: 
            for brep in self.__m_CustomGeoBreps: brep.Transform(rotXform)
        
        self.__m_blnShowCustomGeo = True
        
        
        
    def ModifyCustomGeometry(self, brepCustomGeo=None, vecPlacement=None,placementX=None, placementY=None,placementZ=None,\
        vecScaleFactors=None, scaleX=None, scaleY=None, scaleZ=None, vecUpVector=None, upVectorX=None, upVectorY=None, upVectorZ=None,\
        blnTilable=None, rotation=None, windowDepth=None, dynamicGeoParams=None, trimToPanelSize = None):
        
        if brepCustomGeo == None : brepCustomGeo = self.__m_CustomGeoBaseData
        
        #set dynamic geometry parameters if available
        if dynamicGeoParams <> None and str(type(self.__m_CustomGeoBaseData)) == "<type 'instance'>" : 
            if type(dynamicGeoParams) == ListType:
                for param, value in dynamicGeoParams: self.__m_CustomGeoBaseData.SetParameter(param, value)
            else: self.__m_CustomGeoBaseData.SetParameter(dynamicGeoParams)
        
        if vecPlacement == None : 
            vecPlacement = self.__m_CG_vecPlacement
            if placementX <> None : vecPlacement.X = placementX
            if placementY <> None : vecPlacement.Y = placementY
            if placementZ <> None : vecPlacement.Z = placementZ
        
        if vecScaleFactors == None : 
            vecScaleFactors = self.__m_CG_vecScaleFactor
            if scaleX <> None : vecScaleFactors.X = scaleX
            if scaleY <> None : vecScaleFactors.Y = scaleY
            if scaleZ <> None : vecScaleFactors.Z = scaleZ
        
        if vecUpVector == None : 
            vecUpVector = self.__m_CG_vecUpVector
            if upVectorX <> None : vecUpVector.X = upVectorX
            if upVectorY <> None : vecUpVector.Y = upVectorY
            if upVectorZ <> None : vecUpVector.Z = upVectorZ
            
        #if vecScaleFactors == None : vecScaleFactors = self.__m_CG_vecScaleFactor
        if vecUpVector == None : vecUpVector = self.__m_CG_vecUpVector      
        if blnTilable == None : blnTilable = self.__m_CG_blnTilable
        if rotation == None : rotation = self.__m_CG_dblRotation
        if windowDepth == None : windowDepth = self.__m_CG_windowDepth
        if trimToPanelSize == None : trimToPanelSize = self.__m_CG_trimToPanelSize

        self.AddCustomGeometry(brepCustomGeo, vecPlacement, vecScaleFactors, vecUpVector, blnTilable, rotation, windowDepth, trimToPanelSize)
        
    #----------------------------------------------------------------------------------------------------------------------            
    #PANEL ELEMENTS HIDE/SHOW SECTION--Deletes objects and "Show" varialbles set to off, data strcutures left undtouched----
    #----------------------------------------------------------------------------------------------------------------------    
    #----------------------------------------------------------------------------------------------------------------------
    
    def ShowWall(self):
        if not self.__m_blnShowWall :
            self.__m_blnShowWall = True 
            #self.DrawWall()

    def HideWall(self):
        #Delete Old Wall If Exists.
        if self.__m_arrWallObjects and not type(self.__m_arrWallObjects[0]) == IntType and rs.IsObject(self.__m_arrWallObjects[0]):
           rs.DeleteObjects(self.__m_arrWallObjects)
            
        self.__m_blnShowWall = False
            
            
            
    #----------------------------------------------------------------------------------------------------------------------	
    #----------------------------------------------------------------------------------------------------------------------

    def ShowPane(self):
        if not self.__m_blnShowPane :
            self.__m_blnShowPane = True 
            #self.DrawPane()	

    def HidePane(self):
        #Delete Old Wall Cover objects if exists.
        if self.__m_arrPaneObjects and not type(self.__m_arrPaneObjects[0]) == IntType and rs.IsObject(self.__m_arrPaneObjects[0]): 
            rs.DeleteObjects(self.__m_arrPaneObjects)
        self.__m_blnShowPane = False
        
        
    #----------------------------------------------------------------------------------------------------------------------	
    #----------------------------------------------------------------------------------------------------------------------

    def ShowWindow(self):
        if not self.__m_blnShowWindow and self.__m_arrWindowPoints <> [0,0,0,0]:
            self.__m_blnShowWindow = True
            #self.ShowMullions()
            #self.Draw()
        
        
    def HideWindow(self):
        #Delete Window if Exists.
        if self.__m_arrWindowObjects and not type(self.__m_arrWindowObjects[0]) == IntType and rs.IsObject(self.__m_arrWindowObjects[0]): 
            rs.DeleteObjects(self.__m_arrWindowObjects)
        self.__m_blnShowWindow = False
        

    #----------------------------------------------------------------------------------------------------------------------
    #----------------------------------------------------------------------------------------------------------------------
        
    def ShowMullions(self):
        if not self.__m_blnShowMullions :
            self.__m_blnShowMullions = True  
            #self.DrawMullions()
        
        
    def HideMullions(self):
        
        #Delete Mullions if Exist.
        
        if self.__m_arrMullionHorObjects and not type(self.__m_arrMullionHorObjects[0]) == IntType and rs.IsObject(self.__m_arrMullionHorObjects[0]):
            rs.DeleteObjects(self.__m_arrMullionHorObjects)

        
        if self.__m_arrMullionVertObjects and not type(self.__m_arrMullionVertObjects[0]) == IntType and rs.IsObject(self.__m_arrMullionVertObjects[0]):
            rs.DeleteObjects(self.__m_arrMullionVertObjects)

            
        self.__m_blnShowMullions = False
        
        
    #----------------------------------------------------------------------------------------------------------------------
    #----------------------------------------------------------------------------------------------------------------------

    def ShowShading(self):
        if not self.__m_blnShowShading :
            self.__m_blnShowShading = True
            #self.DrawShading()
        
        
    def HideShading(self):
        #Delete Shadnig if Exists.
        if self.__m_arrShadingObjects and not type(self.__m_arrShadingObjects[0]) == IntType and rs.IsObject(self.__m_arrShadingObjects[0]): 
            rs.DeleteObjects(self.__m_arrShadingObjects)
            
        self.__m_arrShadingObjects = [0]
        self.__m_blnShowShading = False
        
    #----------------------------------------------------------------------------------------------------------------------
    #----------------------------------------------------------------------------------------------------------------------
        
    def ShowCustomGeometry(self):
        if not self.__m_blnShowCustomGeo :
            self.__m_blnShowCustomGeo = True
        
        
    def HideCustomGeometry(self):
        #Delete Shadnig if Exists.
        if self.__m_CustomGeoObjects and len(self.__m_CustomGeoObjects) > 0 and rs.IsObject(self.__m_CustomGeoObjects[0]) : \
            rs.DeleteObjects(self.__m_CustomGeoObjects)
            
        self.__m_CustomGeoObjects  = []
        self.__m_blnShowCustomGeo = False
        
    
    #----------------------------------------------------------------------------------------------------------------------
    #----------------------------------------------------------------------------------------------------------------------

    def HideAll(self):
        self.HideMullions()
        self.HideWindow()
        self.HidePane()
        self.HideWall()
        self.HideShading()
        self.HideCustomGeometry()        


    #----------------------------------------------------------------------------------------------------------------------
    #DRAW GEOMETRY SECTION-------------------------------------------------------------------------------------------------
    
    #----------------------------------------------------------------------------------------------------------------------

    def Draw(self, sceneObjects = False):

        if self.__m_blnShowWall : self.DrawWall()
        
        if self.__m_blnShowWindow : self.DrawWindow()
        
        if self.__m_blnShowPane : self.DrawPane()
        
        if self.__m_blnShowMullions : self.DrawMullions()
        
        if self.__m_blnShowShading : self.DrawShading()
        
        if self.__m_blnShowCustomGeo : self.DrawCustomGeometry()
        
        if self.__m_blnShowDeform : self.DrawMorph()
        
        if sceneObjects : self.DrawSceneObjects()
        
        return
    
    
    #----------------------------------------------------------------------------------------------------------------------
    #----------------------------------------------------------------------------------------------------------------------
        
    def DrawWall(self):
        
        panelPoints = self.__GetCornerPoints()
        
        #Ignore draw wall if window is as large as panel
        
        if self.__m_blnShowWindow :
            windowPoints = [self.__BaseToSurfaceWindowPoint(p) for p in self.__m_arrWindowPoints]# for by-surface panels
            w1, w2, w4, w3 = [rg.Point3d(p[0], p[1], p[2])for p in windowPoints]
            for p,w in zip(panelPoints, [w1, w2, w3, w4]):
                sameSize = False
                if p <> w: break;
                sameSize = True
            if sameSize  : return
        
        cornerPt1, cornerPt2, cornerPt3, cornerPt4 = panelPoints
            
            
        if self.GetDrawMode() == "LADYBUG" : #Wall as single sided in Ladybug draw mode
            wall = rg.Brep.CreateFromCornerPoints(cornerPt1, cornerPt2, cornerPt4, cornerPt3, sc.doc.ModelAbsoluteTolerance)
            if wall <> None or wall <> []: self.__m_arrWallBreps[0] = wall

        else: #DEFAULT MODE 
            wallCurve = rg.Curve.CreateInterpolatedCurve([cornerPt1, cornerPt2, cornerPt4, cornerPt3, cornerPt1],1)
            extrusion = rg.Extrusion.Create(wallCurve, -self.__m_dblWallThickness, True)
            self.__m_arrWallBreps[0]  = extrusion.ToBrep()
                         
        if self.__m_arrWallBreps[0] == None:
            self.__m_warningData.append("Wall shape invalid - discarded")
            self.__m_arrWallBreps = [0] 
            return
            
        self.__m_blnShowWall = True
        
    #----------------------------------------------------------------------------------------------------------------------
    #----------------------------------------------------------------------------------------------------------------------
    
    def DrawPane(self):
        
        #Ignore draw pane if window is as large as panel
        if self.__m_blnShowWindow :
            panelPoints = self.__GetCornerPoints()
            windowPoints = [self.__BaseToSurfaceWindowPoint(p) for p in self.__m_arrWindowPoints]# for by-surface panels
            w1, w2, w4, w3 = [rg.Point3d(p[0], p[1], p[2])for p in windowPoints]
            for p,w in zip(panelPoints, [w1, w2, w3, w4]):
                sameSize = False
                if p <> w: break;
                sameSize = True
            if sameSize  : return        
            
        if self.GetDrawMode() == "LADYBUG" : return   #pane excluded from Ladybug draw mode
        
        GlsSurface = 0          # Surface of Subtracting Object
        CoverSurface = 0        # Surface of Wall Cover 
        strExtrCurve = 0        #: Path is used to Extude, Length of line is equal to Thickness of Wall Cover
        strExtrCurve2 = 0       #: Path is used to Extude Surface of Subtracting Object, Length of line is equal to Thickness of Wall Cover+ Distance between Wall Cover and wall
        OpeningObject = 0
        arrPaneObjects = []
        
        #set up pane offset dimensions
        if type(self.__m_dblPaneOffsetEdge)==ListType : #if a list was provided
            paneOffset = self.__m_dblPaneOffsetEdge     
            for i in range(len(paneOffset),4): paneOffset.append(0) #complete with ceros if less than 4 values.
        else:  #else repeat 4 times the number
            paneOffset = [self.__m_dblPaneOffsetEdge, self.__m_dblPaneOffsetEdge, self.__m_dblPaneOffsetEdge, self.__m_dblPaneOffsetEdge]     
        
        rcTolerance = sc.doc.ModelAbsoluteTolerance  
        
        if not self.GetPanelProperty("SurfacePanelMode"):
            
            pt1 = [paneOffset[0], 0, paneOffset[1]]
            pt2 = [self.__m_dblWidth-paneOffset[2], 0, paneOffset[1]]
            pt3 = [paneOffset[0], 0, self.__m_dblHeight-paneOffset[3]]
            pt4 = [self.__m_dblWidth-paneOffset[2], 0, self.__m_dblHeight-paneOffset[3]]
            pt1, pt2, pt3, pt4 = [rg.Point3d(pt[0], pt[1], pt[2]) for pt in [pt1, pt2, pt3, pt4]]
            paneCurve = rg.Curve.CreateInterpolatedCurve([pt1, pt2, pt4, pt3, pt1],1)
            
        else:
            #if SurfacePanel mode apply first offset only
            p1, p2, p3, p4 = self.__GetCornerPoints()
            panePts = [p1, p2, p4, p3, p1]
            paneCurve = rg.Curve.CreateInterpolatedCurve(panePts,1)  
            if paneOffset[0] > 0:
                # remove (almost) coincident 4th pt in3pt panels to avoid error in offset
                if self.__GetPanelProperty("SurfacePanelSides") == 3:
                    panePts = []
                    for pt, dist in [[p1, p3.DistanceTo(p1)], [p2, p1.DistanceTo(p2)], [p4, p2.DistanceTo(p4)],[p3, p4.DistanceTo(p3)]]:
                        if dist > paneOffset[0] : panePts.append(pt)
                    panePts += [panePts[0]]
                    paneCurve = rg.Curve.CreateInterpolatedCurve(panePts,1)
                #create offset curve     
                ofCurve = paneCurve.Offset(rg.Plane.WorldZX, paneOffset[0], rcTolerance, rg.CurveOffsetCornerStyle.Sharp)
                if ofCurve : paneCurve = ofCurve[0]
        #create pane object
        extrusion = rg.Extrusion.Create(paneCurve, self.__m_dblPaneThickness, True)
        self.__m_arrPaneBreps[0] = extrusion.ToBrep()
        
        if not self.GetPanelProperty("SurfacePanelMode"):    
            #Create pane tiles if parameters configured for non Surface Panels
            if self.__m_dblPaneTileWidth and self.__m_dblPaneTileHeight and self.__m_dblPaneTileThickness :
                
                y = -self.__m_dblPaneTileThickness # lay tiles in front of pane base object
                tileHeight = self.__m_dblPaneTileHeight
                z = tileHeight/2 + paneOffset[1]; zStep = tileHeight + self.__m_dblPaneTileGap
                
                while z-tileHeight/2 < (self.__m_dblHeight-paneOffset[3]) : #loop through vertical spacing
                    if z + tileHeight/2 >  (self.__m_dblHeight-paneOffset[3]) : #create custom piece height at the top
                        tileHeight = (self.__m_dblHeight-paneOffset[3]) - (z-tileHeight/2)
                        z = (self.__m_dblHeight-paneOffset[3]) - tileHeight/2
                    x = paneOffset[0] ; xStep = self.__m_dblPaneTileWidth + self.__m_dblPaneTileGap
                    while x <  (self.__m_dblWidth-paneOffset[2]) : #loop through horizontal spacing
                        start = [x,y,z] ; end = [x+self.__m_dblPaneTileWidth,y,z]
                        if end[0] > (self.__m_dblWidth-paneOffset[2]) : end[0] = (self.__m_dblWidth-paneOffset[2]) #create custom piece width at the right end
                        #create tile
                        member = self.DrawMember(start, end, tileHeight, self.__m_dblPaneTileThickness)
                        if member : self.__m_arrPaneBreps.append(member)
                        x += xStep
                    z += zStep
                    
            #Move to place(front of wall)
            for obj in self.__m_arrPaneBreps: obj.Translate(0, -1 * self.__m_dblPaneOffset, 0)
        
            
        #Create Opening
        if self.__m_blnShowWindow : #: If Window exists we need to subtract Window from panel base and tiles.
            arrOpeningPoints = copy.deepcopy(windowPoints)
            
            #Avoid boolean error when subraction boxes align with panel edges
            if round(self.__GetPanelProperty("WindowLeft"),3) == 0 : arrOpeningPoints[0][0] = arrOpeningPoints[3][0] = -.1*self.__m_unitCoef
            if round(self.__GetPanelProperty("WindowRight"),3) == 0 : arrOpeningPoints[1][0] = arrOpeningPoints[2][0] = self.GetWidth()+.1*self.__m_unitCoef
            if round(self.__GetPanelProperty("WindowBottom"),3) == 0 : arrOpeningPoints[0][2] = arrOpeningPoints[1][2] = -.1*self.__m_unitCoef 
            if round(self.__GetPanelProperty("WindowTop"),3) == 0 : arrOpeningPoints[2][2] = arrOpeningPoints[3][2] = self.GetHeight()+.1*self.__m_unitCoef
            
            pt1, pt2, pt3, pt4 = arrOpeningPoints
            GlsSurface = rg.Brep.CreateFromCornerPoints(rg.Point3d(pt1[0],pt1[1],pt1[2]), rg.Point3d(pt2[0],pt2[1],pt2[2]),\
                rg.Point3d(pt3[0],pt3[1],pt3[2]), rg.Point3d(pt4[0],pt4[1],pt4[2]), rcTolerance)
            if GlsSurface == None : 
                self.__m_warningData.append("Window shape invalid - opening in panel discarded")
            else:
                OpeningObject = GlsSurface.Faces.Item[0].CreateExtrusion(\
                    rg.LineCurve(rg.Point3d(0,0,0), rg.Point3d(0, 4*self.__m_unitCoef, 0)), True)
                OpeningObject.Translate(0,-2*self.__m_unitCoef,0)
                
                arrPaneObjects = self.__m_arrPaneBreps
                self.__m_arrPaneBreps = []
                for index, obj in enumerate(arrPaneObjects):
                    if OpeningObject.GetBoundingBox(True).Contains(obj.GetBoundingBox(True), False) :
                        continue
                    boolResult = list(rg.Brep.Split(obj, OpeningObject , rcTolerance))
                    if not len(boolResult) :self.__m_arrPaneBreps += [obj]
                    #exclude pieces inside boolean solid
                    for piece in boolResult : 
                        bbox = OpeningObject.GetBoundingBox(True)
                        bbox.Inflate(.02*self.__m_unitCoef)
                        if bbox.Contains(piece.GetBoundingBox(True), False): continue
                        if index > 0 : piece.Flip() #flip boolean result of pane tiles (bug)
                        self.__m_arrPaneBreps += [piece]
                
        self.__m_blnShowPane = True
        
    
    #----------------------------------------------------------------------------------------------------------------------
    #----------------------------------------------------------------------------------------------------------------------
    
    def DrawWindow(self):
        
        GlsSurface = 0                #:Surface of Glass
        strExtrCurve = 0              #:Path used to Extrude Subtracting Object, Lenght equal to Wall Depth
        GlassObjectTemp = 0
        wallObjectTemp = 0 #bollean window operation result
        
        #Create Window Panel
        rcTolerance = sc.doc.ModelAbsoluteTolerance
        windowPoints = [self.__BaseToSurfaceWindowPoint(p) for p in self.__m_arrWindowPoints]# for by-surface panels
        pt1, pt2, pt3, pt4 = windowPoints
        GlsSurface = rg.Brep.CreateFromCornerPoints(pt1, pt2, pt3, pt4, rcTolerance)
        if GlsSurface == None : 
            self.__m_warningData.append("Window shape invalid - discarded")
            return
            
        if self.GetDrawMode() == "LADYBUG" and self.__m_dblWinGlassThickness > 0:
            self.__m_arrWindowBreps[0] = GlsSurface #in LADYBUG mode only glass pane is drawn
            #Move to place
            self.__m_arrWindowBreps[0].Translate(0, -self.__m_dblWinGlassOffset, 0)
            self.__m_blnShowWindow = True
            if self.__m_blnShowWall and self.__m_arrWallBreps <> [0]:
                tmpObject = rg.Brep.CreateBooleanDifference(self.__m_arrWallBreps[0], GlsSurface, rcTolerance)
                if tmpObject : self.__m_arrWallBreps = tmpObject
                
            return
            
        if self.__m_dblWinGlassThickness > 0 : #create glass pane if thickness > 0 otherwise just create opening
            self.__m_arrWindowBreps[0]= GlsSurface.Faces.Item[0].CreateExtrusion(\
                rg.LineCurve(rg.Point3d(0,0,0), rg.Point3d(0, self.__m_dblWinGlassThickness, 0)), True)
            #Move to place
            self.__m_arrWindowBreps[0].Translate(0, -self.__m_dblWinGlassOffset, 0)

            
        #Create Opening if wall is visible
        if self.__m_blnShowWall and self.__m_arrWallBreps <> [0]:

            GlassObjectTemp = GlsSurface.Faces.Item[0].CreateExtrusion(\
                rg.LineCurve(rg.Point3d(0,0,0), rg.Point3d(0, self.__m_dblWallThickness, 0)), True)
            wallObjectTemp = self.__m_arrWallBreps[0]
            wallBreps = rg.Brep.CreateBooleanDifference(wallObjectTemp, GlassObjectTemp, rcTolerance)
            self.__m_arrWallBreps = list(wallBreps)
            
            if wallBreps == None or  wallBreps == []:
                self.__m_warningData.append("Wall shape invalid - discarded")
                self.__m_arrWallBreps = [0] 
                return
                
        self.__m_blnShowWindow = True
        

    #----------------------------------------------------------------------------------------------------------------------
    #----------------------------------------------------------------------------------------------------------------------
        
    def DrawMullions(self):
        
            
        self.__m_arrMullionHorBreps = []
        self.__m_arrMullionVertBreps = []
            
        #Populate array with new mullions based on Mullion Data array
        #Horizontal
        if len(self.__m_arrMullionHorUserData[0]) :
            for i in range(len(self.__m_arrMullionHorUserData[0])) :
                mullionObjList = self.DrawMullionType(self.__m_arrMullionHorUserData[0][i], self.__m_arrMullionHorUserData[1][i], self.__m_arrMullionHorUserData[2][i],\
                    self.__m_arrMullionHorUserData[3][i], self.__m_arrMullionHorUserData[4][i])
                if type(mullionObjList) == ListType and mullionObjList[0]: 
                    self.__m_arrMullionHorBreps.append(mullionObjList)
                
        #Vertical
        if len(self.__m_arrMullionVertUserData[0])  :
            for i in range(len(self.__m_arrMullionVertUserData[0])):
                mullionObjList = self.DrawMullionType(self.__m_arrMullionVertUserData[0][i], self.__m_arrMullionVertUserData[1][i], self.__m_arrMullionVertUserData[2][i],\
                    self.__m_arrMullionVertUserData[3][i], self.__m_arrMullionVertUserData[4][i])
                if type(mullionObjList) == ListType and mullionObjList[0]:
                    self.__m_arrMullionVertBreps.append(mullionObjList)
                    
        if not self.__m_arrMullionHorBreps : self.__m_arrMullionHorBreps = [0]
        if not self.__m_arrMullionVertBreps : self.__m_arrMullionVertBreps = [0]
        
        
    #------------------------------------------------------------------------------------------------------------------------------------
    #------------------------------------------------------------------------------------------------------------------------------------
    #    Mullion/Cap creation data based on their type 
        
    def DrawMullionType(self, strMullionType, dblWidth, dblThickness, dblCapWidth, dblCapThickness):
        
        if dblThickness == 0 or dblWidth == 0 : return None
        if not self.__m_blnShowWindow and "Window" in strMullionType : return #ignore window mullions if no window
        
        arrDeltaPoint = [] # 'Distance from 0,0,0 depending the mullion type (an X value for vertical mullions, Z value for Horizonal)
        fromLeft = 0; fromBottom = 0
        arrMullionPoints = [] 
        arrCapMullionPoints= [] #'The final points that result from adding arrDeltaPoint to arrMullionPoints
        arrXform = [] #'Transformation Matrix needed for the addition of arrDeltaPont
        arrMullions = [] # 'array storing the mullions
        dblYOffset = -self.__m_dblPaneOffset + self.__m_dblPaneThickness + .004 * self.__m_unitCoef ###Use this version to tie panel to mullion face.###
        #dblYOffset = self.__m_dblPaneThickness + 0.125 / 12 / 2.54 # Mullion Y location (2.54 converting feet to meters)
        bWindowFrame = False #sets on window frame mode (vs mullion mode)
        
        #get intersectin between 2 lines (2 groups of point pairs)
        def Intersect(pGroup, dir=1):
            cp1, cp2 , wp1, wp2 = pGroup
            vecA = rg.Vector3d(wp1-wp2); vecB= rg.Vector3d(cp2-cp1)
            angleC = rg.Vector3d.VectorAngle(vecA, vecB)
            sideC = wp2.DistanceTo(cp1)
            vecC = rg.Vector3d(wp2-cp1)
            angleB = rg.Vector3d.VectorAngle(vecB, vecC)
            sideB = math.sin(angleB)*sideC/math.sin(angleC)
            offsetVec = (vecA/vecA.Length*sideB)
            finalPt= wp2 + offsetVec*dir
            return finalPt
             
        c1, c2, c3, c4 = self.__GetCornerPoints()          
        if self.__m_blnShowWindow : 
            windowPoints = [self.__BaseToSurfaceWindowPoint(p) for p in self.__m_arrWindowPoints]# for by-surface panels
            w1, w2, w4, w3 = windowPoints
        #find 4 points for each mulloin type (if window presetn and different cap thickneses secified)
        if strMullionType == "PanelBottom" : 
            if self.__m_blnShowWindow : arrMullionPoints = [c1, Intersect([c1,c2,w1,w3]),Intersect([c1,c2,w2,w4]), c2]
            else: arrMullionPoints = [c1, c2]
        elif strMullionType == "PanelTop" : 
            if self.__m_blnShowWindow : arrMullionPoints = [c3, Intersect([c3,c4,w1,w3],-1),Intersect([c3,c4,w2,w4],-1), c4]
            else: arrMullionPoints = [c3, c4]
        elif strMullionType == "PanelLeft" : 
            if self.__m_blnShowWindow : arrMullionPoints = [c1, Intersect([c1,c3,w1,w2]),Intersect([c1,c3,w3,w4]), c3]
            else: arrMullionPoints = [c1, c3]
        elif strMullionType == "PanelRight" : 
            if self.__m_blnShowWindow : arrMullionPoints = [c2, Intersect([c2,c4,w1,w2],-1),Intersect([c2,c4,w3,w4],-1), c4]
            else: arrMullionPoints = [c2, c4]
        elif strMullionType == "WindowBottom" : arrMullionPoints = [Intersect([c1,c3,w1,w2]), w1, w2, Intersect([c2,c4,w1,w2],-1)]
        elif strMullionType == "WindowTop" : arrMullionPoints = [Intersect([c1,c3,w3,w4]), w3, w4, Intersect([c2,c4,w3,w4],-1)]                
        elif strMullionType == "WindowLeft" : arrMullionPoints = [Intersect([c1,c2,w1,w3]), w1, w3, Intersect([c3,c4,w1,w3],-1)]
        elif strMullionType == "WindowRight" : arrMullionPoints = [Intersect([c1,c2,w2,w4]),w2, w4, Intersect([c3,c4,w2,w4],-1)]      
        elif "Hor_" in strMullionType :
            strData = strMullionType[4:len(strMullionType)]
            codeObj= compile(strData,'<string>','single')
            eval(codeObj)
            line = rg.LineCurve(c1,c4)
            m1 = line.PointAtNormalizedLength(0.5); m2 = rg.Point3d(m1); m2.X += 0.01*self.__m_unitCoef
            m1.Z = m2.Z = fromBottom
            if self.__m_blnShowWindow :
                arrMullionPoints = [Intersect([c1,c3,m1,m2]), Intersect([w1,w3,m1,m2]), Intersect([w2,w4,m1,m2],-1), Intersect([c2,c4,m1,m2],-1)]
            else: arrMullionPoints = [Intersect([c1,c3,m1,m2]), Intersect([c2,c4,m1,m2],-1)] 
        elif "Vert_" in strMullionType :
            strData = strMullionType[5:len(strMullionType)]
            codeObj= compile(strData,'<string>','single')
            eval(codeObj)
            line = rg.LineCurve(c1,c4)
            m1 = line.PointAtNormalizedLength(0.5); m3 = rg.Point3d(m1); m3.Z += 0.01*self.__m_unitCoef
            m1.X = m3.X = fromLeft
            if self.__m_blnShowWindow :
                arrMullionPoints = [Intersect([c1,c2,m1,m3]), Intersect([w1,w2,m1,m3]), Intersect([w3,w4,m1,m3],-1), Intersect([c3,c4,m1,m3],-1)]
            else: arrMullionPoints = [Intersect([c1,c2,m1,m3]), Intersect([c3,c4,m1,m3],-1)]
        else:
            self.__m_warningData.append("Wrong mullion type" + strMullionType)
            return        
        
        if self.__m_blnShowWindow :
            #create intersenction segments from panel and window lines to find intermediate points    
            if (type(dblThickness) == ListType or type(dblCapThickness) == ListType):
                if (type(dblThickness) == ListType and len(dblThickness) > 1) or (type(dblCapThickness) == ListType and len(dblCapThickness) > 1):
                    #3-piece mullions if curtain-wall with opening
                    pass
                else: #if one list item will be used for Window frame only    
                    bWindowFrame = True
            #if full window panel? (no pane object) also use window frame settings
            if not self.__m_arrPaneBreps or self.__m_arrPaneBreps == [0] :
                if type(dblThickness) == ListType and len(dblThickness) > 1 : dblThickness = dblThickness[1]
                if type(dblCapThickness) == ListType and len(dblCapThickness) > 1 : dblCapThickness = dblCapThickness[1]
                bWindowFrame = True 
        
            if bWindowFrame == True :
                dblYOffset = -self.__m_dblWinGlassOffset + self.__m_dblWinGlassThickness + .004 * self.__m_unitCoef
                arrMullionPoints = [arrMullionPoints[1], arrMullionPoints[2]]
        
        arrDeltaPoint = [0, dblYOffset,0]# Store the appropiate distance from 0 based on the mullion type/location 
        
        arrXform = rs.XformTranslation(arrDeltaPoint) # create matrix from vector to add delta(distance) to base points in one line
        arrMullionPoints = rs.PointArrayTransform(arrMullionPoints, arrXform) # add delta(distance) to base mullions to get final 4 points locations
        
        #Create 1 or 3 mullions using the obtained points sending them in pairs (end points of each mullion)

        for i in range(len(arrMullionPoints)-1) :
            
            if rs.PointCompare(arrMullionPoints[i], arrMullionPoints[i + 1]) :
                continue #skip if points on same location
            #detect if thickness is one value or three(varying thinkness along mullion)
            if type(dblThickness) is ListType and len(dblThickness)> i: mullThickness = dblThickness[i]
            else : mullThickness = dblThickness
            
            if mullThickness > 0 and self.GetDrawMode() <> "LADYBUG" : 
                arrMullions.append(self.DrawMember(arrMullionPoints[i], arrMullionPoints[i + 1], dblWidth, mullThickness))
            
            if  dblCapWidth > 0.0 :
                #detect if thickness is one value or three(varying thinkness along mullion)
                if type(dblCapThickness) is ListType and len(dblCapThickness)> i: capThickness = dblCapThickness[i]
                else : capThickness = dblCapThickness
                if  capThickness > 0.0 : #Cap data?
                    if self.GetDrawMode() <> "LADYBUG" or (self.GetDrawMode() == "LADYBUG" and capThickness >= self.__m_LadybugShadeThresh) :
                        # create matrix with  translation to get cap Y location
                        arrXform = rs.XformTranslation([0, -capThickness - (self.__m_dblWinGlassThickness if bWindowFrame else self.__m_dblPaneThickness) - .008 * self.__m_unitCoef, 0])
                        arrCapMullionPoints = rs.PointArrayTransform(arrMullionPoints, arrXform) # new points location
                        arrMullions.append(self.DrawMember(arrCapMullionPoints[i], arrCapMullionPoints[i + 1], dblCapWidth, capThickness))
                        
        
        if arrMullions == [] : arrMullions = None       
        #return the array of mullions back to function call
        return arrMullions     
        
        
        
        
    #------------------------------------------------------------------------------------------------------------------------------------
    #------------------------------------------------------------------------------------------------------------------------------------
        
    def DrawMember(self, arrStartPoint, arrEndPoint, dblWidth, dblThickness, dblRotation=0, arrOffsetStart=None, arrOffsetEnd=None) :
        
        if rs.PointCompare(arrStartPoint, arrEndPoint) : return #return if same points start,end
        
        startPt = rg.Point3d(arrStartPoint[0], arrStartPoint[1], arrStartPoint[2])        
        endPt = rg.Point3d(arrEndPoint[0], arrEndPoint[1], arrEndPoint[2])
        mullionAxis = rg.Vector3d(endPt-startPt)
        vecCtr = (mullionAxis/mullionAxis.Length)*(dblWidth/2)
        vecCtr.Rotate(math.radians(-90), rg.Vector3d.YAxis)
        
        leftStartPt = rg.Point3d(startPt); leftStartPt.Y += dblThickness
        rightStartPt = startPt
        leftEndPt = rg.Point3d(endPt); leftEndPt.Y += dblThickness 
        rightEndPt = endPt
        
        #offset buggy once 3d panels was added.
        if arrOffsetStart:
            rightStartPt += rg.Vector3d(arrOffsetStart[0], arrOffsetStart[1], arrOffsetStart[2])
        if arrOffsetEnd:
            rightEndPt += rg.Vector3d(arrOffsetEnd[0], arrOffsetEnd[1], arrOffsetEnd[2])
            
        curve1 = rg.Curve.CreateInterpolatedCurve([rightStartPt, leftStartPt, leftEndPt, rightEndPt, rightStartPt],1)
        
        if dblRotation <> 0 : 
            ptCenter = rg.Point3d(startPt.X+dblWidth/4,startPt.Y+dblThickness/2,startPt.Z)  
            curve1.Rotate(math.radians(dblRotation), mullionAxis, ptCenter)
            curve1.Translate(curve1.PointAtStart-rightStartPt)
        curve1.Translate(vecCtr)
        extrusion = rg.Extrusion.Create(curve1, dblWidth, True)
        brepMember = extrusion.ToBrep()   
        
        

            
        return brepMember
        
    #----------------------------------------------------------------------------------------------------------------------
    #----------------------------------------------------------------------------------------------------------------------
    def DrawShading(self):

        
        self.__m_arrShadingBreps = []

        #Populate array with new shadine elements based on Data array
        if len(self.__m_arrShadingUserData[0]) :
            self.__m_arrShadingBreps = []
            for i in range(len(self.__m_arrShadingUserData[0])) :
                tmpShadingObjects = self.DrawShadingType(self.__m_arrShadingUserData[0][i], self.__m_arrShadingUserData[1][i], self.__m_arrShadingUserData[2][i],\
                    self.__m_arrShadingUserData[3][i], self.__m_arrShadingUserData[4][i], self.__m_arrShadingUserData[5][i], self.__m_arrShadingUserData[6][i],\
                    self.__m_arrShadingUserData[7][i], self.__m_arrShadingUserData[9][i])
                if tmpShadingObjects <> None : self.__m_arrShadingBreps.append(tmpShadingObjects)
        if not self.__m_arrShadingBreps or self.__m_arrShadingBreps[0] == None : self.__m_arrShadingBreps = [0]
        
        
    def DrawShadingType(self,  strShadingType, fromLeftBottomCorner, fromRightTop, width=.05*_UNIT_COEF, thickness=0.05*_UNIT_COEF, offset=0, spacing=.1*_UNIT_COEF, rotation=0, shiftEnds=[None,None]):
        
        if thickness <= 0 or width <= 0 : return
                
        #----Setting up parameters common to all shading types
        start = [0,0,0]; end = [0,0,0]
        start[1] = -offset-thickness; end[1] = -offset-thickness
        tmpFromLeftBottomCorner = copy.deepcopy(fromLeftBottomCorner)
        tmpFromRightTop = copy.deepcopy(fromRightTop)
        
        #----Setting up parameters based on shading type
        #Single Shade options:
        if strShadingType in ["HorizontalShade", "HorizontalWindowShade"]:  #---Single Horizontal Shade
            if strShadingType == "HorizontalWindowShade": 
                if self.__m_blnShowWindow : 
                    # - negative value defines distance from window head 
                    if tmpFromLeftBottomCorner[1] < 0 :  tmpFromLeftBottomCorner[1] = self.__GetPanelProperty("WindowHeight") + tmpFromLeftBottomCorner[1]
                    if tmpFromLeftBottomCorner[0] < 0 :  tmpFromLeftBottomCorner[0] = self.__GetPanelProperty("WindowWidth") + tmpFromLeftBottomCorner[0]
                    # add values to remap distances from window lower left corner
                    tmpFromLeftBottomCorner[0] += self.__GetPanelProperty("WindowLeft")
                    tmpFromLeftBottomCorner[1] += self.__GetPanelProperty("WindowBottom")
                    tmpFromRightTop  += self.__GetPanelProperty("WindowRight")
                else: return
            start[0] = tmpFromLeftBottomCorner[0]; start[2] = tmpFromLeftBottomCorner[1]
            end[0] = self.__GetPanelProperty("PanelWidth")-tmpFromRightTop
            end[2] = tmpFromLeftBottomCorner[1]
            if start[0] >= end[0] or start[0] < 0 or start[0] > self.GetWidth()*self.__m_dimRoundCoef or start[2] < 0 or start[2] > self.GetHeight()*self.__m_dimRoundCoef:
                self.__m_warningData.append("Invalid "+ strShadingType + " data"); return None #check for wrong data
            #remaping of points to adjust shade to conformed shape in Surface Panel Mode
            if "Window" in strShadingType : cStart, cEnd = [self.__BaseToSurfaceWindowPoint(p) for p in [start, end]]
            else: cStart, cEnd = [self.__BaseToSurfacePanelPoint(p) for p in [start, end]]
            
            return [self.DrawMember(cStart, cEnd, width, thickness, rotation, shiftEnds[0], shiftEnds[1])]
            
        elif strShadingType in ["VerticalShade", "VerticalWindowShade"]: #---Single Horizontal Shade
            if strShadingType == "VerticalWindowShade":
                if self.__m_blnShowWindow:
                   # - negative value defines distance from window head and right jamb
                    if tmpFromLeftBottomCorner[1] < 0 :  tmpFromLeftBottomCorner[1] = self.__GetPanelProperty("WindowHeight") + tmpFromLeftBottomCorner[1]
                    if tmpFromLeftBottomCorner[0] < 0 :  tmpFromLeftBottomCorner[0] = self.__GetPanelProperty("WindowWidth") + tmpFromLeftBottomCorner[0]
                    # add values to remap distances from window lwer left corner
                    tmpFromLeftBottomCorner[0] += self.__GetPanelProperty("WindowLeft")
                    tmpFromLeftBottomCorner[1] += self.__GetPanelProperty("WindowBottom")
                    tmpFromRightTop  += self.__GetPanelProperty("WindowTop")
                else: return               
            start[0] = tmpFromLeftBottomCorner[0]; start[2] = tmpFromLeftBottomCorner[1]
            end[0] = tmpFromLeftBottomCorner[0]
            end[2] = self.__GetPanelProperty("PanelHeight")-tmpFromRightTop
            if start[2] >= end[2] or start[0] < 0 or start[0] > self.GetWidth()*self.__m_dimRoundCoef or start[2] < 0 or start[2] > self.GetHeight()*self.__m_dimRoundCoef:
                self.__m_warningData.append("Invalid "+ strShadingType + " data"); return None #check for wrong data
            #remaping of points to adjust shade to conformed shape in Surface Panel Mode
            if "Window" in strShadingType : cStart, cEnd = [self.__BaseToSurfaceWindowPoint(p) for p in [start, end]]
            else: cStart, cEnd = [self.__BaseToSurfacePanelPoint(p) for p in [start, end]]
            return [self.DrawMember(cStart, cEnd, width, thickness, rotation, shiftEnds[0], shiftEnds[1])]
            
        #Louver type options:
        elif strShadingType in ["HorizontalLouver", "HorizontalWindowLouver"] : #---VerticalLouvers
            if strShadingType == "HorizontalWindowLouver":
                if self.__m_blnShowWindow : 
                    tmpFromLeftBottomCorner[0] += self.__GetPanelProperty("WindowLeft")
                    tmpFromLeftBottomCorner[1] += self.__GetPanelProperty("WindowBottom")
                    tmpFromRightTop[0]  += self.__GetPanelProperty("WindowRight")
                    tmpFromRightTop[1]  += self.__GetPanelProperty("WindowTop")
                else: return
            start[0] = tmpFromLeftBottomCorner[0]; start[2] = tmpFromLeftBottomCorner[1]        
            end[0] = self.__GetPanelProperty("PanelWidth")-tmpFromRightTop[0]
            valZ = start[2]
            endZ = self.__GetPanelProperty("PanelHeight")-tmpFromRightTop[1]
            if start[0] >= end[0] or start[2] < 0 or start[2] > self.GetHeight()*self.__m_dimRoundCoef: return None #check for wrong data
            arrLouvers = []
            #adjust start-end points of shade to offset rotation from center of sunshade to side closer to panel.
            offsetZ = 0; offsetY = 0
            while valZ <= endZ :
                start[2] = end[2] = valZ - offsetZ
                #remaping of points to adjust shade to conformed shape in Surface Panel Mode
                if "Window" in strShadingType : cStart, cEnd = [self.__BaseToSurfaceWindowPoint(p) for p in [start, end]]
                else: cStart, cEnd = [self.__BaseToSurfacePanelPoint(p) for p in [start, end]]
                arrLouvers.append(self.DrawMember(cStart, cEnd, width, thickness, rotation, shiftEnds[0], shiftEnds[1]))
                valZ += spacing
            return arrLouvers
            
        if strShadingType in ["VerticalLouver", "VerticalWindowLouver" ]: #---Horizontal Louvers
            if strShadingType == "VerticalWindowLouver":
                if self.__m_blnShowWindow:
                    tmpFromLeftBottomCorner[0] += self.__GetPanelProperty("WindowLeft")
                    tmpFromLeftBottomCorner[1] += self.__GetPanelProperty("WindowBottom")
                    tmpFromRightTop[0]  += self.__GetPanelProperty("WindowRight")
                    tmpFromRightTop[1]  += self.__GetPanelProperty("WindowTop")
                else: return               
            start[0] = tmpFromLeftBottomCorner[0]; start[2] = tmpFromLeftBottomCorner[1]        
            end[2] = self.__GetPanelProperty("PanelHeight")-tmpFromRightTop[1]
            valX = start[0]
            endX = self.__GetPanelProperty("PanelWidth")-tmpFromRightTop[0]
            if start[2] >= end[2] or start[0] < 0 or start[0] > self.GetWidth()*self.__m_dimRoundCoef: return None #check for wrong data
            arrLouvers = []
            #adjust start-end points of shade to offset rotation from center of sunshade to side closer to panel.
            offsetX = 0; offsetY = 0
            while valX <= endX :
                start[0] = end[0] = valX+offsetX
                #remaping of points to adjust shade to conformed shape in Surface Panel Mode
                if "Window" in strShadingType : cStart, cEnd = [self.__BaseToSurfaceWindowPoint(p) for p in [start, end]]
                else: cStart, cEnd = [self.__BaseToSurfacePanelPoint(p) for p in [start, end]]
                arrLouvers.append(self.DrawMember(cStart, cEnd, width, thickness, rotation, shiftEnds[0], shiftEnds[1]))
                valX += spacing
            return arrLouvers
            
        else: self.__m_warningData.append("Incorrect louver type: " + strShadingType) ; return
        
        
        
    #----------------------------------------------------------------------------------------------------------------------
    #----------------------------------------------------------------------------------------------------------------------
    def DrawCustomGeometry(self):


        if self.__m_CustomGeoBreps == None or self.__m_CustomGeoBreps == [] : return
        tolerance = sc.doc.ModelAbsoluteTolerance
        self.__m_CustomGeoDrawBreps = []
        
        #prepare panel solid for trimming to panel shape
        if self.__m_CG_trimToPanelSize:
            cPSCornerPts = self.__GetCornerPoints()
            cPSBBox = rg.BoundingBox(cPSCornerPts)
            cp1, cp2, cp4, cp3 = cPSCornerPts
            curvePanel = rg.Curve.CreateInterpolatedCurve([cp1, cp2, cp3, cp4, cp1],1)
            curvePanel.Translate(0, self.__m_CG_vecPlacement.Y, 0)
            extrusion = rg.Extrusion.Create(curvePanel, 2, True)
            tmpBoxBrep = extrusion.ToBrep()
            
        if self.__m_CG_windowDepth and self.__m_blnShowWindow:   
            wp1, wp2, wp3, wp4 = [self.__BaseToSurfaceWindowPoint(wp) for wp in self.__m_arrWindowPoints]
            curveWindow = rg.Curve.CreateInterpolatedCurve([wp1, wp2, wp3, wp4, wp1],1)
            
        for brep in self.__m_CustomGeoBreps:
            tmpCustomGeo = brep.DuplicateBrep()
            customGeoBBox = tmpCustomGeo.GetBoundingBox(True)
            customGeoMin = customGeoBBox.Min
            customGeoMax = customGeoBBox.Max
            customGeoSize = customGeoMax - customGeoMin
            
            # if Trim enabled, trim Custom Geometry to match panel size if extends beyond  
            if self.__m_CG_trimToPanelSize:
                if round(customGeoMin.X, 3) < 0 or round(customGeoMax.X, 3) > self.GetWidth() or \
                    round(customGeoMin.Y, 3) < 0 or round(customGeoMax.Y, 3) > self.GetHeight():
                    #create substraction object and subract
                    tmpBrepList = rg.Brep.CreateBooleanIntersection(tmpCustomGeo, tmpBoxBrep, tolerance)
                    if tmpBrepList == None : self.__m_warningData.append("Panel '"+self.GetName()+"': Panel sizing boolean Error - discarding custom geometry") ; return
                    for index in range(len(tmpBrepList)-1):
                        tmpBrepList[0].Append(tmpBrepList[index+1])
                    if tmpBrepList : tmpCustomGeo = tmpBrepList[0]
                    else: tmpCustomGeo = None
                
            # if window exists and Window Void enabled subtract window from custom geometry
            if self.__m_CG_windowDepth and tmpCustomGeo and self.__m_blnShowWindow:
                voidDepth = 0
                if self.__m_CG_windowDepth == "True" : 
                    voidDepth = -customGeoSize.Y * self.__m_CG_vecScaleFactor.Y + self.__m_CG_vecPlacement.Y
                else : 
                    voidDepth = -self.__m_CG_windowDepth+self.__m_CG_vecPlacement.Y
                extrusion = rg.Extrusion.Create(curveWindow, -voidDepth+self.__m_dblWinGlassOffset, True)
                tmpWinBoxBrep = extrusion.ToBrep()
                tmpWinBox = tmpWinBoxBrep.GetBoundingBox(True)
                #check if both window and custom geometry overlap before creating opening
                tmpGeoBBox = tmpCustomGeo.GetBoundingBox(True)
                if tmpGeoBBox.Min.X < tmpWinBox.Max.X and tmpGeoBBox.Min.Z < tmpWinBox.Max.Z: 
                    if tmpWinBox.Contains(tmpGeoBBox): continue
                    tmpBrepList = rg.Brep.CreateBooleanDifference(tmpCustomGeo, tmpWinBoxBrep, tolerance)
                    #unify pieces in one brep
                    if tmpBrepList <> None : 
                        for index in range(len(tmpBrepList)-1):
                            tmpBrepList[0].Append(tmpBrepList[index+1])
                        if tmpBrepList : tmpCustomGeo = tmpBrepList[0] 
                    else : 
                        self.__m_warningData.append("Panel '"+self.GetName()+"': Window Boolean error - discarding boolean")                    
                else :
                    self.__m_warningData.append("Panel '"+self.GetName()+"': Window Boolean error - discarding boolean")
                
                #Avoid boolean error when subraction boxes align with panel edges
                
            if tmpCustomGeo : self.__m_CustomGeoDrawBreps.append(tmpCustomGeo)
        
        #if in Ladybug draw mode check if custom geometry projection off facade is les than Ladybug shading threshhold 
        if self.GetDrawMode() == "LADYBUG" :
            bbox = rg.BoundingBox.Empty
            for  brep in self.__m_CustomGeoDrawBreps:
                bbox.Union(brep.GetBoundingBox(True))
                if bbox.Max.Y-bbox.Min.Y < self.__m_LadybugShadeThresh: 
                    self.__m_CustomGeoDrawBreps = []
                    return
    
    #----------------------------------------------------------------------------------------------------------------------
    #----------------------------------------------------------------------------------------------------------------------
    def DrawMorph(self):
        
        panelBrepList = self.GetBreps()
        self.BoxMorphObject(panelBrepList)
        
        #Store deform box as new panel bounding box
        self.__m_arrBoundingBox = self.__m_arrDeformBox
        
        
    #Work around Phyton not implementing yet morphing func(BoxMorphObject) used in DrawMorph()------------------------------------------------
    def BoxMorphObject(self, arrObjects):
        
        for obj in arrObjects : 
            obj.Transform(self.__m_TransformMatrix)
    
    
    def GetBreps(self, objectType=None):
        
        brepList = []
        
        if objectType == "Wall" or objectType == None :
            if  self.__m_blnShowWall and len(self.__m_arrWallBreps) and self.__m_arrWallBreps <> [0]: 
                if objectType == "Wall" : return self.__m_arrWallBreps
                brepList += self.__m_arrWallBreps

        if objectType == "Window" or objectType == None :                
            if  self.__m_blnShowWindow and self.__m_dblWinGlassThickness and self.__m_arrWindowBreps <> [0]:
                if objectType == "Window" : return self.__m_arrWindowBreps
                brepList += self.__m_arrWindowBreps

        if objectType == "Pane" or objectType == None :
            if  self.__m_blnShowPane and len(self.__m_arrPaneBreps) and self.__m_arrPaneBreps <> [0]:
                if objectType == "Pane" : return self.__m_arrPaneBreps
                brepList += self.__m_arrPaneBreps

        if objectType == "Mullions" or objectType == None :
            if  self.__m_blnShowMullions :
                brepObjects = []
                if len(self.__m_arrMullionHorBreps) and self.__m_arrMullionHorBreps[0]:
                    for i in range(self.__GetPanelProperty("MullionHorNum")):
                        arrMullions = self.__GetPanelPropertyArray("MullionHorObjArray", i)
                        if arrMullions and arrMullions[0] and not type(arrMullions[0]) == IntType:
                            brepObjects.extend(arrMullions)
                if len(self.__m_arrMullionVertBreps) and self.__m_arrMullionVertBreps[0]:
                    for i in range(self.__GetPanelProperty("MullionVertNum")):
                        arrMullions = self.__GetPanelPropertyArray("MullionVertObjArray", i)
                        if arrMullions and arrMullions[0] and not type(arrMullions[0]) == IntType:
                            brepObjects.extend(arrMullions)
                if objectType == "Mullions" : return brepObjects
                brepList += brepObjects
                
        if objectType == "Shading" or objectType == None :
            if  self.__m_blnShowShading and self.__m_arrShadingBreps and self.__m_arrShadingBreps <> [0]:
                brepObjects = []
                for arrShading in self.__m_arrShadingBreps : brepObjects += arrShading
                if objectType == "Shading" : return brepObjects
                brepList += brepObjects
                
        if objectType == "CustomGeometry" or objectType == None :
            if  self.__m_blnShowCustomGeo:
                if objectType == "CustomGeometry" : return self.__m_CustomGeoDrawBreps        
                brepList += self.__m_CustomGeoDrawBreps
            
        return brepList
        
        
        
    def DrawSceneObjects(self, objectType=None):
        
        parentLayerName = "SKIN_DESIGNER"
        if self.__m_SkinParentName <> None : parentLayerName = self.__m_SkinParentName.split("::")[0]
        if not rs.IsLayer(parentLayerName) : rs.AddLayer(parentLayerName)
        
        currentLayer = rs.CurrentLayer()
        
        
        if objectType == "Wall" or objectType == None:
            #Delete Old Wall If Exists
            if  type(self.__m_arrWallObjects) == ListType and not type(self.__m_arrWallObjects[0]) == IntType and rs.IsObject(self.__m_arrWallObjects[0]): 
                rs.DeleteObjects(self.__m_arrWallObjects)
            if  self.__m_blnShowWall and len(self.__m_arrWallBreps) and self.__m_arrWallBreps <> [0]: 
                if not rs.IsLayer(parentLayerName+"::_P_Wall") : rs.AddLayer(parentLayerName+"::_P_Wall")
                rs.CurrentLayer(parentLayerName+"::_P_Wall")
                self.__m_arrWallObjects = []
                for brep in self.__m_arrWallBreps :
                    if not brep.IsValid : continue
                    self.__m_arrWallObjects += [sc.doc.Objects.AddBrep(brep)]
            
        if objectType == "Pane" or objectType == None:
            if  type(self.__m_arrPaneObjects) == ListType and not type(self.__m_arrPaneObjects[0]) == IntType \
                and rs.IsObject(self.__m_arrPaneObjects[0]): rs.DeleteObjects(self.__m_arrPaneObjects)
            if  self.__m_blnShowPane and len(self.__m_arrPaneBreps) and self.__m_arrPaneBreps <> [0]:
                if not rs.IsLayer(parentLayerName+"::"+self.__m_strPaneName) : rs.AddLayer(parentLayerName+"::"+self.__m_strPaneName)
                rs.CurrentLayer(parentLayerName+"::"+self.__m_strPaneName)
                self.__m_arrPaneObjects = []
                for brep in self.__m_arrPaneBreps : 
                    if not brep.IsValid : continue
                    self.__m_arrPaneObjects += [sc.doc.Objects.AddBrep(brep)]
                
        if objectType == "Window" or objectType == None:
            if type(self.__m_arrWindowObjects) == ListType and not type(self.__m_arrWindowObjects[0]) == IntType \
                and rs.IsObject(self.__m_arrWindowObjects[0]) : rs.DeleteObjects(self.__m_arrWindowObjects)
            if  self.__m_blnShowWindow and self.__m_dblWinGlassThickness and self.__m_arrWindowBreps <> [0]:
                if not rs.IsLayer(parentLayerName+"::_P_Glass") : rs.AddLayer(parentLayerName+"::_P_Glass")
                rs.CurrentLayer(parentLayerName+"::_P_Glass")
                self.__m_arrWindowObjects = []
                for brep in self.__m_arrWindowBreps : 
                    if not brep.IsValid : continue
                    self.__m_arrWindowObjects += [sc.doc.Objects.AddBrep(brep)]
                
        if objectType == "Mullions" or objectType == None:
            #Horizontal mullions
            if type(self.__m_arrMullionHorObjects) == ListType and len(self.__m_arrMullionHorObjects) and not type(self.__m_arrMullionHorObjects[0]) == IntType \
                and rs.IsObject(self.__m_arrMullionHorObjects[0]) : rs.DeleteObjects(self.__m_arrMullionHorObjects)
            if len(self.__m_arrMullionHorBreps) and self.__m_arrMullionHorBreps[0]:
                self.__m_arrMullionHorObjects = []
                if not rs.IsLayer(parentLayerName+"::_P_Mullions") : rs.AddLayer(parentLayerName+"::_P_Mullions") 
                rs.CurrentLayer(parentLayerName+"::_P_Mullions")
                for i in range(self.__GetPanelProperty("MullionHorNum")):
                    arrMullions = self.__GetPanelPropertyArray("MullionHorObjArray", i)
                    if arrMullions and arrMullions[0] and not type(arrMullions[0]) == IntType:
                        for brep in arrMullions : 
                            if not brep.IsValid : continue
                            self.__m_arrMullionHorObjects += [sc.doc.Objects.AddBrep(brep)]

            #Delete Verticals mullions
            if type(self.__m_arrMullionVertObjects) == ListType and len(self.__m_arrMullionVertObjects) and not type(self.__m_arrMullionVertObjects[0]) == IntType \
                and rs.IsObject(self.__m_arrMullionVertObjects[0]) : rs.DeleteObjects(self.__m_arrMullionVertObjects)
            if len(self.__m_arrMullionVertBreps) and self.__m_arrMullionVertBreps[0]:
                self.__m_arrMullionVertObjects = []
                if not rs.IsLayer(parentLayerName+"::_P_Mullions") : rs.AddLayer(parentLayerName+"::_P_Mullions") 
                rs.CurrentLayer(parentLayerName+"::_P_Mullions")
                for i in range(self.__GetPanelProperty("MullionVertNum")):
                    arrMullions = self.__GetPanelPropertyArray("MullionVertObjArray", i)
                    if arrMullions and arrMullions[0] and not type(arrMullions[0]) == IntType:
                        for brep in arrMullions : 
                            if not brep.IsValid : continue
                            self.__m_arrMullionVertObjects += [sc.doc.Objects.AddBrep(brep)]
                
        if objectType == "Shading" or objectType == None:
            #Detlete Shading
            if type(self.__m_arrShadingObjects) == ListType and not type(self.__m_arrShadingObjects[0]) == IntType \
                and rs.IsObject(self.__m_arrShadingObjects[0]) : rs.DeleteObjects(self.__m_arrShadingObjects)
            if  self.__m_blnShowShading and self.__m_arrShadingBreps and self.__m_arrShadingBreps <> [0]:
                self.__m_arrShadingObjects = []; i=0
                for arrShading in self.__m_arrShadingBreps :
                    if not rs.IsLayer(parentLayerName+"::"+self.__m_arrShadingUserData[8][i]) : rs.AddLayer(parentLayerName+"::"+self.__m_arrShadingUserData[8][i]) 
                    rs.CurrentLayer(parentLayerName+"::"+self.__m_arrShadingUserData[8][i])
                    for brep in arrShading : 
                        if not brep.IsValid : continue
                        self.__m_arrShadingObjects += [sc.doc.Objects.AddBrep(brep)]
                    i += 1
                    
        if objectType == "CustomGeometry" or objectType == None:
            if type(self.__m_CustomGeoObjects) == ListType and len(self.__m_CustomGeoObjects) > 0 \
                and rs.IsObject(self.__m_CustomGeoObjects[0]) : rs.DeleteObjects(self.__m_CustomGeoObjects)
            self.__m_CustomGeoObjects = []
            if  self.__m_blnShowCustomGeo and self.__m_CustomGeoDrawBreps <> [] :
                for brep in self.__m_CustomGeoDrawBreps:
                    if not brep.IsValid : continue
                    CGLayerName = brep.GetUserString("Layer")
                    if CGLayerName == None or CGLayerName == "" : CGLayerName = "CustomGeo"
                    if not rs.IsLayer(parentLayerName+"::_P_"+CGLayerName) : rs.AddLayer(parentLayerName+"::_P_"+CGLayerName)
                    rs.CurrentLayer(parentLayerName+"::_P_"+CGLayerName)
                    self.__m_CustomGeoObjects.append(sc.doc.Objects.AddBrep(brep))
            
        rs.CurrentLayer(currentLayer)
        
#----------------------------------------------------------------------------------------------------------------------

SGLibPanel = Panel




class Skin:
    
    __m_skinGenName = "" # Name id (avoids overlapping block names between skin instances
    __m_GeneratePanelsOnly = False
    __m_surfaceAsPanels = False #If True, surfaces will not be subdivided and each surface will be used to define each panel area.
    
    __m_dblOffsetLevel = 0  #Offset in elevation from path to be considered bottom of panel. Any value > 0 creates custom panel. 
    __m_dblOffsetPath = 0 #Offset x distance of first panel at segments.Use list for different dimensions at each segment
    __m_blnSkinWrap = True #Wrap at corners or create custom corner panels
    
    
    __m_resetBayAtPoints = True #Start new bay at new segment
    
    __m_dblFloorToFloor = 4 * _UNIT_COEF #Floor height
    __m_dblMinPanelWidth = 0 #if surface cell width is below this number it will be ignored and panel won't be created.
    __m_dblMinPanelHeight = 0 #if surface cell height is below this number will be ignored and panel won't be created.
    __m_dblMinPanelArea = 0 #if surface cell area is below this number will be ignored and panel won't be created.
    __m_panelProfileTolerance = 0  #Maximum tolerance allowed to match current required panel properties with panel database.
    
    __m_flatMode = False  #Low geoemtry mode
    __m_drawMode = ""   #"LADYBUG", "DEFAULT" 
    __m_random = None #Global Random generator object
    
    __m_bayList = None # bays used in skin - 'None' will use all panel bays connected

    # Internal members
    __m_objSkinSurface = None #skin surface from skin generator
    __m_surfCurves = [] #top and bottom curves of validated surface
    __m_userData = [] #user parameters stored in skin surface
    __m_panelBays = [] #panel bay data from skin generator
    __m_DesignFunctions = [] 
    
    __m_arrBayMatrix = [] #surface matrix of bay points
    __m_arrBayCellSides = [] #surface matrix of bay sides count
    __m_arrBayPtData = {}
    __m_intRows = 0 #number of rows on surface
    __m_intColumns = 0 #number of columns on surface
    __m_intCurrCellColumn = 0
    __m_intCurrCellRow = 0
    __m_intCurrBayIndex = 0
    __m_intCurrBayPanelIndex = 0
    
    __m_arrCornerPoints = []
    
    __m_PanelData = {}
    __m_BayData = {}
    __m_warningData = []
    
    
    
    def __init__(self, skinName = "DEFAULT", objSkinSurface=None, panelPoints=None, panelBays=None, designFunctions=None):
        
        #Skin generator parameters
        self.__m_skinGenName = skinName 
        
        if objSkinSurface: 
            #create rc geometry if it's a document object and extract user surface parameters
            geo = None; objData = None        
            if str(type(objSkinSurface)) == "<type 'Guid'>" :
                if  not rs.IsObject(objSkinSurface) : return False #Abort skin creation if object is not valid
                objData = rs.ObjectName(objSkinSurface) #extract data if any
                self.__m_objSkinSurface = Rhino.DocObjects.ObjRef(objSkinSurface).Brep()
                
            elif type(objSkinSurface) ==  Rhino.Geometry.Brep :
                self.__m_objSkinSurface = objSkinSurface
                objData = objSkinSurface.GetUserString('Data')
                
            else: return False #Abort skin creation if object is not valid
            
            if  self.__m_objSkinSurface == None : return False #Abort skin creation if object is not valid
            
            #parse user surface-specific parameters (stored on brep user string or object name)
            if  objData : self.__m_userData = list(objData.rsplit("/"))  
            
            self.__m_surfCurves = self.ExtractEdges(self.__m_objSkinSurface)
            
        
        elif panelPoints: #if panel points are provided instead of a surface
         
            self.__m_arrBayMatrix, self.__m_arrBayCellSides, self.__m_arrBayPtData = panelPoints
            self.__m_intRows = len(self.__m_arrBayMatrix)
            self.__m_surfaceAsPanels = True
        else: return False # abort skin creation if no required data avialable
        
        self.__m_panelBays = panelBays
        self.__m_DesignFunctions = designFunctions
        self.__m_GeneratePanelsOnly = False
        
        
        self.__m_dblOffsetLevel = 0
        self.__m_dblOffsetPath = 0
        self.__m_blnSkinWrap = True
        
        self.__m_resetBayAtPoints = True
        
        self.__m_dblFloorToFloor = panelBays[0][0].GetPanelProperty("PanelHeight")
        self.__m_dblMinPanelWidth = .1 * _UNIT_COEF
        self.__m_dblMinPanelHeight = .1 * _UNIT_COEF
        self.__m_dblMinPanelArea = .01* _UNIT_COEF
        
        self.__m_flatMode = False
        self.__m_drawMode = "DEFAULT" 
        self.__m_objRandom = random.Random() 
        
        self.__m_bayList = None 
      
        #Internal members        
        if not self.__m_surfaceAsPanels : 
            self.__m_arrBayMatrix = []
            self.__m_intRows = 0  
        self.__m_intColumns = 0
        self.__m_intCurrCellColumn = 0
        self.__m_intCurrCellRow = 0
        self.__m_intCurrBayIndex = 0
        self.__m_intCurrBayPanelIndex = 0
        self.__m_arrCornerPoints = []
        self.__m_warningData = []
        
        self.__m_PanelData = {}
        self.__m_BayData = {'BayCounter':[], 'PanelIndices':[], 'BayIndices':[]}
        self.__m_BayData['BayCounter'] = self.__m_panelBays + [0 for x in self.__m_panelBays] #bay counters in format [list of bays, list of  counters]
        
        return True

    def __del__(self):
        #print "adios!"
        pass
        
        
    def ExtractEdges(self, surface):

            
        #get flat base curves and heights of single surfaces
        curveList = []; elevList = []
        for face in  surface.Faces:
            curve, elev = self.GetParametersFromFace(face)
            curveList.append(curve)
            elevList.append(elev)
            
        #unify bottom and top edges to one common top/bottom elevation
        sortedCurves = sorted(curveList, key=lambda curve: curve.PointAtStart.Z)
        sortedElevs = sorted(elevList) 
        bottomElev = sortedCurves[-1].PointAtStart.Z
        for curve in sortedCurves:
            deltaElev =  bottomElev - curve.PointAtStart.Z
            curve.Translate(Rhino.Geometry.Vector3d(0,0,deltaElev))
        bottomCurve = Rhino.Geometry.Curve.JoinCurves(sortedCurves, sc.doc.ModelAbsoluteTolerance, False)[0]
        #create offset of bottom curve for top curve
        topCurve = bottomCurve.DuplicateCurve()
        topCurve.Translate(Rhino.Geometry.Vector3d(0,0,sortedElevs[0]-bottomCurve.PointAtStart.Z))
        
        return [bottomCurve, topCurve]
        
        

    def GetParametersFromFace(self, face):
        
        #Create valid 2d versions of 3d curves
        def MakeValidEdge(edge, type):
            
            ptStart = edge.PointAtStart
            ptEnd = edge.PointAtEnd
            if ptStart.Z == ptEnd.Z: return edge
            else: 
                if  type == "Bottom" : curveElev = max(ptStart.Z,ptEnd.Z)
                elif type == "Top" : curveElev = min(ptStart.Z,ptEnd.Z)
                else: return None
                plane = Rhino.Geometry.Plane(Rhino.Geometry.Point3d(0,0, curveElev), Rhino.Geometry.Vector3d(0,0,1))
                return Rhino.Geometry.Curve.ProjectToPlane(edge, plane)
        
        #find top/bottom curves and make them 2D
        edges = face.DuplicateFace(False).DuplicateEdgeCurves()
        sortedEdges = sorted(edges, key=lambda edge: edge.PointAtNormalizedLength(0.5).Z)
        bottomEdge = MakeValidEdge(sortedEdges[0].DuplicateCurve(), "Bottom")
        topEdge = MakeValidEdge(sortedEdges[-1].DuplicateCurve(), "Top")
        topElev = topEdge.PointAtStart.Z
            
        return bottomEdge, topElev
        
        
        
    def LoadSurfaceProperties(self):
        
        #if self.__m_objSkinSurface == None : return
        
        # init from stored paramters
        OFFSET_LEVEL = self.__m_dblOffsetLevel
        OFFSET_PATH = self.__m_dblOffsetPath
        SKIN_WRAP = self.__m_blnSkinWrap
        PATTERN = self.__m_bayList
        
        #look for Surface-specific parameters stored on object name 
        #with format: OFFSET_LEVEL=float/OFFSET_PATH=float/SKIN_WRAP=bool/PATTERN = [int,..]
        for data in self.__m_userData : 
            if 'OFFSET_LEVEL' in data or 'OFFSET_PATH' in data or 'SKIN_WRAP' in data or 'PATTERN' in data :
                codeObj= compile(data,'<string>','single') ; eval(codeObj)
        
        # parameters update
        self.__m_dblOffsetLevel = OFFSET_LEVEL
        self.__m_dblOffsetPath = OFFSET_PATH
        self.__m_blnSkinWrap = SKIN_WRAP
        self.__m_bayList = PATTERN if type(PATTERN) == ListType else self.__m_bayList
              
        
        
    def SetProperty(self, strProperty, value):
    
        if strProperty in ["SKIN_NAME", "OFFSET_LEVEL", "OFFSET_PATH", "SKIN_WRAP", "RESET_BAY_AT_POINTS", \
            "FLAT_MODE", "DRAW_MODE", "BAY_LIST", \
            "MIN_PANEL_WIDTH", "MIN_PANEL_HEIGHT", "MIN_PANEL_AREA", "PANEL_PROFILE_TOLERANCE",\
            "RANDOM_OBJECT", \
            "FLOOR_HEIGHT", "GENERATE_PANELS_ONLY", "SURFACES_AS_PANELS", "WARNING_DATA"] :
            self.__SetProperty(strProperty, value)
        else:
            "Skin Parameter "+ strProperty + " is not valid"

        
    def __SetProperty(self, strProperty, value):
    
        if strProperty == "SKIN_NAME" : self.__m_skinGenName = value
        elif strProperty == "OFFSET_LEVEL" : self.__m_dblOffsetLevel = value
        elif strProperty == "OFFSET_PATH" : self.__m_dblOffsetPath = value
        elif strProperty == "SKIN_WRAP" : self.__m_blnSkinWrap = value
        elif strProperty == "RESET_BAY_AT_POINTS" : self.__m_resetBayAtPoints = value
        elif strProperty == "FLAT_MODE" : self.__m_flatMode = value
        elif strProperty == "DRAW_MODE" : self.__m_drawMode = value
        elif strProperty == "BAY_LIST" : self.__m_bayList = value
        elif strProperty == "MIN_PANEL_WIDTH" : self.__m_dblMinPanelWidth = value
        elif strProperty == "MIN_PANEL_HEIGHT" : self.__m_dblMinPanelHeight = value
        elif strProperty == "MIN_PANEL_AREA" : self.__m_dblMinPanelArea = value
        elif strProperty == "PANEL_PROFILE_TOLERANCE" : self.__m_panelProfileTolerance = value; 
        elif strProperty == "RANDOM_OBJECT" : self.__m_objRandom = value
        elif strProperty == "FLOOR_HEIGHT" : 
            if value > 0 : self.__m_dblFloorToFloor = value
        elif strProperty == "GENERATE_PANELS_ONLY" : self.__m_GeneratePanelsOnly = value   
        elif strProperty == "SURFACES_AS_PANELS" : self.__m_surfaceAsPanels = value   
        elif strProperty == "SKIN_SURFACE" : self.__m_objSkinSurface = value
        elif strProperty == "PANEL_BAY_LIST" : self.__m_panelBays = value
        elif strProperty == "DESIGN_FUNCTIONS" : self.__m_DesignFunctions = value
        elif strProperty == "PANEL_DATA" : self.__m_PanelData = value
        elif strProperty == "BAY_DATA" : self.__m_BayData = value
        elif strProperty == "WARNING_DATA" : self.__m_warningData.append(value)
        
        
    def GetProperty(self, strProperty):
        
        #if strProperty == "SKIN_SURFACE" : return self.__m_objSkinSurface
        if strProperty == "SKIN_NAME" : return self.__m_skinGenName
        elif strProperty == "SKIN_SURFACE_TYPE" : return str(type(self.__m_objSkinSurface))
        elif strProperty == "SURFACES_AS_PANELS" : return self.__m_surfaceAsPanels   
        elif strProperty == "SKIN_CELL_ROWS" : return self.__m_intRows
        elif strProperty == "SKIN_CELL_COLUMNS" : return self.__m_intColumns
        elif strProperty == "SKIN_CURRENT_CELL_COLUMN" : return self.__m_intCurrCellColumn
        elif strProperty == "SKIN_CURRENT_CELL_ROW" : return self.__m_intCurrCellRow       
        elif strProperty == "SKIN_CURRENT_BAY_INDEX" : return self.__m_intCurrBayIndex      
        elif strProperty == "SKIN_CURRENT_BAY_PANEL_INDEX" : return self.__m_intCurrBayPanelIndex   
        elif strProperty == "BAY_LIST" : return copy.deepcopy(self.__m_bayList)
        elif strProperty == "FLOOR_HEIGHT" : return self.__m_dblFloorToFloor
        elif strProperty == "WARNING_DATA": return self.__m_warningData
            
    #--------------------------------------------------------------------------------
    #Retrieves a range of Bay and Panel Properties given cell data. 
    #Needs panel number within bay for specific panel data.
    #--------------------------------------------------------------------------------    
    def GetCellProperty(self, intRow, intColumn,  strProperty, bayPanelIndex=0):
        
        
        #TYPE 1 - Cell properties
        
        try:
            bayCornerPts = self.__m_arrBayMatrix[intRow][intColumn]
            if 'FITTED' in strProperty : 
                fittedRectangle = self.GetCellFittedRectange(bayCornerPts)
        except:
            raise
            self.__m_warningData.append("GetCellPreoperty: Invalid row/column cell data") 
            return None
        
        #Properties
        if strProperty == "CELL_CORNER_POINTS": return copy.deepcopy(bayCornerPts)
        if strProperty == "CELL_CORNER_POINTS_IN_PANEL_SPACE": 
            cellPts = copy.deepcopy(bayCornerPts); 
            return self.GetPointsInPanelSpace(cellPts, cellPts)
        if strProperty == "CELL_PLANE" or strProperty == "PANEL_PLANE": 
            return Rhino.Geometry.Plane(bayCornerPts[0], bayCornerPts[1], bayCornerPts[2])
        if strProperty == "CELL_NORMAL_VECTOR" or strProperty == "PANEL_NORMAL_VECTOR": 
            return  Rhino.Geometry.Plane(bayCornerPts[0], bayCornerPts[1], bayCornerPts[2]).Normal
            
        if strProperty in ["CELL_SIDES", "CELL_SHARED_SIDE1_CELLS", "CELL_SHARED_SIDE2_CELLS", "CELL_SHARED_SIDE3_CELLS",\
            "CELL_SHARED_SIDE4_CELLS", "CELL_SHARED_ALLSIDES_CELLS", "CELL_POINT1_NORMAL", "CELL_POINT2_NORMAL", \
            "CELL_POINT3_NORMAL", "CELL_POINT4_NORMAL", "CELL_SHARED_POINT1_CELLS", "CELL_SHARED_POINT2_CELLS", \
            "CELL_SHARED_POINT3_CELLS", "CELL_SHARED_POINT4_CELLS"]:
            if self.GetProperty("SURFACES_AS_PANELS") == False:
                print ">>>>"+ strProperty +": Call is invalid when SURFACE_AS_PANELS is set to False"
                return None            
        if strProperty == "CELL_SIDES": 
            return  self.__m_arrBayCellSides[intRow][intColumn]
        if strProperty == "CELL_SHARED_SIDE1_CELLS":
            return self.GetCellsWithPts([bayCornerPts[0], bayCornerPts[1]]) 
        if strProperty == "CELL_SHARED_SIDE2_CELLS":
            return self.GetCellsWithPts([bayCornerPts[1], bayCornerPts[3]]) 
        if strProperty == "CELL_SHARED_SIDE3_CELLS":
            return self.GetCellsWithPts([bayCornerPts[3], bayCornerPts[2]]) 
        if strProperty == "CELL_SHARED_SIDE4_CELLS":
            return self.GetCellsWithPts([bayCornerPts[2], bayCornerPts[0]]) 
        if strProperty == "CELL_SHARED_ALLSIDES_CELLS":
            return self.GetCellsWithPts([bayCornerPts[0], bayCornerPts[1], bayCornerPts[3], bayCornerPts[2]]) 
            
        if strProperty == "CELL_SHARED_POINT1_CELLS":
            return self.GetCellsWithPts([bayCornerPts[0]]) 
        if strProperty == "CELL_SHARED_POINT2_CELLS":
            return self.GetCellsWithPts([bayCornerPts[1]]) 
        if strProperty == "CELL_SHARED_POINT3_CELLS":
            if self.__m_arrBayCellSides[intRow][intColumn] == 3: 
                return self.GetCellPointNormal(bayCornerPts[3])
            return self.GetCellsWithPts([bayCornerPts[2]]) 
        if strProperty == "CELL_SHARED_POINT4_CELLS":
            if self.__m_arrBayCellSides[intRow][intColumn] == 3:
                return None             
            return self.GetCellsWithPts([bayCornerPts[3]])   
            
        if strProperty == "CELL_POINT1_NORMAL":
            return self.GetCellPointNormal(bayCornerPts[0]) 
        if strProperty == "CELL_POINT2_NORMAL":
            return self.GetCellPointNormal(bayCornerPts[1]) 
        if strProperty == "CELL_POINT3_NORMAL":
            if self.__m_arrBayCellSides[intRow][intColumn] == 3: 
                return self.GetCellPointNormal(bayCornerPts[3])
            return self.GetCellPointNormal(bayCornerPts[2]) 
        if strProperty == "CELL_POINT4_NORMAL":
            if self.__m_arrBayCellSides[intRow][intColumn] == 3:
                return None 
                
            return self.GetCellPointNormal(bayCornerPts[3])
        if strProperty == "CELL_FITTED_RECTANGLE":
            return fittedRectangle
        if strProperty == "CELL_FITTED_REC_OFFSETS":
            return self.GetCellFittedRecOffsets(fittedRectangle, bayCornerPts)            
        if strProperty == "CELL_FITTED_REC_HEIGHT":
            return fittedRectangle.Height
        if strProperty == "CELL_FITTED_REC_WIDTH":
            return fittedRectangle.Width            
             

        #TYPE 2 - Cell Bay assigment properties
        #Bay ID assignement
        cellBayIDsAssigned = list((id for id, points in self.__m_BayData['BayIndices']))
        cellBayPtsAssigned = list((points for id, points in self.__m_BayData['BayIndices']))
        bayIndexAssigned = cellBayIDsAssigned[cellBayPtsAssigned.index(bayCornerPts)]
        #Panel specific vertex data
        bayPanelMatrix = self.GetPanelMatrix(self.__m_arrBayMatrix, intRow, intColumn, self.__m_panelBays[bayIndexAssigned]) #array of panels corner points in bay
        
        
        #Properties
        if strProperty == "BAY_INDEX" : return bayIndexAssigned
        if strProperty == "BAY_POINTS_PANELS" : return bayPanelMatrix 
        if strProperty == "BAY_BASE_PANELS" : return self.__m_panelBays[bayIndexAssigned]
        if strProperty == "BAY_NUM_PANELS" : return len(bayPanelMatrix[0])-1
        
        #Type 3 - Panel instance properties
        
        try: panelCornerPts = self.GetPanelCorners(bayPanelMatrix, bayPanelIndex)
        except: panelCornerPts = None
        #current cell data assigned
        try: cellPtsAssigned = list((pts for pts, n in self.__m_BayData['PanelIndices'] ))
        except: cellPtsAssigned = None
        try: cellNamesAssigned = list((n for pts, n in self.__m_BayData['PanelIndices'] ))
        except: cellNamesAssigned = None
        
        #current panel instance data
        try:
            skinPanelList = []
            for panelGroup in self.__m_PanelData.values():
                for panel in panelGroup: skinPanelList += [panel]                            
            panelsCreated = list((panel for panel, changeFlag in skinPanelList))
            panelNamesCreated = list((panel.GetName() for panel in panelsCreated))
            panelChgFlagCreated = list((changeFlag for panel, changeFlag in skinPanelList))
        except: panelNamesCreated = panelChgFlagCreated = None        
        
        #Properties
        if strProperty == "PANEL_CORNER_POINTS":
            if panelCornerPts: return copy.deepcopy(panelCornerPts)
            else: self.__m_warningData.append("GetCellProperty: invalid panel index in bay"); return None
        
        if strProperty == "PANEL_NAME":
            try:
                panelIndex = cellPtsAssigned.index(panelCornerPts)
                return cellNamesAssigned[panelIndex]
            except: 
                self.__m_warningData.append("GetCellProperty: cell name data not found")
                return None
                
        if strProperty == "PANEL_CELL_ID":
            try : return cellPtsAssigned.index(panelCornerPts)
            except:
                self.__m_warningData.append("GetCellProperty: cell id data not found")
                return None
                
        if strProperty == "PANEL_INSTANCE":
            try :
                cellIndex = cellPtsAssigned.index(panelCornerPts)
                name = cellNamesAssigned[cellIndex]
                panelIndex = panelNamesCreated.index(name)
                return panelsCreated[panelIndex]
            except: 
                self.__m_warningData.append("GetCellProperty: panel instance data not found")
                return None
                
        if strProperty == "PANEL_CHANGE_FLAG":
            if  cellNamesAssigned and cellPtsAssigned and panelChgFlagCreated:
                try: cellIndex = cellPtsAssigned.index(panelCornerPts)
                except: self.__m_warningData.append("GetCellProperty: panel change flag data not found"); return None
                name = cellNamesAssigned[cellIndex]
                panelIndex = panelNamesCreated.index(name)
                return panelChgFlagCreated[panelIndex]
            else: 
                self.__m_warningData.append("GetCellProperty: panel change flag data not found")
                return None
                
        self.__m_warningData.append("GetCellProperty: Invalid property: "+ strProperty)
        
    #--------------------------------------------------------------------------------
    #
    #--------------------------------------------------------------------------------         
    def GetPointsInPanelSpace(self, points, panelPts):
        rc = Rhino
        
        if len(panelPts) <> 4 :return None
        p1, p2, p3, p4 = panelPts
        
        panelPlane = rc.Geometry.Plane(p1, p2, p3) 
        co = rc.Geometry.Point3d(0,0,0); cx = rc.Geometry.Point3d(1,0,0); cy = rc.Geometry.Point3d(0,0,1)
        originPlane = rc.Geometry.Plane(co, cx, cy)
        xRot = rc.Geometry.Transform.PlaneToPlane(panelPlane, originPlane)
        xPoints = copy.deepcopy(points)
        res = [pt.Transform(xRot) for pt in xPoints]
        return xPoints 
        
        #curve = rc.Geometry.Curve.CreateInterpolatedCurve(points,1)
        #curve.Transform(xRot)
        #crv = curve.TryGetPolyline()[1]
        #xPoints = [rc.Geometry.Point3d(x,y,z) for x,y,z in zip(crv.X, crv.Y, crv.Z)]
        
        
        
    #--------------------------------------------------------------------------------
    #
    #--------------------------------------------------------------------------------        
    def GetCellsWithPts(self, pointList):
        
        flatPts = copy.deepcopy(self.__m_arrBayPtData['flatPts'])
        flatPtLocs = copy.deepcopy(self.__m_arrBayPtData['flatPtLoc'])
        matchingPtsLocs = []; matchingKeys = []
        for ptNum, pt in enumerate(pointList):
            matchingPtsLocs.append([])
            while True:
                try: 
                    matchIndex = flatPts.index(pt)
                    locPair = [flatPtLocs[matchIndex][0], flatPtLocs[matchIndex][1]]
                    matchingPtsLocs[ptNum].append(locPair)
                    if locPair not in matchingKeys : matchingKeys.append(locPair)
                    flatPts[matchIndex] = None
                except:
                    break
                    
        byPoint = [[ptIndex if matchingPtList.count(match) else None for ptIndex,matchingPtList in enumerate(matchingPtsLocs)]  for match in matchingKeys]
        dictMatches = [{"cellLoc": entry[0], "matchingPtIndex":entry[1]} for entry in zip(matchingKeys, byPoint)]
                
        return dictMatches
    #--------------------------------------------------------------------------------
    #
    #--------------------------------------------------------------------------------
    
    def GetCellPointNormal(self, cellPt):
        
        try:
            index = self.__m_arrBayPtData['ptKeys'].index(cellPt)
            return copy.deepcopy(self.__m_arrBayPtData['normalKeys'][index])
        except:
            return None
            
    
    
    #--------------------------------------------------------------------------------
    #
    #--------------------------------------------------------------------------------    
    def GetCellFittedRectange(self, cellPts):
        
        
        rc = Rhino
        def RectangelMethod(cellPts):
            #Get cell Bounding Box
            p1,p2,p3,p4 = copy.deepcopy(cellPts)
            plane = rc.Geometry.Plane(p1,p2,p3)
            bbox = rc.Geometry.Box(plane, cellPts)
            bbox.Z = rc.Geometry.Interval(0,0.001 * _UNIT_COEF)
            boxPts = bbox.GetCorners()[0:4]
            
            #remap to Panel Coordinates
            ptsPlane = []
            xForm = rc.Geometry.Transform.PlaneToPlane(plane, rc.Geometry.Plane.WorldXY)
            for pt in list(boxPts)+ [p1,p2,p4,p3]:
                pt.Transform(xForm)
                ptsPlane.append(copy.deepcopy(pt))
            ptsSrf = ptsPlane[4:8]
            ptsBox = ptsPlane[0:4]
            
            #define Box points X locations
            ptsBox.sort(cmp=lambda x,y: cmp(x.X, y.X))
            ptsBoxLeft =ptsBox[0:2]; ptsBoxRight = ptsBox[2:4]
            ptsSrf.sort(cmp=lambda x,y: cmp(x.X, y.X))
            ptsSrfLeft = ptsSrf[0:2]; ptsSrfRight = ptsSrf[2:4]
            for pt in ptsBoxLeft: pt.X = ptsSrfLeft[1].X
            for pt in ptsBoxRight: pt.X = ptsSrfRight[0].X
            
            #define Box points Y locations
            ptsBox.sort(cmp=lambda x,y: cmp(x.Y, y.Y))
            ptsBoxBottom =ptsBox[0:2]; ptsBoxTop = ptsBox[2:4]
            ptsSrf.sort(cmp=lambda x,y: cmp(x.Y, y.Y))
            ptsSrfBottom = ptsSrf[0:2]; ptsSrfTop = ptsSrf[2:4]
            for pt in ptsBoxBottom: pt.Y = ptsSrfBottom[1].Y
            for pt in ptsBoxTop: pt.Y = ptsSrfTop[0].Y
            
            #create Rectangle
            bbox = rc.Geometry.Box(rc.Geometry.Plane.WorldXY, ptsBox)
            p1,p2,p3,p4 = bbox.GetCorners()[0:4]
            rectangle = rc.Geometry.Rectangle3d(rc.Geometry.Plane.WorldXY, p1, p3)

            #Align rect to World Coordinates     
            xForm = rc.Geometry.Transform.PlaneToPlane(rc.Geometry.Plane.WorldXY, plane)
            
            rectangle.Transform(xForm)
            return rectangle
        
        #For almost traingular shapes(not that useful)
        def findNewPts(pts):
            
            ptDists =[]; ptIndex = []
            for i, pt1 in enumerate(pts):
                for pt2 in pts:
                    if pt1 == pt2: continue
                    d = pt1.DistanceTo(pt2)
                    ptDists.append(d)
                    ptIndex.append(i)
            
            A =  ptIndex[ptDists.index(min(ptDists))]
            ptDists[ptDists.index(min(ptDists))] = max(ptDists)
            B = ptIndex[ptDists.index(min(ptDists))]
        
            if A == 0 and B == 3 :
                A2 = 1; B2 =2
            else:
                A2 = (A-1 if A >0  else 3)
                B2 = (B+1 if B < 3 else 0)
            ptA = pts[A]; ptA2 = pts[A2]
            ptB = pts[B]; ptB2 = pts[B2]
            ptA.Interpolate(ptA, ptA2,0.5)
            ptB.Interpolate(ptB, ptB2,0.5)
            return pts
            
        r1 = RectangelMethod(cellPts)
    
        #r2 = RectangelMethod(findNewPts(copy.deepcopy(cellPts)))
        #return (r1 if r1.Area > r2.Area else r2)
        return r1            
    #--------------------------------------------------------------------------------
    #
    #--------------------------------------------------------------------------------        
    def GetCellFittedRecOffsets(self, fittedRec, cornerPts):
        
        recPoints = [fittedRec.Corner(0), fittedRec.Corner(1), fittedRec.Corner(3), fittedRec.Corner(2)] 
        cornerPts = copy.deepcopy(cornerPts)
        #remap to Panel Coordinates
        plane = rg.Plane(recPoints[0], recPoints[1], recPoints[2])
        xForm = rg.Transform.PlaneToPlane(plane, rg.Plane.WorldZX)
        
        results = [pt.Transform(xForm) for pt in recPoints]
        results = [pt.Transform(xForm) for pt in cornerPts]
          
        recPoints = [rg.Point3d(pt.Z, pt.Y, pt.X) for pt in recPoints]
        cornerPts = [rg.Point3d(pt.Z, pt.Y, pt.X) for pt in cornerPts]        
        
        #return offsets
        return [ptPanel-ptRec for ptRec, ptPanel in zip(recPoints, cornerPts)]
        
        
    #--------------------------------------------------------------------------------
    #Generate matrix of corner points of a surface based on panel bay dimensions
    #--------------------------------------------------------------------------------
    def GeneratePanelMatrix(self, dblBayWidth, dblFloorToFloor):
        
        
        #use surface floor to floor value if provided
        if self.__m_dblFloorToFloor > 0 : dblFloorToFloor = self.__m_dblFloorToFloor
        
        
        self.__m_arrBayMatrix = [] #Stores array of bay corner points
        
        CurveBottom = Rhino.RhinoDoc.ActiveDoc.Objects.AddCurve(self.__m_surfCurves[0])
        CurveTop = Rhino.RhinoDoc.ActiveDoc.Objects.AddCurve(self.__m_surfCurves[1])

        #Create points based on panelwidth on top/bottom two curves
        
        arrPointsBottom = self.DividePoints(CurveBottom, dblBayWidth, self.__m_dblOffsetPath, self.__m_blnSkinWrap)
        arrPointsTop = self.DividePoints(CurveTop, dblBayWidth, self.__m_dblOffsetPath, self.__m_blnSkinWrap)
        rs.DeleteObjects([CurveBottom,CurveTop])
        
        #Create plane to define panel grid Vertical points
        arrPlane = rs.WorldXYPlane()
        dblFloorTop = arrPointsTop[0][2]
        
        if self.__m_dblOffsetLevel: dblFloorLevel = arrPointsBottom[0][2] + self.__m_dblOffsetLevel
        else: dblFloorLevel = arrPointsBottom[0][2] + dblFloorToFloor
        
        #Initialize array to store grid points
        self.__m_arrBayMatrix.append(arrPointsBottom)
        intLevel = 0
        
        #Create array of grid points
        while dblFloorLevel < dblFloorTop :
    
            arrPlane = rs.WorldXYPlane()
            levelMove = rs.XformTranslation([0, 0, dblFloorLevel])
            arrPlane = rs.PlaneTransform(arrPlane, levelMove)
            pointIndex = 0
            arrInterPoints = [] #Intersection points in current level
            
            for arrPoint in arrPointsTop:
                
                #if intLevel == 0 : rs.AddLine(arrPointsBottom[pointIndex], arrPointsTop[pointIndex]) #--to visualize vertical lines
                arrLine = [arrPointsBottom[pointIndex], arrPointsTop[pointIndex]]  #Create Line from Top / bottom curves
                arrIntPoint = rs.LinePlaneIntersection(arrLine, arrPlane)#Intersect with level plane to obtain vertial points
                
                arrInterPoints.append(arrIntPoint)
                pointIndex = pointIndex + 1
    
            intLevel = intLevel + 1
            self.__m_arrBayMatrix.append(arrInterPoints)
            
            #rs.AddPolyline(self.__m_arrBayMatrix[intLevel]) #--to visualize horizontal lines
            dblFloorLevel = dblFloorLevel + dblFloorToFloor
            
        self.__m_arrBayMatrix.append(arrPointsTop)
        intRows = intLevel+1
        intColumns = len(self.__m_arrBayMatrix[0])-1
        
        #new cell points data format
        parsedArrBayMatrix = []
        for intRow in range(intRows):
            parsedArrBayMatrix.append([])
            for intColumn in range(intColumns):
                bayCornerPts = [self.__m_arrBayMatrix[intRow][intColumn], self.__m_arrBayMatrix[intRow][intColumn + 1],\
                self.__m_arrBayMatrix[intRow + 1][intColumn], self.__m_arrBayMatrix[intRow + 1][intColumn + 1]]
                
                parsedArrBayMatrix[intRow].append(bayCornerPts)
        
        self.__m_arrBayMatrix = parsedArrBayMatrix
        self.__m_intColumns = len(self.__m_arrBayMatrix[0])
        self.__m_intRows = intRows
        
        
    #--------------------------------------------------------------------------------
    #Select and divide curve in specific segments
    #--------------------------------------------------------------------------------
    def DividePoints(self, strObject, dblLength, dblOffset, skinWrap) :
        
        if not rs.IsCurve(strObject) : self.__m_warningData.append("DividePoints: Invalid Curve") ; return
        
        newPoints = [] ; segmentList = []
        
        if  not skinWrap and rs.CurvePointCount(strObject) > 2 : segmentList = rs.ExplodeCurves(strObject)#create individual segements to avoid wrapping
        else : segmentList.append(rs.CopyObject(strObject)) #treat as a single segment

        #store corner points to use on panel placement data
        self.__m_arrCornerPoints = []
        for segment in segmentList:
            self.__m_arrCornerPoints.append(rs.CurveStartPoint(segment))
        self.__m_arrCornerPoints.append(rs.CurveEndPoint(segment))

        #process each segment individually
        for i in range(len(segmentList)):
    
            #----If offset used create new curve to divide at offset start point
            offset = 0
            if type(dblOffset)== ListType :
                if len(dblOffset) > i : offset = dblOffset[i]
                else: offset = dblOffset[len(dblOffset)-1]
            else : offset = dblOffset
            
            if offset and offset <> round(rs.CurveLength(segmentList[i]),4):
                
                domain = rs.CurveDomain(segmentList[i])
                newPoints.append(rs.CurveStartPoint(segmentList[i]))
                coefOffset = (dblLength/(dblLength/offset))/rs.CurveLength(segmentList[i])
                domain[0] = rs.CurveParameter(segmentList[i], coefOffset)
                tmpSegment = segmentList[i]
                segmentList[i] = rs.TrimCurve(tmpSegment,domain, True)
                
            newPoints.extend(rs.DivideCurveEquidistant(segmentList[i], dblLength))
            
            #Adjusting last Panel to absorb leftover dimension(not working)
            #remainderDist = rs.Distance(newPoints[len(newPoints)-1], rs.CurveEndPoint(segmentList[i]))
            #if  remainderDist > MIN_PANEL_WIDTH  : newPoints[len(newPoints)-1] = rs.CurveEndPoint(segmentList[i])
            
        #remainderDist = rs.Distance(newPoints[len(newPoints)-1], rs.CurveEndPoint(strObject))
        #if  remainderDist > MIN_PANEL_WIDTH  : newPoints.append(rs.CurveEndPoint(strObject))
        newPoints.append(rs.CurveEndPoint(strObject))
        
        
        # remove duplicate points
        index=1
        while index < len(newPoints):
            if rs.PointCompare(newPoints[index], newPoints[index-1], 0.01) : del newPoints[index]
            else: index += 1 
            
        
        #--Wrap up----------------------------------------
    
        rs.DeleteObjects(segmentList)
    
        return newPoints
    
    
    
    
    def GeneratePanelBlocks(self, PanelTypes, BayData):
        
        #INIT SECTION-------------------------------------------------------------------------
        print "> Skin "+ self.GetProperty("SKIN_NAME")
        #load created panel/bay data already created on previous surfaces
        self.__SetProperty("PANEL_DATA", PanelTypes)
        self.__SetProperty("BAY_DATA", BayData)
        
        #Design functions class variables issue - fixed by replacing them with local variables
        myPanelBays = self.__m_panelBays 
        randomObj = self.__m_objRandom 
        bayList = self.__m_bayList #bay indices used in skin [1 based]
        
        #intial loop settings
        currBayPanel = None ; bayPanelIndex = -1  #Holds current panel in bay; Holds index of current panel in use 
        currentBay = self.__m_panelBays[0] ; self.__m_intCurrBayIndex = -1 # Stores current bay; Stores index of current bay 
        PanelDef = None #Stores current panel of the bay used
        BlockName = "" #Holds block name based on panel data  
         
        intLevels = self.__m_intRows
        self.__m_intCurrCellRow = 0 ; self.__m_intCurrCellColumn = -1          #init level and index counters 
        intBaysPerLevel = len(self.__m_arrBayMatrix[0])
        bayCornerPoints = []
        #Change flags store specific panel modifications to ID'd when stored and loaded from database
        #ChangeFlag = [0, 0, dict(), ""]     #[panel height , panel width , Property_Dictionary, skin_placement (string)]
        
        blnFloorPanelHeight = False #change panel height to match floor to floor height
        
        #-----------------------Iteration through skin Bay grid---------------------------------------------------------
        #-----------------------BAY & PANEL selection, design and generation--------------------------------------------
        
        while True :
            
            bayPanelIndex += 1 # next panel of current bay
            
            if bayPanelIndex == len(currentBay) or bayPanelIndex == 0: #when done with current bay panels
                bayPanelIndex = 0; self.__m_intCurrBayIndex += 1 #move on to next panel bay
                if self.__m_intCurrBayIndex == len(self.__m_panelBays) : self.__m_intCurrBayIndex = 0  #and loop when done with all bays
                
                #------------BAY SECTION---------------------------------------------------
                self.__m_intCurrCellColumn +=  1 # move to next cell on row
                
                #--------Level End detection and action
                if self.__m_intCurrCellColumn == intBaysPerLevel :
                    self.__m_intCurrCellColumn = 0 ; self.__m_intCurrCellRow += 1 ; #start next row up
                    if self.__m_intCurrCellRow > intLevels-1 : break
                    intBaysPerLevel = len(self.__m_arrBayMatrix[self.__m_intCurrCellRow])
                    if self.__m_resetBayAtPoints : bayPanelIndex = 0; currentBay = self.__m_panelBays[0]; self.__m_intCurrBayIndex=-1 #reset bay at beginng of row
                            #exit at end of grid
                    
                #---------Run BAY-TYPE Design Functions (run when a new bay is started)
                
                #store current bay corner points (needed by some functions)
                
                bayCornerPoints = self.GetCellProperty(self.__m_intCurrCellRow, self.__m_intCurrCellColumn, "CELL_CORNER_POINTS")
                
                #Run default function on bay first.        
                currentBay, self.__m_intCurrBayIndex = self.DesFunc_Default_Panel_Bays(self.__m_panelBays, bayList)
                
                #Run all bay-type Design Functions available
                if self.__m_DesignFunctions: 
                    for dsFunc in self.__m_DesignFunctions:
                        if dsFunc and dsFunc.IsLayoutType() : currentBay, self.__m_intCurrBayIndex = dsFunc.Run(myPanelBays, currentBay, self)
                
                #----------Update Bay data
                BayDataCounter = self.__m_BayData['BayCounter']
                BayDataCounter[BayDataCounter.index(currentBay)+len(self.__m_panelBays)] += 1 #update bay type counters
                self.__m_BayData['BayIndices'].append([self.__m_panelBays.index(currentBay), bayCornerPoints])
                
                panelMatrix = self.GetPanelMatrix(self.__m_arrBayMatrix, self.__m_intCurrCellRow, self.__m_intCurrCellColumn, currentBay) #get array of corner points of all panels in bay
                
            
            #---------------PANEL SECTION------------------------------------------------------------------------------------------------
            PanelDef = None     #reset variable (needed by panel-type function calls)
            currBayPanel = currentBay[bayPanelIndex] 
            if bayPanelIndex > len(panelMatrix[0])-2  : continue #skip rest of bay if not finished at end of row
            
            #store panel point data
            if self.__m_surfaceAsPanels == False: #2D Panel mode
                arrAreaPanelPoints = self.GetPanelCorners(panelMatrix, bayPanelIndex) 
                
            else: #surface as panel points for 3D panels ( Using Fitted rectangle on surface panel)
                rct = self.GetCellProperty(self.__m_intCurrCellRow, self.__m_intCurrCellColumn, "CELL_FITTED_RECTANGLE")
                arrAreaPanelPoints = [rct.Corner(0), rct.Corner(1), rct.Corner(3), rct.Corner(2)] 
                #Store Offset Pts (from fitted rectangel coners to cell corners
                offsetPts = self.GetCellProperty(self.__m_intCurrCellRow, self.__m_intCurrCellColumn, "CELL_FITTED_REC_OFFSETS")
                def fromPtToIntegersXYZ(pt):
                    return [int(round(val,3)*1000) for val in [pt.X, pt.Y, pt.Z]]
                intOffsetPts = [fromPtToIntegersXYZ(pt) for pt in offsetPts]
                
            #----------------Panel Profile: Flagging Size data
            
            ChangeFlag = [0, 0, dict(), ""]     #[panel height , panel width , Property_Dictionary, skin_placement (string)]
            
            #ChangeFlag[0]stores panel height number (in unit/1000), used to store and retrieve panels in database 
            panelHeight = max(rs.Distance(arrAreaPanelPoints[0], arrAreaPanelPoints[2]), rs.Distance(arrAreaPanelPoints[1], arrAreaPanelPoints[3]))
            #ChangeFlag[1] stores panel width number (in unit/1000 ), used to store and retrieve panels in database 
            panelWidth = max(rs.Distance(arrAreaPanelPoints[0],arrAreaPanelPoints[1]), rs.Distance(arrAreaPanelPoints[2],arrAreaPanelPoints[3]))   
            # panel height limited to current panel height, regardless of floor to floor value
            if self.__m_surfaceAsPanels == False:
                if not blnFloorPanelHeight and panelHeight >= currBayPanel.GetHeight() - sc.doc.ModelAbsoluteTolerance : 
                    panelHeight = currBayPanel.GetHeight()
                #Check first if panel size is large enough
                if panelHeight < self.__m_dblMinPanelHeight or panelWidth < self.__m_dblMinPanelWidth :
                    print ">>>  Panel [Floor:"+str(self.__m_intCurrCellRow)+" Bay:"+str(self.__m_intCurrCellColumn)+" Panel:"+str(bayPanelIndex)+\
                        "] under minimum size ("+str(round(panelWidth,4))+","+str(round(panelHeight,4))+") Discarded"
                    continue        
            elif self.__m_surfaceAsPanels == True: #check area in surface panels
                rct = self.GetCellProperty(self.__m_intCurrCellRow, self.__m_intCurrCellColumn, "CELL_FITTED_RECTANGLE")
                if rct.Width <= sc.doc.ModelAbsoluteTolerance or rct.Height <= sc.doc.ModelAbsoluteTolerance:  
                    print ">>>  Panel [Row:"+str(self.__m_intCurrCellRow)+" Col:"+str(self.__m_intCurrCellColumn)+\
                        "] has invalid fitted rectangle - Discarded"
                    continue
                if self.__m_dblMinPanelArea > 0:
                    sp1,sp2,sp4,sp3 = self.GetCellProperty(self.__m_intCurrCellRow, self.__m_intCurrCellColumn, "CELL_CORNER_POINTS")
                    spArea = Rhino.Geometry.Brep.CreateFromCornerPoints(sp1, sp2, sp3, sp4, sc.doc.ModelAbsoluteTolerance).GetArea()
                    if spArea < self.__m_dblMinPanelArea :
                        print ">>>  Panel [Row:"+str(self.__m_intCurrCellRow)+" Col:"+str(self.__m_intCurrCellColumn)+\
                            "] under minimum area ("+str(round(spArea,4))+") Discarded"                        
                        continue

                        
            ChangeFlag[0] = int(round(panelHeight,3)*1000)
            ChangeFlag[1] = int(round(panelWidth,3)*1000)
            
            
            #--------------Panel Profile:Flagging placement data in ChangeFlag[3] 
            
            strSkinPlacement = 'Field'
            if self.__m_surfaceAsPanels == False:
                placementList = ['Left', 'Right']
                for side in [0,1]: #corner detection    
                    indexPoint = rs.PointArrayClosestPoint(self.__m_arrCornerPoints, arrAreaPanelPoints[side])
                    cornerPoint = copy.deepcopy(self.__m_arrCornerPoints[indexPoint])
                    cornerPoint[2] = arrAreaPanelPoints[side][2]
                    if rs.PointCompare(cornerPoint, arrAreaPanelPoints[side], self.__m_dblMinPanelWidth + sc.doc.ModelAbsoluteTolerance) :
                        if strSkinPlacement == 'Field': strSkinPlacement = placementList[side]
                        elif strSkinPlacement == 'Left': strSkinPlacement += placementList[side]
            #tagging placement
            ChangeFlag[3] = strSkinPlacement
            
            #if Surface as Panel mode - store Offset Pts property on ChgFlag
            if self.__m_surfaceAsPanels: ChangeFlag[2]['SP_Offsets'] = intOffsetPts
            
            #---------Run PANEL DESIGN FUNCTION First call / Flagging Changes in ChangeFlag[2] - run in every panel.
            #Run own panel design functions first if any (Panel Controller)
            panelController = currBayPanel.GetPanelProperty("CustomGeoController")
            if panelController : panelController.Run_Flag(self, ChangeFlag, currBayPanel)
            #Run Skingenerator global panel design functions next
            if self.__m_DesignFunctions: #Run all Panel Design Functions available
                for dsFunc in self.__m_DesignFunctions:
                    if dsFunc and dsFunc.IsPanelType() : dsFunc.Run_Flag(self, ChangeFlag, currBayPanel)
                    
            #---------Panel Type and Profile LOOKUP in PANEL DATABASE
            #Checks for same panel type with same changeFlags.
            #Database format: Dictionary = {BasePanelType_Name_A:[[PanelType Object 1, ChangeFlag],[PanelType Object 2, ChangeFlag],.....],
            #                               BasePanelType_Name_B:[[PanelType Object 1, ChangeFlag],.....], BasePanelType_Name_C:....}
            
            
            if currBayPanel.GetName() in self.__m_PanelData : #found panel type?
                PanelDef, BlockName = self.PanelProfileLookUp(self.__m_PanelData[currBayPanel.GetName()], ChangeFlag, self.__m_panelProfileTolerance)
            else: self.__m_PanelData[currBayPanel.GetName()] = [] 
            
            #----------------------------------------------------------------------------------------------------
            #NEW PANEL TYPE: A new panel type is generated if no match found in database
            if PanelDef == None :
                
                #-----Create panel copy if unique ----------------------------
                #PanelTypeCount += 1
                PanelDef = SGLibPanel()
                PanelDef.Copy(currBayPanel)
                
                #PANEL DESIGN FUNCTION SECTION - Second Call / Apply custom properties based on ChangeFlag[2] data
                tmpChangeFlag = copy.deepcopy(ChangeFlag) #create a copy (protect from Design Functions modif.)
                
                #Run panel's own controller to apply flagged changes.
                panelController = PanelDef.GetPanelProperty("CustomGeoController")
                if panelController : panelController.Run_Modify(tmpChangeFlag, PanelDef)                
                        
                #ChangeFlag = tmpChangeFlag #restore change flag data
                
                #CUSTOM PANEL SIZE SECTION (automated edge conditions)
                
                #-----Name tag panel (used by Panel Inventory component) 
                PanelDef.SetName(PanelDef.GetName() + " "+strSkinPlacement)
                if round(panelHeight,3) <> round(PanelDef.GetPanelProperty("PanelHeight"),3) : 
                    PanelDef.SetName(PanelDef.GetName() + " -Height:"+str(round(panelHeight,2)))
                if round(panelWidth,3) <> round(PanelDef.GetPanelProperty("PanelWidth"),3) : 
                    PanelDef.SetName(PanelDef.GetName() + " -Width:"+str(round(panelWidth,2)))
                    
                #-----Resize panel ----
                PanelDef.SetHeight(panelHeight)
                PanelDef.SetWidth(panelWidth)
                
                #----Store Panel Parameters ----
                if self.__m_surfaceAsPanels : 
                    PanelDef.SetPanelProperty("PanelOffsetPoints", offsetPts)
                    PanelDef.ModifyCustomGeometry()
                    numSides = self.GetCellProperty(self.__m_intCurrCellRow, self.__m_intCurrCellColumn, "CELL_SIDES")
                    PanelDef.SetPanelProperty("SurfacePanelSides", numSides)
                    
                PanelDef.SetPanelProperty("SkinPlacement", strSkinPlacement)
                
                #CONDITIONAL DEFINITIONS SECTION
                #----Run Conditional definitions on Panel (from panel component input)
                PanelDef.RunConditionalDefinition()
                
                
                #Draw panel geometry to create block
                PanelDef.Draw() 
                
                
                #Add new panel type to Database
                CurrBayList = self.__m_PanelData.get(currBayPanel.GetName())
                CurrBayList.append([PanelDef, copy.deepcopy(ChangeFlag)])
                self.__m_PanelData[currBayPanel.GetName()] = CurrBayList
                
                #-----Generate new Panel Block params --------------------------------------------------
                
                BlockName = "_P_ID-" + self.__m_skinGenName + "_" + str(ChangeFlag) + currBayPanel.GetName()
                
                print ">>> Panel " +  PanelDef.GetName() + " " + " created"
                
            else:
                print ">>> Panel " +  PanelDef.GetName() + " retreived from panel database"   
            #-----Existing and newly created panels ------
            #-----Create Block instance with current panel design
            
            
            if not self.__m_GeneratePanelsOnly:
                result = PanelDef.CreateBlockCopy(BlockName, arrAreaPanelPoints, False)
                #check and discard panels with no objects
                if result == None:
                    self.__m_PanelData[currBayPanel.GetName()].pop()
                    print ">>>>> Panel '" + PanelDef.GetName() + " has no objects - Discarded"
                    continue
                        
            PanelIndices = self.__m_BayData ['PanelIndices']
            PanelIndices.append([arrAreaPanelPoints, PanelDef.GetName()])
        
        """DUMP PANEL DATA
        cRow = 1;cCol = 3; cPanel =0 
        bayBasePanels = self.GetCellProperty(cRow,cCol,"BAY_BASE_PANELS") ; bayPoints = self.GetCellProperty(cRow,cCol,"BAY_POINTS_PANELS")
        for i,p in enumerate(bayBasePanels): print ["bay panels & points", p.GetName()]
        
        print list((p for pts in bayPoints for p in pts ))
        for index in range(self.GetCellProperty(cRow,cCol,"BAY_NUM_PANELS")): 
            #print ["panel instance & chngflag", self.GetCellProperty(cRow,cCol,"PANEL_INSTANCE",index).GetName(), self.GetCellProperty(cRow,cCol,"PANEL_CHANGE_FLAG",index)]
        print self.__m_BayData['BayIndices']
        """
        
        return self.__m_PanelData, self.__m_BayData
    
    
    #--------------------------------------------------------------------------------
    #Retrieve corner points of each panel in cell (bays have 1+ panels)
    #--------------------------------------------------------------------------------
    def GetPanelMatrix(self, bayMatrix, intLevel, intBayID, currentBay):
        
        #in surfacepanel mode create matrix format of 1 panel
        if self.__m_surfaceAsPanels == True: 
            panelMatrix = self.GetCellProperty(intLevel, intBayID, "CELL_CORNER_POINTS")
            return [[panelMatrix[0], panelMatrix[1]],[panelMatrix[2], panelMatrix[3]]]
        
        arrAreaBayPoints = bayMatrix[intLevel][intBayID]
        
        panelMatrix = []
        bayLength = 0
        for panel in currentBay :
            bayLength += panel.GetPanelProperty("PanelWidth")        
            
        linesBay = [0,0]
        
        for pairIndex in [0,1]:
            linesBay[pairIndex]= rs.AddLine(arrAreaBayPoints[pairIndex*2], arrAreaBayPoints[pairIndex*2+1])
            lengthLine = rs.CurveLength(linesBay[pairIndex])
            coefLength = 1
            lengthTotals = 0
            for panel in currentBay :
                if intBayID == len(bayMatrix[intLevel])-1:
                    prevCoefLength = 1
                    if intBayID > 0 :
                        prevCoefLength = rs.Distance(bayMatrix[intLevel][intBayID-1][0], bayMatrix[intLevel][intBayID][0])/bayLength
                    if (bayLength-lengthTotals)< panel.GetPanelProperty("PanelWidth")*prevCoefLength:
                        coefLength = lengthLine/bayLength
                lengthTotals += panel.GetPanelProperty("PanelWidth")*coefLength
                if lengthTotals < lengthLine : rs.InsertCurveKnot(linesBay[pairIndex], lengthTotals)
                
            panelMatrix.append(rs.CurveEditPoints(linesBay[pairIndex]))
            rs.DeleteObject(linesBay[pairIndex])                
                
        return panelMatrix
        
        
        
    
    #--------------------------------------------------------------------------------
    #Retrieve 4 cornes on grid array of skin
    #--------------------------------------------------------------------------------
    def GetPanelCorners(self, arrPanelMatrix, bayPanelIndex):
        
        return copy.deepcopy([arrPanelMatrix[0][bayPanelIndex], arrPanelMatrix[0][bayPanelIndex + 1],\
            arrPanelMatrix[1][bayPanelIndex], arrPanelMatrix[1][bayPanelIndex + 1]])
    
    def PanelProfileLookUp(self, currentBayPanelData, lookUpProfile, threshold ): 
        #profile = [panel height , panel width , Property_Dictionary, skin_placement (string)]
        panelDef = None; blockName = None
        #look for perfect match first
        for pIndex, panelData in enumerate(currentBayPanelData):
            dbProfile = panelData[1]
            if dbProfile == lookUpProfile : 
                panelDef = panelData[0] #found same profile?
                if  len(panelDef.GetPanelProperty("BlockInstances")) == 0 : blockName = ""; break #panels with empty blocks (ex.Ladybug) are skipped
                blockName = rs.BlockInstanceName(panelDef.GetPanelProperty("BlockInstances")[0])
                return panelDef, blockName
        if threshold == 0: return panelDef, blockName # no value to test
        
        #look for imperfect match inside threshold value
        pWidth, pHeight, pPDict, pLocation = lookUpProfile
        for pIndex, panelData in enumerate(currentBayPanelData):
            dbProfile = panelData[1]
            dbWidth, dbHeight, dbDict, dbLocation = dbProfile
            if dbLocation <> pLocation: continue #location
            #overall dimensions
            tolerances = [abs(x-y) for x,y in zip([pWidth, pHeight],[dbWidth, dbHeight])]
            if max(tolerances) > threshold*1000: continue #*1000 to align with the stored format.
            #dictinary data
            
            for pKey in pPDict.keys(): 
                if pKey not in dbDict.keys() : continue #
                if pKey == 'SP_Offsets':
                    comps = [rs.PointCompare(p1, p2, threshold*1000) for p1, p2 in zip(pPDict['SP_Offsets'], dbDict['SP_Offsets'])]
                    if False in comps : continue
                
                #found profile within tolerance
                panelDef = panelData[0] #retrieve panel object stored
                break
                
        if panelDef <> None:        
            if  len(panelDef.GetPanelProperty("BlockInstances")) == 0 : blockName = "" #panels with empty blocks (ex.Ladybug) are skipped
            blockName = rs.BlockInstanceName(panelDef.GetPanelProperty("BlockInstances")[0])
            
        return panelDef, blockName
        
    #--------------------------------------------------------------------------------------------------
    # DESIGN FUNCTIONS SECTION
    #--------------------------------------------------------------------------------------------------
    def DesFunc_Default_Panel_Bays(self, PanelBay_List, defaultBayList=None):

        validBayList = copy.deepcopy(defaultBayList)
        
        # Define new current bay index based on the exclude bays listed 
        if  validBayList:   
            for index in range(len(validBayList)) : validBayList[index] -=1 #cero based indexes
        else: validBayList = range(len(PanelBay_List))
        
        while True:
            if  self.__m_intCurrBayIndex in validBayList : break
            self.__m_intCurrBayIndex +=1
            if self.__m_intCurrBayIndex == len(PanelBay_List) : self.__m_intCurrBayIndex = min(validBayList)
                
        if self.__m_intCurrBayIndex >= len(PanelBay_List) : 
            self.__m_warningData.append("DesFunc_Default_Panel_Bays: Invalid bay index, using bay 1")
            return [PanelBay_List[0], 0]
        return  [PanelBay_List[self.__m_intCurrBayIndex], self.__m_intCurrBayIndex]
        

#DisplayUtilities
#Tools for displaying visual elements on panels such as guides, corner bounding box lines, etc. 
rc = Rhino
import System.Drawing

class DisplayUtilities:
    
    @staticmethod
    def BakeGeo(geoList, fieldName, tagText=None):
        prevDoc = sc.doc 
        sc.doc = rc.RhinoDoc.ActiveDoc
        if fieldName not in sc.sticky: sc.sticky[fieldName] = []
        
        for obj in sc.sticky[fieldName]:
            rs.DeleteObject(obj)
        rs.AddLayer("GEO")
        sceneObjects = []
        currentLayer = rs.CurrentLayer()
        
        for geo in geoList : 
        
            #prep. attributes
            color = geo.GetUserString("Color")
            color = eval(color) if color <> None and color <> "" else None
            colorSource = geo.GetUserString("ColorSource")
            colorSource = eval(colorSource) if colorSource <> None and colorSource <> "" else None
            layer = geo.GetUserString("Layer")
            if layer =="" or layer == None: layer="default"
            rs.AddLayer("GEO::"+layer)
            newAttr = rc.DocObjects.ObjectAttributes()
            if color : newAttr.ObjectColor = color
            if colorSource : newAttr.ColorSource = colorSource
            newAttr.LinetypeSource = rc.DocObjects.ObjectLinetypeSource.LinetypeFromLayer
            newAttr.LayerIndex =  rc.RhinoDoc.ActiveDoc.Layers.Find(layer, True)  
            
            #add object to scene
            objDoc = None
            if rs.IsBrep(geo): #is a surface/polysurface?
                objDoc = sc.doc.Objects.AddBrep(geo, newAttr)
            elif rs.IsCurve(geo): # a curve?
                objDoc = sc.doc.Objects.AddCurve(geo, newAttr)
            if objDoc: sceneObjects += [rs.coerceguid(objDoc)]
            
        #add tag if provided
        if geoList and geoList <> [] and tagText <> None:
            textInsertPt = [0,-.4*_UNIT_COEF,0]
            rs.AddLayer("GEO::_Canvas")
            rs.CurrentLayer("GEO::_Canvas")
            tag=rs.AddText(tagText, textInsertPt, .2*_UNIT_COEF, font_style=1)
            sceneObjects += [tag]
            
        #store them for future delete/update        
        sc.sticky[fieldName] = sceneObjects
        rs.CurrentLayer(currentLayer)
        sc.doc = prevDoc
        
    @staticmethod
    def DrawCanvasGeo(canvasPts, breps=None, boundingBox=None):
        
        #generates lines from corner points and lengths ratios
        def getCornerLinesFromPoints(pts, extLengthRatio, trimLengthRatio, color):
            startPts = pts
            endPts = copy.deepcopy(pts)
            endPts.append(endPts.pop(0))    
            geoList = []
            for stPt, endPt in zip(startPts, endPts):
                trimLine  = rc.Geometry.Line(stPt, endPt)
                extLine  = rc.Geometry.Line(stPt, endPt)
                dist = stPt.DistanceTo(endPt)
                trimLine.Extend(-dist*trimLengthRatio,-dist*trimLengthRatio)
                extLine.Extend(dist*extLengthRatio, dist*extLengthRatio)
                geoList.append(rc.Geometry.Line(extLine.From, trimLine.From).ToNurbsCurve())
                geoList.append(rc.Geometry.Line(extLine.To, trimLine.To).ToNurbsCurve())
                
            for geo in geoList:
                geo.SetUserString("Layer", "_Canvas") 
                geo.SetUserString("Color", color)
                geo.SetUserString("ColorSource", "rc.DocObjects.ObjectColorSource.ColorFromObject")
            return geoList
            
        #canvas corner lines
        canvasGeoList = getCornerLinesFromPoints(canvasPts, 1/15, -1/60, "System.Drawing.Color.Blue")
        
        #create base and top canvas corner lines    
        canvasBasePts = canvasTopPts = []
        baseGeoList = topGeoList = []
        canvasPlane = rc.Geometry.Plane(canvasPts[0], canvasPts[1], canvasPts[3]) if len(canvasPts)> 4 \
            else rc.Geometry.Plane(canvasPts[0], canvasPts[1], canvasPts[2])
        if breps: # canvas for created objects
            geoBbox = rc.Geometry.BoundingBox.Empty
            for brep in breps:
                geoBbox.Union(brep.GetBoundingBox(canvasPlane))
            canvasBasePts = list(geoBbox.GetCorners()[0:4])
            canvasTopPts = list(geoBbox.GetCorners()[4:8]) 
        elif boundingBox: #canvas for base curves/breps
            canvasBasePts = list(boundingBox.GetCorners()[0:4])
            canvasTopPts = list(boundingBox.GetCorners()[4:8]) 
        xForm = rc.Geometry.Transform.PlaneToPlane(rc.Geometry.Plane.WorldXY, canvasPlane)
        if canvasBasePts <> []:
            baseGeoList = getCornerLinesFromPoints(canvasBasePts, 0, 1/5, "System.Drawing.Color.Red")
            if breps:
                for geo in baseGeoList: geo.Transform(xForm) 
        if canvasTopPts <> []:
            topGeoList = getCornerLinesFromPoints(canvasTopPts, 0, 1/5, "System.Drawing.Color.Red")        
            if breps:
                for geo in topGeoList: geo.Transform(xForm)            
            
        return canvasGeoList + baseGeoList + topGeoList







class DynamicGeometry:
    
    __m_baseParameters = []
    __m_dynamicParameters = []
    __m_dynamicBreps = []    
    __m_storedDynamicParameters = None
    __m_storedBrepOutput = None
    __m_warningData = []
    
    #CONSTRUCTOR -------------------------------------------------------------------------------------------
    def __init__(self, baseParameters, dynamicParameters):
        
        self.__m_baseParameters = baseParameters
        self.__m_dynamicParameters = dynamicParameters
        
    @property
    def WarningData(self):
        return self.__m_warningData        
        
    def SetParameter(self, value, numParam=None):
        
        if numParam >= len(self.__m_dynamicParameters) : return False
        
        if numParam == None: self.__m_dynamicParameters =list((value for n in self.__m_dynamicParameters))
        else: self.__m_dynamicParameters[numParam] = value
        
        return True
        
    def Reset(self):
        pass
        
    def Run(self):
        return self.__m_dynamicBreps
        




# Design Function  Class
# Base class used for all DesignFunctions

class BaseDesignFunction:
    
    __m_warningData = []
    
    #CONSTRUCTOR -------------------------------------------------------------------------------------------
    def __init__(self):
        pass
        
    @property
    def WarningData(self):
        return self.__m_warningData   
      
    def IsLayoutType(self):
        pass
        
    def IsPanelType(self):
        pass  
    
    def Reset(self):
        pass
        
    #Layout Design Function
    def Run(self, PanelBay_List, currentBay, skinInstance):
        pass
        
    #Panel Design Function
    def Run_Flag(self, skinInstance, ChangeFlag, BasePanel):
        pass
        
    #Panel Deisgn Function
    def Run_Modify(self, ChangeFlag, BasePanel):
        pass
        
        

#In-Panel controller to be referenced on systems panels
class SystemsPanelController(BaseDesignFunction):
    
    __m_functionType = ''
    __m_customPanelIndex = 0
    warningData = []
    
    #CONSTRUCTOR -------------------------------------------------------------------------------------------
    def __init__(self):
        
        self.__m_functionType = 'Panel'
        self.__m_dataIndex = 0
        self.__m_customPanelIndex = 1
        
        excludeCustomSize = False
        if excludeCustomSize : self.__m_excludeCustomSizePanels = excludeCustomSize
                 

    def Reset(self):
        self.__m_dataIndex = 0
        self.__m_customPanelIndex = 1
        
    def IsLayoutType(self):
        if self.__m_functionType == 'Layout': return True
        return False
        
        
    def IsPanelType(self):
        if self.__m_functionType == 'Panel': return True
        return False        
        
        
    #----- functionCall valid skin parameters to us as inputs ------
    # skinInstance :  a reference to the skin object calling this function
    # ChangeFlag : List used in Skin Generator to identify panel changes - format: [panel height , panel width , PropertyDictionary ]
    # BasePanel : Panel used as base for new custom panel (can only be used on callState=1 section

    #1st call - Flagging panel modifications
    def Run_Flag(self, skinInstance, ChangeFlag, BasePanel):
        
        #Systems panels don't flag any information to modify panel
        return
    
    #2nd call - Performing panel modifications 
    def Run_Modify(self, ChangeFlag, BasePanel):

        propDict = ChangeFlag[2]
        if propDict == 0 : return
        
        #go through flagged changes on panel
        customFlag = False
        for param, value in zip(propDict.keys(), propDict.values()):
            customFlag = True
            #run panel funcitons based on type of parameter change
            if  param == "Shading":
                strData = value[0]
                if "layerName" in value[0]: 
                    splitData = value[0].rsplit("=",1)
                    splitData[1] = splitData[1][0:7] if splitData[1].find("-") else  splitData[1][0:8]
                    strData = splitData[0]+"='Layer_"+splitData[1]+"'"
                if "type=" in value[0]:
                    exec("BasePanel.ModifyShadingType("+strData+")")
                    del value[0]
                elif  "index=" in value[0]:
                    exec("BasePanel.ModifyShadingIndex("+strData+")")
                    del value[0]
            elif param == "Window":
                exec("BasePanel.ModifyWindow("+value[0]+")")
                del value[0]
            elif param == "Mullion":
                exec("BasePanel.ChangeMullionType("+value[0]+")")
                del value[0]
            elif param == "CustomGeometry":
                exec("BasePanel.ModifyCustomGeometry("+value[0]+")")
                del value[0]
            else:
                if BasePanel.GetPanelProperty(param) <> value:
                    BasePanel.SetPanelProperty(param, value)

        #Add Version number (.x)  to the panel name (used on panel inventory viewer)
        if customFlag :
            panelName = BasePanel.GetName()+"."+str(self.__m_customPanelIndex)
            BasePanel.SetName(panelName)
            self.__m_customPanelIndex +=1
                    
        return 
            
        
        
sc.sticky["SGLib_DisplayUtilities"] = DisplayUtilities

sc.sticky["SGLib_Panel"] = Panel

sc.sticky["SGLib_Skin"] = Skin

sc.sticky["SGLib_DynamicGeometry"] = DynamicGeometry

sc.sticky["SGLib_DesignFunction"] = BaseDesignFunction

sc.sticky["SGLib_SystemsPanelController"] = SystemsPanelController

print "SkinDesigner Running..."
# ---------- end skindesigner ----------

# ----
# Shading Systems
# Sunshade
# Louvers
# Shading Box
number_slider = Slider(-49, range=-90..90)
shadinglouver = SkinDesigner_ShadingLouver(
    thickness=Slider(0.3, range=0.1..1),
    spacing=Slider(0.6, range=0.2..1.5),
    rotation=number_slider,
    offsetFromWall=Slider(0.3, range=0.2..1.5))  # -> shadingSystem; inputs verticalOrientation: Boolean, windowLouver: Boolean
# ---------- shadinglouver: Python ----------
# SkinDesigner: A Plugin for Building Skin Design (GPL) started by Santiago Garay

# This file is part of SkinDesigner.
# 
# Copyright (c) 2017, Santiago Garay <sgaray1970@gmail.com> 
# SkinDesigner is free software; you can redistribute it and/or modify 
# it under the terms of the GNU General Public License as published 
# by the Free Software Foundation; either version 3 of the License, 
# or (at your option) any later version. 
# 
# SkinDesigner is distributed in the hope that it will be useful,
# but WITHOUT ANY WARRANTY; without even the implied warranty of 
# MERCHANTABILITY or FITNESS FOR A PARTICULAR PURPOSE. See the 
# GNU General Public License for more details.
# 
# You should have received a copy of the GNU General Public License
# along with SkinDesigner; If not, see <http://www.gnu.org/licenses/>.
# 
# @license GPL-3.0+ <http://spdx.org/licenses/GPL-3.0+>
# Louver Shading
"""
Use this component to generate a shade louver to be added to a panel

    Args:
        layerName: A string indicating the layer the louver shade geometry will use when drawn in the scene. Default is _P_Shading
        width: A floating point value that represents the louvers' horizontal dimension in scene units. Default is 0.25m (10 inches aprox.)
        thickness: A floating point value that represents the louvers'  vertical dimension in scene units. Default value is 0.025m (1 inch)
        spacing: A floating point value that represents the spacing between louvers in scene units. Default value is 0.15m (6 inches aprox.)
        rotation: A floating point value indicating the rotation applied to the louvers length axis, with origon at the mid point of the louvers width. Default is 0.0
        offsetFromWallFromWall: A floating point value that represenets a separation distance from panel wall's exterior surface  (not including panel systems applied).Default value is 0.025 m (1 inch)
        verticalOrientation: A boolean to turn on/off vertical orientation of the shade. Default is False (horizontal).
        windowLouvers: A boolean to turn on off considering fromLeftEdge, fromBottomEdge and fromEdgeEnd values relative to the window instead of realtive to the panel. Deafult is False (dimensions are considered relative to the panel)
        fromLeftEdge: A floating point value indicating the separation of the louvers from the left edge of the panel or the window if it is a window louver. Default value is 0.0.
        fromRightEdge: A floating point value indicating the separation of the louvers from the right edge of the panel or the window if it is a window louver. Default value is 0.0.
        fromBottomEdge:  A floating point value indicating the separation of the louvers from the bottom edge of the panel or the window if it is a window louver. Default value is 0.0.
        fromTopEdge:  A floating point value indicating the separation of the louvers from the top edge of the panel or the window if it is a window louver. Default value is 0.0.
    Returns:
        shadingSystem: A list with shading data packed to be connected to a Panel component shadingSystem input


    Returns:


"""
# WindowData(wd) = 0=width,1=height,2=fromLeft,3=fromBottom,4=recess 

ghenv.Component.Name = "SkinDesigner_ShadingLouver"
ghenv.Component.NickName = 'ShadingLouver'
ghenv.Component.Message = 'VER 0.5.00\nJul_18_2018'
ghenv.Component.Category = "SkinDesigner"
ghenv.Component.SubCategory = "02 | Parameters"
try: ghenv.Component.AdditionalHelpFromDocStrings = "3"
except: pass

import Grasshopper.Kernel as gh
import GhPython
# automnatically set the right input names and types (when using + icon) 
numInputs = ghenv.Component.Params.Input.Count
accessList = ghenv.Component.Params.Input[0].Access.list
accessItem = ghenv.Component.Params.Input[0].Access.item
typeFloat = GhPython.Component.NewFloatHint()
typeString = GhPython.Component.NewStrHint()
typeBool = gh.Parameters.Hints.GH_BooleanHint_CS()
typeVector = gh.Parameters.Hints.GH_Vector3dHint()

for input in range(numInputs):
    access = accessList
    typeHint = typeString   
    if input == 0: inputName = 'width'; access = accessItem; typeHint = typeFloat
    elif input == 1: inputName = 'thickness'; access = accessItem; typeHint = typeFloat
    elif input == 2: inputName = 'spacing'; access = accessItem; typeHint = typeFloat
    elif input == 3: inputName = 'rotation'; access = accessItem; typeHint = typeFloat
    elif input == 4: inputName = 'offsetFromWall'; access = accessItem; typeHint = typeFloat
    elif input == 5: inputName = 'verticalOrientation' ; access = accessItem; typeHint = typeBool   
    elif input == 6: inputName = 'windowLouver'; access = accessItem; typeHint = typeBool   
    elif input == 7: inputName = 'layerName'; access = accessItem
    elif input == 8: inputName = '------------------------'
    elif input == 9: inputName = 'fromLeftEdge' ; access = accessItem
    elif input == 10: inputName = 'fromRightEdge'; access = accessItem
    elif input == 11: inputName = 'fromBottomEdge' ; access = accessItem
    elif input == 12: inputName = 'fromTopEdge'; access = accessItem
    else: continue
    
    ghenv.Component.Params.Input[input].NickName = inputName
    ghenv.Component.Params.Input[input].Name = inputName
    ghenv.Component.Params.Input[input].Access = access
    ghenv.Component.Params.Input[input].TypeHint = typeHint
ghenv.Component.Attributes.Owner.OnPingDocument()



import scriptcontext as sc
import Rhino


#init set up global variables
_UNIT_COEF = 1
sc.doc = Rhino.RhinoDoc.ActiveDoc
unitSystem = sc.doc.ModelUnitSystem
if unitSystem == Rhino.UnitSystem.Feet: _UNIT_COEF = 3.28084
if unitSystem == Rhino.UnitSystem.Inches: _UNIT_COEF = 3.28084*12
if unitSystem == Rhino.UnitSystem.Millimeters: _UNIT_COEF = 1000
sc.doc = ghdoc



if numInputs == 0 or width == None : width = .1*_UNIT_COEF
if numInputs < 2 or thickness== None : thickness = .01*_UNIT_COEF
if numInputs < 3 or spacing == None : spacing = .15*_UNIT_COEF
if numInputs < 4 or rotation == None : rotation = 0.0
if numInputs < 5 or offsetFromWall == None : offsetFromWall = .02*_UNIT_COEF
if numInputs < 8 or layerName == None : layerName = "_P_Shading"

if numInputs < 10 or fromLeftEdge == None : fromLeftEdge = 0.0
if numInputs < 11 or fromRightEdge == None : fromRightEdge = 0.0
if numInputs < 12 or fromBottomEdge == None : fromBottomEdge = 0.0
if numInputs < 13 or fromTopEdge == None : fromTopEdge = 0.0


if numInputs >= 5 and verticalOrientation == True : shadingType = 'VerticalLouver'; hOffset = str(spacing)+"/2"; vOffset="0"
else: shadingType = 'HorizontalLouver'; hOffset = "0"; vOffset=str(spacing)+"/2"

if numInputs >= 6 and windowLouver == True:
    if shadingType == 'HorizontalLouver': shadingType = 'HorizontalWindowLouver'
    else: shadingType = 'VerticalWindowLouver'


shiftEndVectors = [None, None]
if numInputs > 14 and shiftEnd1 : shiftEndVectors[0] = [shiftEnd1.X, shiftEnd1.Y, shiftEnd1.Z]
if numInputs > 15 and shiftEnd2 : shiftEndVectors[1] = [shiftEnd2.X, shiftEnd2.Y, shiftEnd2.Z]


shadingSystem = "AddShadingType('" + shadingType +"', layerName='"+ layerName +"', fromLeftBottom = ["+str(fromLeftEdge)+", "+str(fromBottomEdge)+\
    "], fromRightTop=["+str(fromRightEdge)+", "+str(fromTopEdge)+"],width="+str(thickness)+", thickness="+str(width)+\
    ", spacing="+str(spacing)+", offset="+str(offsetFromWall)+", rotation="+str(rotation)+", shiftEnds="+str(shiftEndVectors)+")\r\n"

#print shadingSystem
print "Done"
# ---------- end shadinglouver ----------
shadingbox = SkinDesigner_ShadingBox()  # -> out, shadingSystem; inputs shiftCorners: list
# ---------- shadingbox: Python ----------
# SkinDesigner: A Plugin for Building Skin Design (GPL) started by Santiago Garay

# This file is part of SkinDesigner.
# 
# Copyright (c) 2017, Santiago Garay <sgaray1970@gmail.com> 
# SkinDesigner is free software; you can redistribute it and/or modify 
# it under the terms of the GNU General Public License as published 
# by the Free Software Foundation; either version 3 of the License, 
# or (at your option) any later version. 
# 
# SkinDesigner is distributed in the hope that it will be useful,
# but WITHOUT ANY WARRANTY; without even the implied warranty of 
# MERCHANTABILITY or FITNESS FOR A PARTICULAR PURPOSE. See the 
# GNU General Public License for more details.
# 
# You should have received a copy of the GNU General Public License
# along with SkinDesigner; If not, see <http://www.gnu.org/licenses/>.
# 
# @license GPL-3.0+ <http://spdx.org/licenses/GPL-3.0+>
# Shading Box
"""
Use this component to generate four shade objects placed around the window to be added to a panel component.

    Args:
        layerName: A string indicating the layer the louver shade geometry will use when drawn in the scene. Default is _P_Shading
        width: A floating point value that represents the louvers' horizontal dimension in scene units. Default is 0.25m (10 inches aprox.)
        thickness: A floating point value that represents the louvers'  vertical dimension in scene units. Default value is 0.025m (1 inch)
        offsetFromWall: A floating point value that represenets a separation distance from panel wall's exterior surface  (not including panel systems applied).Default value is 0.025 m (1 inch)
        offsetFromWindow: A floating point value that represents the distance from the window edges where the sunshades will be located. Positive values offset the sunshades towards inside the window. Default value is 0.0.
        offsetFromPanel: A floating point value that represents the distance from the panel edges where the sunshades will be located. Positive values offset the sunshades towards inside the panel. Default value is 0.0.
        shiftCorners: A list of one to four vectors that is used to shift in scene units on x,y,z the outside end point of the shading box corners. It is provided to be able to create custom-shaped shading elements. Default value is 0,0,0 on all corners.
    Returns:
        shadingSystem: A list with shading data packed to be connected to a Panel component shadingSystem input



"""


ghenv.Component.Name = "SkinDesigner_ShadingBox"
ghenv.Component.NickName = 'ShadingBox'
ghenv.Component.Message = 'VER 0.5.00\nJul_18_2018'
ghenv.Component.Category = "SkinDesigner"
ghenv.Component.SubCategory = "02 | Parameters"
try: ghenv.Component.AdditionalHelpFromDocStrings = "3"
except: pass


import scriptcontext as sc
import Rhino


#init set up global variables
_UNIT_COEF = 1
sc.doc = Rhino.RhinoDoc.ActiveDoc
unitSystem = sc.doc.ModelUnitSystem
if unitSystem == Rhino.UnitSystem.Feet: _UNIT_COEF = 3.28084
if unitSystem == Rhino.UnitSystem.Inches: _UNIT_COEF = 3.28084*12
if unitSystem == Rhino.UnitSystem.Millimeters: _UNIT_COEF = 1000
sc.doc = ghdoc


if layerName == None : layerName = "'_P_Shading'"
if not thickness : thickness = .015*_UNIT_COEF
if not width : width = .2*_UNIT_COEF
if not offsetFromWall : offsetFromWall = 0
offset = -thickness/2

# shift data 
shiftEndVectors = []
for v in range(4) : 
    shiftVector = None
    if v < len(shiftCorners): 
        corner = eval(str(shiftCorners[v]))
        shiftVector = [corner[0], corner[1], corner[2]]
    shiftEndVectors.append(shiftVector)



#WindowData = 0=width,1=height,2=fromLeft,3=fromBottom,4=recess 
if offsetFromPanel <> None: 
    offsetFromPanel = eval(str(offsetFromPanel))
    if offsetFromPanel < 0: offsetFromPanel = 0
    offset = offsetFromPanel + thickness/2
    shadingSystem = "AddShadingType('HorizontalShade'"+", layerName="+ layerName +", fromLeftBottom = ["+str(offset)+", "+str(offset)+"], fromEdge="+str(offset)+\
        ",width="+str(thickness)+", thickness="+str(width)+", offset="+str(offsetFromWall)+", shiftEnds="+str([shiftEndVectors[3],shiftEndVectors[2]])+")\r\n"
    shadingSystem +=  "AddShadingType('HorizontalShade'"+", layerName="+ layerName +", fromLeftBottom = ["+str(offset)+", PanelHeight-"+str(offset)+"], fromEdge="+str(offset)+\
        ",width="+str(thickness)+", thickness="+str(width)+", offset="+str(offsetFromWall)+", shiftEnds="+str([shiftEndVectors[0],shiftEndVectors[1]])+")\r\n"
    shadingSystem +=  "AddShadingType('VerticalShade'"+", layerName="+ layerName +", fromLeftBottom = ["+str(offset)+", "+str(offset)+"], fromEdge="+str(offset)+\
        ",width="+str(thickness)+", thickness="+str(width)+", offset="+str(offsetFromWall)+", shiftEnds="+str([shiftEndVectors[3],shiftEndVectors[0]])+")\r\n"
    shadingSystem +=  "AddShadingType('VerticalShade'"+", layerName="+ layerName +", fromLeftBottom = [PanelWidth-"+str(offset)+", "+str(offset)+"], fromEdge="+str(offset)+\
        ",width="+str(thickness)+", thickness="+str(width)+", offset="+str(offsetFromWall)+", shiftEnds="+str([shiftEndVectors[2],shiftEndVectors[1]])+")\r\n"
else:
    if offsetFromWindow <> None: offset = - eval(str(offsetFromWindow)) - thickness/2
    shadingSystem = "AddShadingType('HorizontalWindowShade'"+", layerName="+ layerName +", fromLeftBottom = [-Window['width']+"+str(offset)+", Window['height']+"+str(-offset)+\
        "], fromEdge="+str(offset)+",width="+str(thickness)+", thickness="+str(width)+", offset="+str(offsetFromWall)+", shiftEnds="+str([shiftEndVectors[3],shiftEndVectors[2]])+")\r\n"
    shadingSystem +=  "AddShadingType('HorizontalWindowShade'"+", layerName="+ layerName +", fromLeftBottom = [-Window['width']+"+str(offset)+", -Window['height']+"+str(offset)+\
        "], fromEdge="+str(offset)+",width="+str(thickness)+", thickness="+str(width)+", offset="+str(offsetFromWall)+", shiftEnds="+str([shiftEndVectors[0],shiftEndVectors[1]])+")\r\n"
    shadingSystem += "AddShadingType('VerticalWindowShade'"+", layerName="+ layerName +", fromLeftBottom = [-Window['width']+"+str(offset)+", -Window['height']+"+str(offset)+\
        "], fromEdge="+str(offset)+",width="+str(thickness)+", thickness="+str(width)+", offset="+str(offsetFromWall)+", shiftEnds="+str([shiftEndVectors[3],shiftEndVectors[2]])+")\r\n"
    shadingSystem +=  "AddShadingType('VerticalWindowShade'"+", layerName="+ layerName +", fromLeftBottom = [Window['width']+"+str(-offset)+", -Window['height']+"+str(offset)+\
        "], fromEdge="+str(offset)+",width="+str(thickness)+", thickness="+str(width)+", offset="+str(offsetFromWall)+", shiftEnds="+str([shiftEndVectors[0],shiftEndVectors[1]])+")\r\n"

    
#print shadingSystem
print "Done"
# ---------- end shadingbox ----------
shading = SkinDesigner_Shading()  # -> shadingSystem; inputs verticalOrientation: Boolean, windowShade: Boolean
# ---------- shading: Python ----------
# SkinDesigner: A Plugin for Building Skin Design (GPL) started by Santiago Garay

# This file is part of SkinDesigner.
# 
# Copyright (c) 2017, Santiago Garay <sgaray1970@gmail.com> 
# SkinDesigner is free software; you can redistribute it and/or modify 
# it under the terms of the GNU General Public License as published 
# by the Free Software Foundation; either version 3 of the License, 
# or (at your option) any later version. 
# 
# SkinDesigner is distributed in the hope that it will be useful,
# but WITHOUT ANY WARRANTY; without even the implied warranty of 
# MERCHANTABILITY or FITNESS FOR A PARTICULAR PURPOSE. See the 
# GNU General Public License for more details.
# 
# You should have received a copy of the GNU General Public License
# along with SkinDesigner; If not, see <http://www.gnu.org/licenses/>.
# 
# @license GPL-3.0+ <http://spdx.org/licenses/GPL-3.0+>
# Shading
"""
Use this component to generate a shade object to be added to a panel

    Args:
        layerName: A string indicating the layer the shade geometry will use when drawn in the scene. Default is _P_Shading
        width: A floating point value that represents a shade object's horizontal dimension in scene units. Default is 0.25m (10 inches aprox.)
        thickness: A floating point value that represents a shade object's  vertical dimension in scene units. Default value is 0.025m (1 inch)
        offsetFromWall: A floating point value that represenets a separation distance from panel wall's exterior surface  (not including panel systems applied).Default value is 0.025 m (1 inch)
        verticalOrientation: A boolean to turn on/off vertical orientation of the shade. Default is False (horizontal).
        windowShade: A boolean to turn on/off fromLeftEdge, fromBottomEdge and fromEdgreEnd values to be measured relative to the window bottom/left corner instead of realtive to the panel bottom/left corne. Deafult is False (dimensions are considered relative to the panel)
        fromLeftEdge: A floating point value indicating the separation of the shade from the left edge of the panel or the window if it is a window shade. Default value is 0.0. Also negative values are used to set dimensions from the panel or window right edge. 
        fromBottomEdge:  A floating point value indicating the separation of the shade from the bottom edge of the panel or the window if it is a window shade. Default value depends on shade orientation: In horizotnal shades it is the panel height (top of panel) or window height (top of window) if it is a window shade. In vertical shades default value is is 0.0. Also negative values are used to set dimensions from the top of panel or window.
        fromOppositeEdge:  A floating point value indicating the separation of the shade from the opposite edge of the panel or the window if it is a window shade. Default value is 0.0 (no separation ).
        rotation: A floating point value indicating the rotation around the shade's long axis, with center at the mid point of the shade's width. Default is 0.0
    Returns:
        shadingSystem: A list with shading data packed to be connected to a Panel component shadingSystem input

"""


ghenv.Component.Name = "SkinDesigner_Shading"
ghenv.Component.NickName = 'Shading'
ghenv.Component.Message = 'VER 0.5.00\nJul_18_2018'
ghenv.Component.Category = "SkinDesigner"
ghenv.Component.SubCategory = "02 | Parameters"
try: ghenv.Component.AdditionalHelpFromDocStrings = "3"
except: pass

import Grasshopper.Kernel as gh
import GhPython
import scriptcontext as sc
import Rhino

# automnatically set the right input names and types (when using + icon) 

numInputs = ghenv.Component.Params.Input.Count
if numInputs: 
    accessList = ghenv.Component.Params.Input[0].Access.list
    accessItem = ghenv.Component.Params.Input[0].Access.item
    typeFloat = GhPython.Component.NewFloatHint()
    typeVector3d = gh.Parameters.Hints.GH_Vector3dHint()
    typeString = GhPython.Component.NewStrHint()
    typeBool = gh.Parameters.Hints.GH_BooleanHint_CS()
    typeVector = gh.Parameters.Hints.GH_Vector3dHint()

for input in range(numInputs):
    access = accessList
    typeHint = typeString 
    if input == 0: inputName = 'width'; access = accessItem; typeHint = typeFloat
    elif input == 1: inputName = 'thickness'; access = accessItem; typeHint = typeFloat
    elif input == 2: inputName = 'rotation'; access = accessItem; typeHint = typeFloat
    elif input == 3: inputName = 'offsetFromWall'; access = accessItem; typeHint = typeFloat
    elif input == 4: inputName = 'verticalOrientation'; access = accessItem; typeHint = typeBool  
    elif input == 5: inputName = 'windowShade'; access = accessItem; typeHint = typeBool  
    elif input == 6: inputName = 'layerName'; access = accessItem
    elif input == 7: inputName = '------------------------'
    elif input == 8: inputName = 'fromLeftEdge' ; access = accessItem
    elif input == 9: inputName = 'fromBottomEdge' ; access = accessItem
    elif input == 10: inputName = 'fromOppositeEdge'; access = accessItem
    else: continue
    
    ghenv.Component.Params.Input[input].NickName = inputName
    ghenv.Component.Params.Input[input].Name = inputName
    ghenv.Component.Params.Input[input].Access = access
    ghenv.Component.Params.Input[input].TypeHint = typeHint
        
ghenv.Component.Attributes.Owner.OnPingDocument()


#init set up global variables
_UNIT_COEF = 1
sc.doc = Rhino.RhinoDoc.ActiveDoc
unitSystem = sc.doc.ModelUnitSystem
if unitSystem == Rhino.UnitSystem.Feet: _UNIT_COEF = 3.28084
if unitSystem == Rhino.UnitSystem.Inches: _UNIT_COEF = 3.28084*12
if unitSystem == Rhino.UnitSystem.Millimeters: _UNIT_COEF = 1000
sc.doc = ghdoc

try:
    if layerName == None: layerName = "_P_Shading" 
except: layerName = "_P_Shading"
try:
    if width == None : width = 3/12*_UNIT_COEF
except: width = 3/12*_UNIT_COEF
try:
    if thickness == None : thickness = .025*_UNIT_COEF
except: thickness = .025*_UNIT_COEF
try:
    if offsetFromWall == None : offsetFromWall = .025*_UNIT_COEF
except: offsetFromWall = .025*_UNIT_COEF

try: 
    if verticalOrientation == True : shadingType = "VerticalShade"
    else : shadingType = 'HorizontalShade'    
except : verticalOrientation = False; shadingType = 'HorizontalShade'
try:
    if windowShade == None: windowShade = False
except: windowShade = False
try: 
    if fromLeftEdge == None : fromLeftEdge = 0.0
except: fromLeftEdge = 0.0
try: 
    fromBottomEdge
except: fromBottomEdge = None

if fromBottomEdge == None : 
    if windowShade==False : 
        if verticalOrientation : fromBottomEdge = 0.0
        else : fromBottomEdge = 'PanelHeight'
    else : 
        if  verticalOrientation : fromBottomEdge = 0.0
        else : fromBottomEdge = -0.01
try:
    if fromOppositeEdge == None : fromOppositeEdge = 0.0
except: fromOppositeEdge = 0.0

#window shade?

if windowShade == True:
    if shadingType == 'HorizontalShade' : shadingType = 'HorizontalWindowShade'
    elif shadingType == 'VerticalShade' : shadingType = 'VerticalWindowShade'

fromEdge = fromOppositeEdge
fromLeft = fromLeftEdge
fromBottom = fromBottomEdge
fromBottomEdge = None
angleRot = 0
#rotation data
try:
    if rotation <> None:  angleRot = rotation
except: pass

#shade ends shifting data
shiftEndVectors = [None, None]
try:
    if shiftEnd1 == None :shiftEndVectors[0] = [0,0,0]
    else: shiftEndVectors[0] = [shiftEnd1[0], shiftEnd1[1], shiftEnd1[2]]
except: shiftEndVectors[0] = [0,0,0]
try:
    if shiftEnd2 == None : shiftEndVectors[1] = [0,0,0]
    else: shiftEndVectors[1] = [shiftEnd2[0], shiftEnd2[1], shiftEnd2[2]]
except: shiftEndVectors[1] = [0,0,0]



# WindowData(wd) = 0=width,1=height,2=fromLeft,3=fromBottom,4=recess 

shadingSystem = "AddShadingType('" + shadingType +"', layerName='"+ layerName +"', fromLeftBottom = ["+str(fromLeft)+", "+str(fromBottom)+"], fromEdge="+str(fromEdge)+\
    ",width="+str(thickness)+", thickness="+str(width)+", offset="+str(offsetFromWall)+", rotation="+str(angleRot)+", shiftEnds="+str(shiftEndVectors)+")\r\n"


#print shadingSystem
print "Done"
# ---------- end shading ----------

# ----
# Panel Systems
# Curtain Wall
# Wall
system_curtainwall = SkinDesigner_SystemCurtainWall()  # -> panelSystem; inputs global_mullion_data: list, width: list, thickness: list, capThickness: list, windowThickness: list, windowCapThickness: list
# ---------- system_curtainwall: Python ----------
# SkinDesigner: A Plugin for Building Skin Design (GPL) started by Santiago Garay

# This file is part of SkinDesigner.
# 
# Copyright (c) 2017, Santiago Garay <sgaray1970@gmail.com> 
# SkinDesigner is free software; you can redistribute it and/or modify 
# it under the terms of the GNU General Public License as published 
# by the Free Software Foundation; either version 3 of the License, 
# or (at your option) any later version. 
# 
# SkinDesigner is distributed in the hope that it will be useful,
# but WITHOUT ANY WARRANTY; without even the implied warranty of 
# MERCHANTABILITY or FITNESS FOR A PARTICULAR PURPOSE. See the 
# GNU General Public License for more details.
# 
# You should have received a copy of the GNU General Public License
# along with SkinDesigner; If not, see <http://www.gnu.org/licenses/>.
# 
# @license GPL-3.0+ <http://spdx.org/licenses/GPL-3.0+>
# SkinDesigner_System-CurtainWall
"""
Use this component to generate a curtain-wall system to be added to a Panel component.
Note mullion thickness inputs accept floating point values or lists of three values to specify each mullion segment independently(left or below window, at window, above or right of window).

    Args:
        width: A floating point value that indicates in scene units the width of all panel and window mullions. Default value is 0.05m (2 inches)
        thickness: A floating point value that indicates in scene units the thickness of all panel and window mullions. Default value is 0.1m (4 inches)
        Alternatively a list of three floating point values can be indicated to specify mullion properties at each of the three mullion pieces(below/left of window, at window, above/right of window)
        capThickness: A floating point value that indicates in scene units the cap thickness of all panel and window mullions. Default value is 0.25m (1 inch).
        Alternatively a list of three floating point values can be indicated to specify mullion properties at each of the three mullion pieces(below/left of window, at window, above/right of window)
        windowThickness: A floating point value that indicates in scene units the thickness of window mullions. Overrides overal 'thickness' parameter Default value uses 'thickness' value specified.
        Alternatively a list of three floating point values can be indicated to specify mullion propertys at each of the three mullion pieces(below/left of window, at window, above/right of window)
        windowCapThickness: A floating point value that indicates in scene units the cap thickness of all window mullions. Overrides overal 'capThickness' parameter. Default value uses 'capThickness' value specified.
        Alternatively a list of three floating point values can be indicated to specify mullion propertys at each of the three mullion pieces(below/left of window, at window, above/right of window)
        panelThickness_H: A floating point value that indicates in scene units the thickness of horizontal panel mullions only. Overrides overal 'thickness' parameter. Default value uses 'thickness' value specified.
        Alternatively a list of three floating point values can be indicated to specify mullion propertys at each of the three mullion pieces(below/left of window, at window, above/right of window)
        panelCapThickness_H: A floating point value that indicates in scene units the cap thickness of horizontal panel mullion caps only. Overrides overal 'capThickness' parameter. Default value uses 'capThickness' value specified.
        Alternatively a list of three floating point values can be indicated to specify mullion propertys at each of the three mullion pieces(below/left of window, at window, above/right of window)
        panelThickness_V: A floating point value that indicates in scene units the thickness of vertical panel mullions only. Overrides overal 'thickness' parameter. Default value uses 'thickness' value specified.
        Alternatively a list of three floating point values can be indicated to specify mullion propertys at each of the three mullion pieces(below/left of window, at window, above/right of window)
        panelCapThickness_V: A floating point value that indicates in scene units the cap thickness of vertical panel mullion caps only. Overrides overal 'capThickness' parameter. Default value uses 'capThickness' value specified.
        Alternatively a list of three floating point values can be indicated to specify mullion propertys at each of the three mullion pieces(below/left of window, at window, above/right of window)
        windowThickness_H: A floating point value that indicates in scene units the thickness of horizontal window mullions only. Overrides overal 'thickness' and 'windowThickness' parameters. Default value uses 'thickness' or 'windowThickness' value specified.
        Alternatively a list of three floating point values can be indicated to specify mullion propertys at each of the three mullion pieces(below/left of window, at window, above/right of window)
        windowCapThickness_H: A floating point value that indicates in scene units the cap thickness of horizontal window mullion caps only. Overrides overal 'capThickness' and 'windowCapThickness' parameters. Default value uses 'capThickness' or 'windowCapThickness' value specified.
        Alternatively a list of three floating point values can be indicated to specify mullion propertys at each of the three mullion pieces(below/left of window, at window, above/right of window)
        windowThickness_V: A floating point value that indicates in scene units the thickness of vertical window mullions only. Overrides overal 'thickness' and 'windowThickness' parameters. Default value uses 'thickness' or 'windowThickness' value specified.
        Alternatively a list of three floating point values can be indicated to specify mullion propertys at each of the three mullion pieces(below/left of window, at window, above/right of window)
        windowCapThickness_V: A floating point value that indicates in scene units the cap thickness of vertical window mullion caps only. Overrides overal 'capThickness' and 'windowCapThickness' parameters. Default value uses 'capThickness' or 'windowCapThickness' value specified.
        Alternatively a list of three floating point values can be indicated to specify mullion propertys at each of the three mullion pieces(below/left of window, at window, above/right of window)


    Returns:
        panelSystem: A list with curtain-wall data packed to be connected to a Panel component panelSystem input

"""

ghenv.Component.Name = "SkinDesigner_System-CurtainWall"
ghenv.Component.NickName = 'System-CurtainWall'
ghenv.Component.Message = 'VER 0.5.00\nJul_18_2018'
ghenv.Component.Category = "SkinDesigner"
ghenv.Component.SubCategory = "02 | Parameters"
try: ghenv.Component.AdditionalHelpFromDocStrings = "2"
except: pass

import Grasshopper.Kernel as gh
import GhPython
# automnatically set the right input names and types (when using + icon) 
numInputs = ghenv.Component.Params.Input.Count
accessList = ghenv.Component.Params.Input[0].Access.list
accessItem = ghenv.Component.Params.Input[0].Access.item
typeFloat = GhPython.Component.NewFloatHint()

inputNames = ['-----global mullion data---','width','thickness','capThickness','windowThickness','windowCapThickness', '-----panel mllion data-----', 'panelThickness_H','panelCapThickness_H',\
    'panelThickness_V', 'panelCapThickness_V', '-----window mullion data---', 'windowThickness_H', 'windowCapThickness_H','windowThickness_V','windowCapThickness_V']
    
for input in range(numInputs):
    if input >= len(inputNames): continue
    ghenv.Component.Params.Input[input].NickName = inputNames[input]
    ghenv.Component.Params.Input[input].Name = inputNames[input]
    ghenv.Component.Params.Input[input].Access = accessList
    ghenv.Component.Params.Input[input].TypeHint = typeFloat

warningData=[]
#tranform inputs with one element lists to a single floating point value.
for num in range(numInputs) :
    inputData = ghenv.Component.Params.Input[num]
    if inputData.VolatileData.DataCount == 0: continue
    if inputData.VolatileData.DataCount == 1:
        value = inputData.VolatileData[0][0]
        inputString = inputData.Name + "=" + str(value)
        try:
            codeObj= compile(inputString,'<string>','single')
            eval(codeObj)
        except: warningData.append("Invalid input "+ inputString)

# reset deleted inputs. They keep last data otherwise.
for num in range(16-numInputs) :
    inputString = inputNames[15-num]
    if '-----' in inputString: continue
    inputString += '=[]'
    codeObj= compile(inputString,'<string>','single')
    eval(codeObj)
    
    
ghenv.Component.Attributes.Owner.OnPingDocument()        
    

import scriptcontext as sc
import Rhino


#init set up global variables
_UNIT_COEF = 1
sc.doc = Rhino.RhinoDoc.ActiveDoc
unitSystem = sc.doc.ModelUnitSystem
if unitSystem == Rhino.UnitSystem.Feet: _UNIT_COEF = 3.28084
if unitSystem == Rhino.UnitSystem.Inches: _UNIT_COEF = 3.28084*12
if unitSystem == Rhino.UnitSystem.Millimeters: _UNIT_COEF = 1000
sc.doc = ghdoc


# WindowData(wd) = 0=width,1=height,2=fromLeft,3=fromBottom,4=recess

if width == [] : width = .05*_UNIT_COEF
if thickness == [] : thickness = 0.1* _UNIT_COEF
if windowThickness == [] : windowThickness = thickness
if capThickness == [] : capThickness = 0.025*_UNIT_COEF
if windowCapThickness == [] : windowCapThickness = capThickness

if panelThickness_H == [] : panelThickness_H = thickness
if panelThickness_V == [] : panelThickness_V = thickness
if panelCapThickness_H == [] : panelCapThickness_H = capThickness
if panelCapThickness_V == [] : panelCapThickness_V = capThickness
    

if windowThickness_H == [] : windowThickness_H = windowThickness
if windowThickness_V == [] : windowThickness_V = windowThickness
if windowCapThickness_H == [] : windowCapThickness_H = windowCapThickness
if windowCapThickness_V == [] : windowCapThickness_V = windowCapThickness

panelSystem = [0,0,0,0]

PanelActions = "AddPane('_P_Glass_SP',thickness="+str(0.02*_UNIT_COEF)+", offset="+str(0.02*_UNIT_COEF)+", offsetEdge="+str(0.02*_UNIT_COEF)+")\r\n"
MullionActions = ""
WindowMullionActions = "" #WindowMullionActions = "ShowWall()\r\n"

for mullionType in ['PanelLeft', 'PanelRight','PanelTop','PanelBottom','WindowBottom','WindowTop','WindowLeft', 'WindowRight'] :
    
    if mullionType in ['PanelBottom', 'PanelTop'] :
        if panelThickness_H: thickness  = panelThickness_H
        else :continue
        capThickness = panelCapThickness_H
    if mullionType in ['PanelLeft', 'PanelRight'] :
        if panelThickness_V: thickness = panelThickness_V
        else :continue
        capThickness = panelCapThickness_V
    if mullionType in ['PanelLeft', 'PanelRight','PanelTop','PanelBottom'] :
        MullionActions += "AddMullionType('"+ mullionType+"', width="+ str(width)+", thickness=" + str(thickness)+", capThickness=" + str(capThickness)+")\r\n"

    if mullionType in ['WindowBottom','WindowTop'] :
        if windowThickness_H : windowThickness = windowThickness_H
        else : continue
        windowCapThickness = windowCapThickness_H
    if mullionType in ['WindowLeft', 'WindowRight'] :
        if windowThickness_V : windowThickness = windowThickness_V
        else : continue
        windowCapThickness = windowCapThickness_V
        
    if mullionType in ['WindowLeft', 'WindowRight','WindowBottom','WindowTop'] :
        WindowMullionActions += "AddMullionType('"+ mullionType+"', width="+ str(width)+", thickness=" + str(windowThickness)+", capThickness=" + str(windowCapThickness)+")\r\n"




if warningData <> []: 
    for warning in warningData: ghenv.Component.AddRuntimeMessage(gh.GH_RuntimeMessageLevel.Warning, str(warning))
else:
    panelSystem = ["CurtainWall" , PanelActions , MullionActions, WindowMullionActions]

#print panelSystem
 
#thickness= thicknessA = thicknessC="max(thickness, wd[4]*-1)" # use wall thickness or glass recess on punched window
#MullionData = "AddWindowMullions(width="+ str(width)+", thickness=[" + str(thicknessA)+","+ str(thickness)+","+ str(thicknessC)+\
#    "], capThickness=[0,0.05,0])\r\n"


print "Done"
# ---------- end system_curtainwall ----------
system_wall = SkinDesigner_SystemWall()  # -> panelSystem
# ---------- system_wall: Python ----------
# SkinDesigner: A Plugin for Building Skin Design (GPL) started by Santiago Garay

# This file is part of SkinDesigner.
# 
# Copyright (c) 2017, Santiago Garay <sgaray1970@gmail.com> 
# SkinDesigner is free software; you can redistribute it and/or modify 
# it under the terms of the GNU General Public License as published 
# by the Free Software Foundation; either version 3 of the License, 
# or (at your option) any later version. 
# 
# SkinDesigner is distributed in the hope that it will be useful,
# but WITHOUT ANY WARRANTY; without even the implied warranty of 
# MERCHANTABILITY or FITNESS FOR A PARTICULAR PURPOSE. See the 
# GNU General Public License for more details.
# 
# You should have received a copy of the GNU General Public License
# along with SkinDesigner; If not, see <http://www.gnu.org/licenses/>.
# 
# @license GPL-3.0+ <http://spdx.org/licenses/GPL-3.0+>
# System_Wall
"""
Use this component to generate a Wall system to be added to a Panel component.

    Args:
        windowFrameWidth: A floating point value that indicates in scene units the width of the window frame. Default value is 0.025m (1 inch)
        windowFrameThickness: A floating point value that indicates in scene units the thickness of the window frame. Panel property 'PanelThickness' is valid. Default value depends on the glass pane placement.
        windowFrameLoc: A floating point value that indicates in scene units the location of the window frame. Positive values shift the frame inbound to the panel while negative values shift the frame outboud. Note the shifting is constrained to keep attachment to both the wall and the glass pane. Panel property 'PanelThickness' is valid. Default value is 0.0.
        tileWidth: A floating point value that indicates in scene units the horizontal dimension of the tile. Panel properties 'PanelWidth' and 'PanelHeight' are also valid. Default value is 0.0.
        tileHeight: A floating point value that indicates in scene units the vertical dimension of the tile. Panel properties 'PanelWidth' and 'PanelHeight' are also valid. Default value is 0.0.
        tileThickness: A floating point value that indicates in scene units the thickness of the tile. Panel properties 'PanelWidth' and 'PanelHeight' are valid. Default value is 0.025m (1 inch) if tileWidth and tileThickness are specified, otherwise is 0.00.
        tileJoint: A floating point value that indicates in scene units the joint dimension between tiles.  Default value is 0.025m (1 inch) if tileWidth and tileThickness are specified, otherwise is 0.00.
        tileEdgeOffset: A floating point value that indicates in scene units the dimentsion of  the joint around the panel edges.  Default value is tileJoint/2 if tileJoint is greater than 0.0, otherwise is 0.0.
    Returns:
        panelSystem: A list with the wall system data packed to be connected to a Panel component panelSystem input


"""


ghenv.Component.Name = "SkinDesigner_System-Wall"
ghenv.Component.NickName = 'System-Wall'
ghenv.Component.Message = 'VER 0.5.00\nJul_18_2018'
ghenv.Component.Category = "SkinDesigner"
ghenv.Component.SubCategory = "02 | Parameters"
try: ghenv.Component.AdditionalHelpFromDocStrings = "2"
except: pass


import GhPython
# automnatically set the right input names and types (when using + icon) 
numInputs = ghenv.Component.Params.Input.Count
accessList = ghenv.Component.Params.Input[0].Access.list
accessItem = ghenv.Component.Params.Input[0].Access.item
typeFloat = GhPython.Component.NewFloatHint()

for input in range(numInputs):
    access = accessList
    typeHint = None
    if input == 0: inputName = 'windowFrameWidth' ; access = accessItem; typeHint = typeFloat
    elif input == 1: inputName = 'windowFrameThickness' ; access = accessItem; typeHint = typeFloat
    elif input == 2: inputName = 'windowFrameLoc' ; access = accessItem; typeHint = typeFloat
    elif input == 3: inputName = 'tileWidth' ; access = accessItem
    elif input == 4: inputName = 'tileHeight'; access = accessItem
    elif input == 5: inputName = 'tileThickness' ; access = accessItem; typeHint = typeFloat
    elif input == 6: inputName = 'tileJoint'; access = accessItem; typeHint = typeFloat
    elif input == 7: inputName = 'tileEdgeOffset'; access = accessItem; typeHint = typeFloat
    else: continue
    
    ghenv.Component.Params.Input[input].NickName = inputName
    ghenv.Component.Params.Input[input].Name = inputName
    ghenv.Component.Params.Input[input].Access = access
    if typeHint: ghenv.Component.Params.Input[input].TypeHint = typeHint
    
ghenv.Component.Attributes.Owner.OnPingDocument()

import scriptcontext as sc
import Rhino
from types import *

#init set up global variables
_UNIT_COEF = 1
sc.doc = Rhino.RhinoDoc.ActiveDoc
unitSystem = sc.doc.ModelUnitSystem
if unitSystem == Rhino.UnitSystem.Feet: _UNIT_COEF = 3.28084
if unitSystem == Rhino.UnitSystem.Inches: _UNIT_COEF = 3.28084*12
if unitSystem == Rhino.UnitSystem.Millimeters: _UNIT_COEF = 1000
sc.doc = ghdoc


# WindowData(wd) = 0=width,1=height,2=fromLeft,3=fromBottom,4=recess
if  numInputs > 3:
    if tileWidth == None or tileHeight == None: tileWidth = tileHeight = 0
else: tileWidth = tileHeight = 0
    
if  numInputs > 4:
    if type(tileThickness) == StringType : tileThickness = eval(tileThickness)
    elif tileThickness == None: tileThickness = .025*_UNIT_COEF if tileWidth > 0 else  0
else: tileThickness = .025*_UNIT_COEF if tileWidth > 0 else  0

if  numInputs > 5:
    if type(tileJoint) == StringType : tileJoint = eval(tileJoint)
    elif tileJoint == None : tileJoint = .025*_UNIT_COEF if tileWidth > 0 else  0
else: tileJoint = .025*_UNIT_COEF if tileWidth > 0 else  0

if  numInputs > 6:
    if type(tileEdgeOffset) == StringType : tileEdgeOffset = eval(tileEdgeOffset)
    if tileEdgeOffset == None : tileEdgeOffset = tileJoint/2
else: tileEdgeOffset = tileJoint/2


panelSystem= [0,0,0,0]
paneName="_P_Clad"
paneThickness = .01*_UNIT_COEF #standard pane thickness (not relevant)
PanelActions = "AddPane('"+ paneName + "', thickness="+str(paneThickness)+", offset="+str(paneThickness)+", offsetEdge="+str(tileEdgeOffset)+\
    ", tileWidth="+str(tileWidth)+", tileHeight="+str(tileHeight)+", tileThickness="+str(tileThickness)+", tileGap="+str(tileJoint)+")\r\n"


if windowFrameThickness == None: windowFrameThickness = "max(PanelThickness+0.02*_UNIT_COEF+"+str(paneThickness+tileThickness)+", abs(eval(str(Window['recess']))) + 0.05*_UNIT_COEF + "+str(paneThickness+tileThickness)+")"
if windowFrameWidth == None: windowFrameWidth = .025*_UNIT_COEF
if windowFrameLoc == None: windowFrameLoc = "0"

MullionActions = ""
WindowMullionActions = ""

windowFrameInThickness = "min(max(0.02*_UNIT_COEF,"+"eval(str(Window['recess']))+PanelThickness-0.01*_UNIT_COEF)+"+str(windowFrameLoc)+","+str(windowFrameThickness)+"+0.02*_UNIT_COEF)"
windowFrameOutThickness = "min(max("+str(windowFrameThickness) + "-(" + windowFrameInThickness + "),.02*_UNIT_COEF),"+str(windowFrameThickness)+")"

for mullionType in ['WindowBottom','WindowTop','WindowLeft', 'WindowRight'] :
    WindowMullionActions += "AddMullionType('"+ mullionType+"', width="+ str(windowFrameWidth)+", thickness=[" + \
    str(windowFrameInThickness)+"], capThickness=[" + str(windowFrameOutThickness)+"])\r\n"


panelSystem = ["WallSystem" , PanelActions , MullionActions, WindowMullionActions]
# ---------- end system_wall ----------

# ----
# Window Systems
number_slider_2 = Slider(6.6, range=0.5..15)
# PARAMETRIC PANEL & ARCHITECTURAL ELEMENTS
# (scene units should be set in feet)
number_slider_3 = Slider(3.8, range=0.5..15)
number_slider_4 = Slider(1.2, range=0..8)
# Window
window = SkinDesigner_Window(width=number_slider_3, height=number_slider_2, recess=Slider(2.9, range=0..8))  # -> windowSystem
# ---------- window: Python ----------
# SkinDesigner: A Plugin for Building Skin Design (GPL) started by Santiago Garay

# This file is part of SkinDesigner.
# 
# Copyright (c) 2017, Santiago Garay <sgaray1970@gmail.com> 
# SkinDesigner is free software; you can redistribute it and/or modify 
# it under the terms of the GNU General Public License as published 
# by the Free Software Foundation; either version 3 of the License, 
# or (at your option) any later version. 
# 
# SkinDesigner is distributed in the hope that it will be useful,
# but WITHOUT ANY WARRANTY; without even the implied warranty of 
# MERCHANTABILITY or FITNESS FOR A PARTICULAR PURPOSE. See the 
# GNU General Public License for more details.
# 
# You should have received a copy of the GNU General Public License
# along with SkinDesigner; If not, see <http://www.gnu.org/licenses/>.
# 
# @license GPL-3.0+ <http://spdx.org/licenses/GPL-3.0+>
# Window
"""
Use this component to generate a window to be input to a Panel component.
-
Refer to PanelLib API for Definition input functions
    Args:
        width: A floating point number representing the window opening width in scene units. Panel properties 'PanelWidth' and 'PanelHeights' are valid. Default value is 'PanelWidth/2'.
        height: A floating point number representing the window opening height in scene units. Panel properties 'PanelWidth' and 'PanelThickness' are valid. Default value is 'PanelHeight/2'.
        fromLeft: A floating point value indicating in scene units the horizontal placement of the window from the left edge of the panel. Panel properties 'PanelWidth',  'PanelHeight' and 'C'(centered on panel) are valid. Default value is 'C'.
        fromBottom: A floating point value indicating in scene units the vertical placement of the window from the bottom edge of the panel. Panel properties 'PanelWidth', 'PanelHeight' and 'C'(centered on panel) are valid. Default value is 'C'.
        recess : A floating point value indicating in scene units the location of the glass pane relative to the front face of the wall element. Positive values place the glass pane inbound from the wall surface, negative values project the glass pane outbound. Default value is 0.0.
        conformSurfPanel : A boolean indicating if window conforms to the shape of a surface (for Surface Panel Mode' only). default is False.
    Returns:
        windowSystem: A list with window data formatted to be connected to a Panel component windowSystem input

"""


ghenv.Component.Name = "SkinDesigner_Window"
ghenv.Component.NickName = 'Window'
ghenv.Component.Message = 'VER 0.5.00\nJul_18_2018'
ghenv.Component.Category = "SkinDesigner"
ghenv.Component.SubCategory = "02 | Parameters"
try: ghenv.Component.AdditionalHelpFromDocStrings = "1"
except: pass



#import rhinoscriptsyntax as rs
#import Rhino
#import Panel14 as PanelLib
#import scriptcontext as sc

wWidth = "PanelWidth/2"
wHeight = "PanelHeight/2"
wFromLeft = "C"
wFromBottom = "C"
wRecess = 0.0
wConformSurface = False

if width<>None : wWidth = width
if height <> None : wHeight = height
if fromLeft <> None : wFromLeft = fromLeft
if fromBottom <> None : wFromBottom = fromBottom
if recess <> None : wRecess = -recess
if conformSurfPanel <> None : wConformSurface = conformSurfPanel

windowSystem = [wWidth,wHeight, wFromLeft, wFromBottom, wRecess, wConformSurface]
# ---------- end window ----------

unit_y = UnitY(Factor=1)

# ----
# Geometry
# Custom Systems
number_slider_5 = Slider(0.5, range=-2..2)
customgeometry = _CustomGeometry(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)
vec = VectorXYZ(XComponent=number_slider_5, YComponent=number_slider_5, ZComponent=number_slider_5)  # -> Vector, Length
customgeometry_2 = SkinDesigner_CustomGeometry(
    geometry=flatten(customgeometry),
    upAxisVector=unit_y,
    scaleVector=vec.Vector,
    rotation=Slider(-35, range=-90..90),
    tilable=Toggle(True),
    trimToPanelSize=Toggle(True),
    windowVoidDepth=Toggle(True))  # -> customSystem; inputs geometry: list, upAxisVector: Vector3d, placementVector: Vector3d, scaleVector: Vector3d, tilable: Boolean, trimToPanelSize: Boolean
# ---------- customgeometry_2: Python ----------
# SkinDesigner: A Plugin for Building Skin Design (GPL) started by Santiago Garay

# This file is part of SkinDesigner.
# 
# Copyright (c) 2017, Santiago Garay <sgaray1970@gmail.com> 
# SkinDesigner is free software; you can redistribute it and/or modify 
# it under the terms of the GNU General Public License as published 
# by the Free Software Foundation; either version 3 of the License, 
# or (at your option) any later version. 
# 
# SkinDesigner is distributed in the hope that it will be useful,
# but WITHOUT ANY WARRANTY; without even the implied warranty of 
# MERCHANTABILITY or FITNESS FOR A PARTICULAR PURPOSE. See the 
# GNU General Public License for more details.
# 
# You should have received a copy of the GNU General Public License
# along with SkinDesigner; If not, see <http://www.gnu.org/licenses/>.
# 
# @license GPL-3.0+ <http://spdx.org/licenses/GPL-3.0+>
# Custom Geometry 
"""
Use this component to generate a custom geometry system to plug in Panel component.
-
    Args:
        _geometry: A list of Breps or a dynamicGeometry object output from a DynamicGeometry component used as the base geometry to be placed on the panel.
        upAxisVector: A unitized vector with a 1 value on the (X, Y or Z)component indicating the Z axis(up) for the geometry placement. Default is Z (0,0,1) 
        placementVector: A vector that specifies the placement (X, Y, Z) of the geometry in the panel. Origin is at lower left corner.
        scaleVector: A vector that specifies the scale factors (X, Y, Z) of the geomtry in the panel. Scale origin is at lower left corner of the panel.
        rotation: A floating point number that specifies the rotation of the geometry. Rotation origin is at lower left corner of the panel.
        tilable: A boolean turning on/off tiling of the geometry until it covers entire panel.
        trimToPanelSize: A boolean that turns on/off trimminig of the geomtry outsuide the panel extension.
        windowVoidDepth: A floating point number that reperesetns the depth of the subsdtracting volume in front of the window area.
        
    Returns:
        customSystem: A list with data custom geometry packed to be connected to a Panel component customSystem input

"""

ghenv.Component.Name = "SkinDesigner_CustomGeometry"
ghenv.Component.NickName = 'CustomGeometry'
ghenv.Component.Message = 'VER 0.5.00\nJul_18_2018'
ghenv.Component.Category = "SkinDesigner"
ghenv.Component.SubCategory = "02 | Parameters"
try: ghenv.Component.AdditionalHelpFromDocStrings = "4"
except: pass

import Grasshopper.Kernel as gh
import GhPython

# automnatically set the right input names and types (when using + icon) 
numInputs = ghenv.Component.Params.Input.Count
accessList = ghenv.Component.Params.Input[0].Access.list
accessItem = ghenv.Component.Params.Input[0].Access.item
typeFloat = GhPython.Component.NewFloatHint()
typeVector3d = gh.Parameters.Hints.GH_Vector3dHint()
typeGHDoc = GhPython.Component.GhDocGuidHint()
typeBool = gh.Parameters.Hints.GH_BooleanHint_CS()
typeNull = gh.Parameters.Hints.GH_NullHint()

for input in range(numInputs):
    access = accessList
    typeHint = None
    if input == 0: inputName = '_geometry' ; access = accessList; typeHint = typeNull
    elif input == 1: inputName = 'upAxisVector' ; access = accessItem; typeHint = typeVector3d
    elif input == 2: inputName = 'placementVector' ; access = accessItem; typeHint = typeVector3d
    elif input == 3: inputName = 'scaleVector' ; access = accessItem; typeHint = typeVector3d
    elif input == 4: inputName = 'rotation' ; access = accessItem; typeHint = typeFloat
    elif input == 5: inputName = 'tilable'; access = accessItem; typeHint = typeBool 
    elif input == 6: inputName = 'trimToPanelSize'; access = accessItem; typeHint = typeBool 
    elif input == 7: inputName = 'windowVoidDepth'; access = accessItem; typeHint = typeFloat
    else: continue
    
    ghenv.Component.Params.Input[input].NickName = inputName
    ghenv.Component.Params.Input[input].Name = inputName
    ghenv.Component.Params.Input[input].Access = access
    if typeHint: ghenv.Component.Params.Input[input].TypeHint = typeHint
    
ghenv.Component.Attributes.Owner.OnPingDocument()

import scriptcontext as sc
import Rhino as rc
import rhinoscriptsyntax as rs
from types import *

#init set up global variables
_UNIT_COEF = 1
sc.doc = rc.RhinoDoc.ActiveDoc
unitSystem = sc.doc.ModelUnitSystem
if unitSystem == rc.UnitSystem.Feet: _UNIT_COEF = 3.28084
if unitSystem == rc.UnitSystem.Inches: _UNIT_COEF = 3.28084*12
if unitSystem == rc.UnitSystem.Millimeters: _UNIT_COEF = 1000
sc.doc = ghdoc

newCustomGeometry = None
vecUpAxis = rc.Geometry.Vector3d(0,0,1)
vecPlacement = rc.Geometry.Vector3d(0,0,0)
vecScaleFactor = rc.Geometry.Vector3d(1,1,1) #(non uniform scale can throw error someimtes(ex.cirles))
rotationZ = 0
isTilable = False
isTrimmed = False
dblWindowVoidDepth = 0
customSystem = None

#check for object type : Brep or dynamicGeometry instance
if _geometry and _geometry[0]:
    if type(_geometry[0]) == rc.Geometry.Brep :
        newCustomGeometry = _geometry
    elif str(type(_geometry[0])) == "<type 'instance'>" : 
        newCustomGeometry = _geometry[0]
    
    if numInputs > 1 and upAxisVector <> None: vecUpAxis = rs.coerce3dvector(upAxisVector)
    if numInputs > 2 and placementVector <> None: vecPlacement = rs.coerce3dvector(placementVector)
    if numInputs > 3 and scaleVector <> None: vecScaleFactor = rs.coerce3dvector(scaleVector)
    if numInputs > 4 and rotation <> None : rotationZ = eval(str(rotation))
    if numInputs > 5 and tilable <> None : isTilable = tilable
    if numInputs > 6 and trimToPanelSize <> None : isTrimmed = trimToPanelSize
    if numInputs > 7 and windowVoidDepth <> None: dblWindowVoidDepth = windowVoidDepth
        
    customSystem = [newCustomGeometry, vecPlacement, vecScaleFactor, vecUpAxis, isTilable, rotationZ, dblWindowVoidDepth, isTrimmed]
else:
    ghenv.Component.AddRuntimeMessage(gh.GH_RuntimeMessageLevel.Warning, "Missing '_geoemtry' input")
print "Done"
# ---------- end customgeometry_2 ----------

# ----
# Panel
custom_system = Data()
window_system = Data()
shading_system = Data(shadinglouver)
panel_system = Data()
systemspanel = SkinDesigner_SystemsPanel(
    name="Panel-A",
    activate=Toggle(True),
    width=Slider(5.8, range=0.5..15),
    height=Slider(11.3, range=0.5..15),
    thickness=".3",
    panelSystem=panel_system,
    windowSystem=window_system,
    shadingSystems=shading_system,
    customSystem=custom_system)  # -> out, flatten(panel), panelDefinition; inputs activate: Boolean, definitions: list, panelSystem: list, windowSystem: list, shadingSystems: list, customSystem: list
# ---------- systemspanel: Python ----------
# SkinDesigner: A Plugin for Building Skin Design (GPL) started by Santiago Garay

# This file is part of SkinDesigner.
# 
# Copyright (c) 2017, Santiago Garay <sgaray1970@gmail.com> 
# SkinDesigner is free software; you can redistribute it and/or modify 
# it under the terms of the GNU General Public License as published 
# by the Free Software Foundation; either version 3 of the License, 
# or (at your option) any later version. 
# 
# SkinDesigner is distributed in the hope that it will be useful,
# but WITHOUT ANY WARRANTY; without even the implied warranty of 
# MERCHANTABILITY or FITNESS FOR A PARTICULAR PURPOSE. See the 
# GNU General Public License for more details.
# 
# You should have received a copy of the GNU General Public License
# along with SkinDesigner; If not, see <http://www.gnu.org/licenses/>.
# 
# @license GPL-3.0+ <http://spdx.org/licenses/GPL-3.0+>

#Panel
"""
Use this component to generate a panel type to be used by the SkinGenerator component to generate a panelized skin.

    Args:
        name: A string that represents the panel ID. By defualt it uses de component guid (not recommended).
        activate: A boolean that turns the panel on/off. Default is off.        
        definitions: A string with panel functions to be executed on this panel (only for advanced use, refer to Panel API)        
        width: A float number specifying the panel width in scene units
        height: A float number specifying the panel height in scene units
        thickness: A float number specifying the panel wall object thickness in scene units
        panelSystem: A list with data generated by panel system-type components: CurtainWall, Wall, etc.
        windowSystem:  A list with data generated by Window component
        shadingSystems: lists with data generated by shading-type components: Shade, LouverShading, ShadingBox
        customSystem: A list with data generated by a CustomGeometry component 


    Returns:
        panel: A Panel object that represents a Panel data structure to be used as input on Panel_Bay, Skin_Generator or Panel Viewer components
        panelDefinition: A string representing the panel properties as panel functions (refer to Panel API). 
            It can be saved for reference or be used as input on another panel component (as a live reference for instance)
            
"""

ghenv.Component.Name = "SkinDesigner_SystemsPanel"
ghenv.Component.NickName = 'SystemsPanel'
ghenv.Component.Message = 'VER 0.5.00\nSep_13_2018'
ghenv.Component.Category = "SkinDesigner"
ghenv.Component.SubCategory = "01 | Construction"
try: ghenv.Component.AdditionalHelpFromDocStrings = "2"
except: pass

import Grasshopper.Kernel as gh
import GhPython
# automnatically set the right input names and types (when using + icon) 
numInputs = ghenv.Component.Params.Input.Count
accessList = ghenv.Component.Params.Input[0].Access.list
accessItem = ghenv.Component.Params.Input[0].Access.item

typeFloat = GhPython.Component.NewFloatHint()
typeString = GhPython.Component.NewStrHint()
typeNone =  GhPython.Component.NoChangeHint()
typeGHDoc = GhPython.Component.GhDocGuidHint()
typeBool = gh.Parameters.Hints.GH_BooleanHint_CS()
for input in range(numInputs):
    access = accessList ; typeHint = typeString
    if input == 0: inputName = 'name' ; access = accessItem
    elif input == 1: inputName = 'activate'; access = accessItem; typeHint = typeBool   
    elif input == 2: inputName = 'definitions' ; access = accessList; typeHint = typeGHDoc
    elif input == 3: inputName = 'width' ; access = accessItem ; typeHint = typeFloat
    elif input == 4: inputName = 'height' ; access = accessItem ; typeHint = typeFloat
    elif input == 5: inputName = 'thickness'; access = accessItem ; typeHint = typeFloat
    elif input == 6: inputName = 'panelSystem' ; access = accessList; typeHint = typeGHDoc
    elif input == 7: inputName = 'windowSystem' ; access = accessList; typeHint = typeGHDoc
    elif input == 8: inputName = 'shadingSystems' ; access = accessList; typeHint = typeGHDoc
    elif input == 9: inputName = 'customSystem'; access = accessList; typeHint = typeNone 
    else: continue
    
    ghenv.Component.Params.Input[input].NickName = inputName
    ghenv.Component.Params.Input[input].Name = inputName
    ghenv.Component.Params.Input[input].Access = access
    ghenv.Component.Params.Input[input].TypeHint = typeHint
    ghenv.Component.Attributes.Owner.OnPingDocument()



import rhinoscriptsyntax as rs
import Rhino
import scriptcontext as sc
import copy
from types import *


    
#init set up global variables

sc.doc = Rhino.RhinoDoc.ActiveDoc
unitSystem = sc.doc.ModelUnitSystem
_UNIT_COEF = 1
if unitSystem == Rhino.UnitSystem.Feet: _UNIT_COEF = 3.28084
if unitSystem == Rhino.UnitSystem.Inches: _UNIT_COEF = 3.28084*12
if unitSystem == Rhino.UnitSystem.Millimeters: _UNIT_COEF = 1000
sc.doc = ghdoc

panel = None
panelDefinition = ""
warningData = []
panelWarningData = []

try:
    SGLibPanel = sc.sticky["SGLib_Panel"]
    SGLibSystemsPanelController = sc.sticky["SGLib_SystemsPanelController"]
except:
    ghenv.Component.AddRuntimeMessage(gh.GH_RuntimeMessageLevel.Warning, "I need SkinDesigner_SkinDesigner component")
    
    
#SKIN GRID GENERATION BASED ON PANEL SIZE
#------------------------------------------------------------------------------
def PanelCreate():

    #initialize
    sc.doc = Rhino.RhinoDoc.ActiveDoc
    rs.EnableRedraw(False)
    global warningData
    
    #Create Skin Panel Matrix
    #Panel dimensions (Units feet or meters)
    
    #--------------------------------------------------------------------
    # PANEL INIT SECTION

    myBasePanel = SGLibPanel()
    panelDefinition = [""]
    tmpDefinition = ["", None, None, None, None, None]
    
    # run size panel properties if avialable
    if numInputs > 2 and definitions and definitions[0] :
        if len(definitions) == 1: 
            tmpDefinition = ["", None, None, None, None, definitions[0]]
        else :
            tmpDefinition = definitions
            runOK = runActions(tmpDefinition[0], myBasePanel)
            if not runOK: warningData.append("Invalid 'definitions' input (panel size data) - data discarded")
            panelDefinition[0] = tmpDefinition[0] 

    #set panel properties from inputs and update Panel Defintion
    if  numInputs > 3 and width:
        try: myBasePanel.SetWidth(width)
        except: warningData.append("Invalid 'width' input - using default value")
        panelDefinition[0] = updateProperty(panelDefinition[0], "Width", myBasePanel.GetPanelProperty("PanelWidth"))
    if numInputs > 4 and height:
        try: myBasePanel.SetHeight(height)
        except: warningData.append("Invalid 'height' input - using default value")
        panelDefinition[0] = updateProperty(panelDefinition[0], "Height", myBasePanel.GetPanelProperty("PanelHeight"))
    if numInputs > 5 and thickness:
        try: myBasePanel.SetThickness(thickness)
        except: warningData.append("Invalid 'thickness' input - using default value")
        panelDefinition[0] = updateProperty(panelDefinition[0], "Thickness", myBasePanel.GetPanelProperty("PanelThickness"))
        
    #set predifined variables:
    PanelName = str(ghenv.Component.InstanceGuid).rsplit("-",1)[1]

    if name <> None: PanelName = name
    myBasePanel.SetName(PanelName) 
    
    PanelHeight = myBasePanel.GetPanelProperty("PanelHeight")
    PanelWidth = myBasePanel.GetPanelProperty("PanelWidth")
    PanelThickness = myBasePanel.GetPanelProperty("PanelThickness")
    
    #----------Create Window -----------------------------------------    
    tmpWindowSystem = None ; Window = None
    if numInputs > 2 and len(tmpDefinition)>1 and tmpDefinition[1] : tmpWindowSystem = tmpDefinition[1]
    if numInputs > 7 and windowSystem : tmpWindowSystem = windowSystem
    if tmpWindowSystem : 
        try:
            Window = dict(width=tmpWindowSystem[0], height=tmpWindowSystem[1], fromLeft=tmpWindowSystem[2], \
                fromBottom=tmpWindowSystem[3], recess=tmpWindowSystem[4])
            windowDef = "AddWindow(width=Window['width'], height=Window['height'], fromLeft=Window['fromLeft'],"+\
                "fromBottom=Window['fromBottom'], recess=Window['recess'], conformSurface="+str(tmpWindowSystem[5])+")"
        except:  
            warningData.append("Invalid 'windowSystem' input - data discarded")
            Window = None
        else:
            runOK = runActions(windowDef, myBasePanel, Window, PanelWidth, PanelHeight, PanelThickness)
            if not runOK: warningData.append("Invalid 'windoSystem' input - data discarded")
    panelDefinition.append(tmpWindowSystem)
            
    #------------Create Panel System----------------------------------------------
    tmpPanelSystem = None
    if numInputs > 2 and len(tmpDefinition)>2 and tmpDefinition[2] : tmpPanelSystem = tmpDefinition[2]
    if numInputs > 6 and panelSystem and panelSystem[0]: tmpPanelSystem = panelSystem
    if tmpPanelSystem:
        runOK = runActions(tmpPanelSystem[1], myBasePanel, Window, PanelWidth, PanelHeight, PanelThickness)
        if not runOK: warningData.append("Invalid 'panelSystem' input (pane data)- data discarded")
        runOK = runActions(tmpPanelSystem[2], myBasePanel, Window, PanelWidth, PanelHeight, PanelThickness)
        if not runOK: warningData.append("Invalid 'panelSystem' input (mullions data)- data discarded")
        if Window: 
            runOK = runActions(tmpPanelSystem[3], myBasePanel, Window, PanelWidth, PanelHeight, PanelThickness)
            if not runOK: warningData.append("Invalid 'panelSystem' input (window mullions data)- data discarded")
    panelDefinition.append(tmpPanelSystem)
    
    #------------Create Shading----------------------------------------------
    tmpShadeData = None
    if numInputs > 2 and len(tmpDefinition)>3 and tmpDefinition[3] : tmpShadeData = tmpDefinition[3]    
    if numInputs > 8 and shadingSystems: tmpShadeData = shadingSystems
    if tmpShadeData : 
        tmpWindowSystem = None
        if numInputs > 7 and windowSystem: #create window data without variables to avoid error when solving of parameters
            tmpWindowSystem = copy.deepcopy(Window)
            try:
                if type(tmpWindowSystem['width']) == StringType :  tmpWindowSystem['width'] = eval(tmpWindowSystem['width'])
                if type(tmpWindowSystem['height']) == StringType :  tmpWindowSystem['height'] = eval(tmpWindowSystem['height'])
                if tmpWindowSystem['fromLeft'] == 'C' : tmpWindowSystem['fromLeft'] = (PanelWidth-tmpWindowSystem['width'])/2
                if tmpWindowSystem['fromBottom'] == 'C' : tmpWindowSystem['fromBottom'] = (PanelHeight-tmpWindowSystem['height'])/2  
                if type(tmpWindowSystem['fromLeft']) == StringType :  tmpWindowSystem['fromLeft'] = eval(tmpWindowSystem['fromLeft'])
                if type(tmpWindowSystem['fromBottom']) == StringType :  tmpWindowSystem['fromBottom'] = eval(tmpWindowSystem['fromBottom'])
            except: 
                warningData.append("Invalid window parameters - data discarded")
                tmpWindowSystem = None
        for index, shade in enumerate(tmpShadeData):
            runOK = runActions(shade, myBasePanel, tmpWindowSystem, PanelWidth, PanelHeight, PanelThickness)
            if not runOK: warningData.append("Invalid 'shadingSystem' input - shading system #"+str(index)+ " - data discarded")
            
    panelDefinition.append(tmpShadeData)
            
    #-------------Create Custom Geometry --------------------------------------------------------
    tmpGeometryData = None
    if numInputs > 2 and len(tmpDefinition)>4 and tmpDefinition[4] : tmpGeometryData = tmpDefinition[4]
    if numInputs > 9 and customSystem : tmpGeometryData = customSystem
    if tmpGeometryData and len(tmpGeometryData)==8 and tmpGeometryData[0]:
        try:
            myBasePanel.AddCustomGeometry(tmpGeometryData[0], tmpGeometryData[1], tmpGeometryData[2], tmpGeometryData[3],+\
                tmpGeometryData[4], tmpGeometryData[5], tmpGeometryData[6], tmpGeometryData[7])
        except: 
            raise
            warningData.append("Invalid 'customSystem' input - data discarded")
    panelDefinition.append(tmpGeometryData)

    # ---------run definition if provided---------------------------------------------------
    if numInputs > 2 and len(tmpDefinition)>5 and tmpDefinition[5]: 
        runOK = runActions(tmpDefinition[5], myBasePanel, Window,  PanelWidth, PanelHeight, PanelThickness)
        if not runOK: warningData.append("Invalid 'definitions' input - process incomplete")
        panelDefinition.append(tmpDefinition[5])
        
    # ---------Add Panel Controller -----------
    systemsPanelController = SGLibSystemsPanelController()
    myBasePanel.SetPanelProperty("CustomGeoController", systemsPanelController)
    
    #---------- test Draw -------------
    #myBasePanel.Draw("drawGeometry") #Draw in scene (for checkup geometry only)

    #Wrapup
    rs.EnableRedraw(True)
    sc.doc = ghdoc
    return myBasePanel, panelDefinition

    #----------------------------------------------------------------

def updateProperty(definition, property, value):
    txtStart = definition.find(property+"(")
    if txtStart >= 0 :     
        txtDelete = definition[txtStart : definition.find(")",txtStart)+3]
        definition = definition.replace(txtDelete, "")
        
    definition = property + "(" + str(value) + ")\r\n" + definition

    return definition

def runActions(actionString, myBasePanel, Window=None, PanelWidth=None, PanelHeight=None, PanelThickness=None, brepGeometry=None):
    #print [myBasePanel, Window, PanelWidth, PanelHeight, PanelThickness]
    #print actionString
    try:
        actionList = actionString.rsplit("\r\n")
        for action in actionList: 
            if action : 
                if "Window[" in action and Window == None: continue
                action = "myBasePanel." + action
                codeObj= compile(action,'<string>','single')
                eval(codeObj)
    except:
        return False
    return True
    


if activate : 
    panel, panelDefinition = PanelCreate()
    panelWarningData = panel.GetPanelProperty("WarningData")

if warningData <> []: 
    for warning in warningData: ghenv.Component.AddRuntimeMessage(gh.GH_RuntimeMessageLevel.Warning, str(warning))
if panelWarningData <> []:
    for warning in panelWarningData: ghenv.Component.AddRuntimeMessage(gh.GH_RuntimeMessageLevel.Warning, str("Internal Warning:\n\r" +warning))    
print "done"
# ---------- end systemspanel ----------

# ----
# Panel Viewer (placed at 0,0,0)
boolean_toggle = BooleanToggle(True)
point = Point(Point(0, 0, 0))
panelviewer = SkinDesigner_PanelViewer(panel=flatten(systemspanel.panel), drawGeometry=boolean_toggle, locPoint=point)  # -> out, Breps; inputs panel: list, drawGeometry: Boolean, drawBreps: Boolean
# ---------- panelviewer: Python ----------
# SkinDesigner: A Plugin for Building Skin Design (GPL) started by Santiago Garay

# This file is part of SkinDesigner.
# 
# Copyright (c) 2017, Santiago Garay <sgaray1970@gmail.com> 
# SkinDesigner is free software; you can redistribute it and/or modify 
# it under the terms of the GNU General Public License as published 
# by the Free Software Foundation; either version 3 of the License, 
# or (at your option) any later version. 
# 
# SkinDesigner is distributed in the hope that it will be useful,
# but WITHOUT ANY WARRANTY; without even the implied warranty of 
# MERCHANTABILITY or FITNESS FOR A PARTICULAR PURPOSE. See the 
# GNU General Public License for more details.
# 
# You should have received a copy of the GNU General Public License
# along with SkinDesigner; If not, see <http://www.gnu.org/licenses/>.
# 
# @license GPL-3.0+ <http://spdx.org/licenses/GPL-3.0+>

"""
Use this component to display a panel or panel bay in the scene and/or generate grasshopper breps of the panel elements.

    Args:
        _panel: Panel object or Panel_Bay (list of Panels) generated by Panel components.
        drawGeometry: A boolean that turns on/off drawing of panel object in the scene.
        drawBreps: A boolean that turns on/off outputing grasshopper geometry versions of the panel object.
        _locPoint: A grasshoper Point object object to indicate with the start location in the scene to draw the panel.

    Returns:
        Breps: A list of Breps of the panel elements created when drawBreps is turned on.
"""

ghenv.Component.Name = "SkinDesigner_PanelViewer"
ghenv.Component.NickName = 'PanelViewer'
ghenv.Component.Message = 'VER 0.5.00\nSep_13_2018'
ghenv.Component.Category = "SkinDesigner"
ghenv.Component.SubCategory = "04 | Display"

import Grasshopper.Kernel as gh
import rhinoscriptsyntax as rs
import Rhino as rc
import scriptcontext as sc
#import sys
SGLibPanel = sc.sticky["SGLib_Panel"]

PANEL_TYPES_ID=str(ghenv.Component.InstanceGuid)
warningData = []

def DeleteMockup():
    
    if not sc.sticky["Mockup_Data" + PANEL_TYPES_ID] : return
        
    for panel in sc.sticky["Mockup_Data" + PANEL_TYPES_ID] :
        if isinstance(panel, SGLibPanel):
            panel.HideAll() #same as deleting all panel objects
    

#initialize
offsetX = 0; offsetY = 0; offsetZ = 0
sc.doc = rc.RhinoDoc.ActiveDoc
rs.EnableRedraw(False)


for i, panel in enumerate(_panel): 
    if not isinstance(panel, SGLibPanel): 
        warningData.append( "Invalid panel #" + str(i+1) + " in PanelBay input"); _panel[i] = None
try: 
    while True: _panel.remove(None)
except: pass
if _panel == []: warningData.append("'_panel' input data is missing") 
locP = None

if  type(_locPoint) == rc.Geometry.ArcCurve: 
    success, circle = _locPoint.TryGetCircle()
    locP = circle.Center
elif type(_locPoint) == rc.Geometry.Point3d : locP = _locPoint
else: warningData.append( "I need a circle or point for location")    

if locP: offsetX, offsetY, offsetZ = locP



Mockup_Bay = []


if "Mockup_Data"+PANEL_TYPES_ID not in sc.sticky : sc.sticky["Mockup_Data"+PANEL_TYPES_ID] = []

DeleteMockup()
    
if _panel <> []and _panel[0] and locP:

    for i in range(len(_panel)):
        arrBoxPoints = [[offsetX, offsetY, offsetZ],[offsetX + _panel[i].GetPanelProperty("PanelWidth"), offsetY, offsetZ],\
            [offsetX, offsetY, offsetZ+_panel[i].GetPanelProperty("PanelHeight")],\
            [offsetX + _panel[i].GetPanelProperty("PanelWidth"), offsetY, offsetZ+_panel[i].GetPanelProperty("PanelHeight")]]
        try:
            Mockup_Bay.append(SGLibPanel())
            Mockup_Bay[i].Copy(_panel[i])
            Mockup_Bay[i].RunConditionalDefinition()
            Mockup_Bay[i].MorphPanel(arrBoxPoints)
            Mockup_Bay[i].Draw(drawGeometry)
            if  drawBreps : Breps = Mockup_Bay[i].GetBreps()
        except Exception:
            DeleteMockup()
            raise
        offsetX = offsetX + Mockup_Bay[i].GetPanelProperty("PanelWidth")
    sc.sticky["Mockup_Data" + PANEL_TYPES_ID] = Mockup_Bay
else:
    DeleteMockup()
    
#Wrapup
rs.EnableRedraw(True)
sc.doc = ghdoc


if warningData <> []: 
    for warning in warningData: ghenv.Component.AddRuntimeMessage(gh.GH_RuntimeMessageLevel.Warning, str(warning))
print "done"
# ---------- end panelviewer ----------
